# Grasshopper definition 004 - MOVEMENT of O_U in PYTHON - 001 - FR - export for albert.gh (Grasshopper 1.0.7)

cluster = Cluster(path="\\Mac\Home\Downloads\3Dmove 19-01-10 objects coordinates.csv")
cluster_2 = Cluster(path="\\Mac\Home\Downloads\3Dmove 19-01-10 objects coordinates.csv")
division = Division(A=4, B=2)
addition = Addition(B=Slider(2, range=0.1..6))
box = CenterBox(Base=cluster_2, X=division, Y=division, Z=division)
box_2 = CenterBox(Base=cluster, X=expr("x*3", addition), Y=addition, Z=addition)
preview = CustomPreview(
    Geometry=simplify(graft(box)),
    Material=simplify(graft(Tree({0}: [{diffuse=RGB(176, 48, 71), emission=RGB(176, 48, 71), shine=0, specular=RGB(176, 48, 71), transparency=0}], {1}: [{diffuse=RGB(82, 42, 66), emission=RGB(82, 42, 66), shine=0, specular=RGB(82, 42, 66), transparency=0}], {2}: [{diffuse=RGB(52, 51, 61), emission=RGB(52, 51, 61), shine=0, specular=RGB(52, 51, 61), transparency=0}], {3}: [{diffuse=RGB(166, 124, 0), emission=RGB(166, 124, 0), shine=0, specular=RGB(166, 124, 0), transparency=0}], {4}: [{diffuse=RGB(82, 42, 66), emission=RGB(82, 42, 66), shine=0, specular=RGB(82, 42, 66), transparency=0}], {5}: [{diffuse=RGB(166, 124, 0), emission=RGB(166, 124, 0), shine=0, specular=RGB(166, 124, 0), transparency=0}]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))))
preview_2 = CustomPreview(
    Geometry=simplify(graft(box_2)),
    Material=simplify(graft(Tree({0}: [{diffuse=RGB(82, 42, 66), emission=RGB(82, 42, 66), shine=0, specular=RGB(82, 42, 66), transparency=0}], {1}: [{diffuse=RGB(166, 124, 0), emission=RGB(166, 124, 0), shine=0, specular=RGB(166, 124, 0), transparency=0}], {2}: [{diffuse=RGB(145, 65, 38), emission=RGB(145, 65, 38), shine=0, specular=RGB(145, 65, 38), transparency=0}], {3}: [{diffuse=RGB(176, 48, 71), emission=RGB(176, 48, 71), shine=0, specular=RGB(176, 48, 71), transparency=0}], {4}: [{diffuse=RGB(13, 122, 128), emission=RGB(13, 122, 128), shine=0, specular=RGB(13, 122, 128), transparency=0}], {5}: [{diffuse=RGB(189, 77, 17), emission=RGB(189, 77, 17), shine=0, specular=RGB(189, 77, 17), transparency=0}]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))))

# ==== cluster Cluster
path = ClusterInput()
path_2 = FilePath(path)
file = ReadFile(File=path_2, PerLineParse=True)
split = TextSplit(Text=file, Separators=";")  # -> simplify(flatten(Result))
R = ClusterOutput(split)
