# Grasshopper definition 2019 GH File Albert Week 1,1.gh (Grasshopper 1.0.7)
# Copyright: 2015
# plug-ins: ElkGHComponents

panel = Panel("MOVER")
unit_z = UnitZ(Factor=Slider(400, range=0..1000))

file_path = FilePath("C:\Users\Albert Burgers\Downloads\map (2).osm")  # disabled
polyline = PolyLine(Closed=False)  # disabled

number_slider = Slider(8, range=0..10)  # disabled
number_slider_2 = Slider(8, range=0..10)  # disabled
number_slider_3 = Slider(6, range=0..10)  # disabled

number_slider_4 = Slider(5, range=0..100)  # disabled
curve = Curve([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])  # disabled
number_slider_5 = Slider(31, range=0..60)  # disabled
pi = Pi(Factor=number_slider_4)  # disabled
list_item = ListItem(List=curve, Index=0, Wrap=True)  # -> flatten(Item); disabled
construct_domain = ConstructDomain(DomainStart=0, DomainEnd=pi)  # disabled
perp_frames = PerpFrames(Curve=list_item, Count=number_slider_5, Align=True)  # -> Frames, Parameters; disabled
range = Range(Domain=construct_domain, Steps=number_slider_5)  # disabled
number_slider_6 = Slider(30, range=0..100)  # disabled
number_slider_7 = Slider(0.3, range=0..1)  # disabled
expression = Expression(r=number_slider_6, t=range, Expression="r*sin(t)")  # disabled
expression_2 = Expression(r=number_slider_6, t=range, Expression="r*cos(t)")  # disabled
point_oriented = PointOriented(BasePlane=perp_frames.Frames, UComponent=expression, VComponent=expression_2, WComponent=0)  # disabled
interpolate = Interpolate(Vertices=point_oriented, Degree=3, Periodic=False, KnotStyle=1)  # -> flatten(Curve), Length, Domain; disabled
curve_2 = Curve([list_item, interpolate.Curve])  # disabled
bounding_box = BoundingBox(Content=curve_2, Plane=PlaneXY(0, 0, 0), UnionBox=True)  # -> Box, Box_2; disabled
box_properties = BoxProperties(Box=bounding_box.Box)  # -> Center, Diagonal, Area, Volume, Degeneracy; disabled
deconstruct_vector = DeconstructVector(Vector=box_properties.Diagonal)  # -> XComponent, YComponent, ZComponent; disabled
integer = Integer(deconstruct_vector.YComponent)  # disabled
integer_2 = Integer(deconstruct_vector.ZComponent)  # disabled
integer_3 = Integer(deconstruct_vector.XComponent)  # disabled
panel_3 = Panel([integer_3, integer, integer_2])  # disabled
expression_3 = Expression(Variable_x=deconstruct_vector.XComponent, Variable_y=integer_3, Expression="x/(2*y)")  # disabled
expression_4 = Expression(Variable_x=deconstruct_vector.ZComponent, Variable_y=integer_2, Expression="x/(2*y)")  # disabled
expression_5 = Expression(Variable_x=deconstruct_vector.YComponent, Variable_y=integer, Expression="x/(2*y)")  # disabled
range_2 = Range(Domain=Domain(0, 1), Steps=integer_2)  # disabled
range_3 = Range(Domain=Domain(0, 1), Steps=integer_3)  # disabled
range_4 = Range(Domain=Domain(0, 1), Steps=integer)  # disabled
cross_reference = CrossReference(ListListA=range_3, ListListB=range_4, ListC=range_2, CrossMode=1)  # -> ListListA, ListListB, ListC; disabled
evaluate_box = EvaluateBox(
    Box=bounding_box.Box,
    UParameter=cross_reference.ListListA,
    VParameter=cross_reference.ListListB,
    WParameter=cross_reference.ListC)  # -> Plane, Point, Include; disabled
number_slider_8 = Slider(3.856, range=0..10)  # disabled
center_box = CenterBox(Base=evaluate_box.Plane, X=expression_3, Y=expression_5, Z=expression_4)  # disabled
pull_point = PullPoint(Point=evaluate_box.Point, Geometry=graft(curve_2), ClosestOnly=True)  # -> ClosestPoint, Distance; disabled
collision_one_many = CollisionOneMany(Collider=curve_2, Obstacles=graft(center_box))  # -> Collision, Index; disabled
expression_6 = Expression(Variable_x=pull_point.Distance, Variable_y=number_slider_8, Expression="if(x<y,True,False)")  # disabled
flip_matrix = FlipMatrix(Data=expression_6)  # disabled
list_item_2 = ListItem(List=collision_one_many.Collision, Index=0, Wrap=True)  # -> flatten(Item), flatten(Item1); disabled
list_item_3 = ListItem(List=flip_matrix, Index=0, Wrap=True)  # -> flatten(Item), flatten(Item1); disabled
panel_4 = Panel(list_item_3.Item)  # disabled
panel_5 = Panel("true")  # disabled
panel_6 = Panel("false")  # disabled
gate_not = GateNot(A=list_item_3.Item1)  # disabled
gate_or = GateOr(A=list_item_3.Item, B=list_item_3.Item1)  # disabled
gate_and = GateAnd(A=list_item_3.Item, B=gate_not)  # disabled
cull_pattern = CullPattern(List=center_box, CullPattern=gate_and)  # disabled
panel_7 = Panel(gate_or)  # disabled

# ---- group: Uniform scale
number_slider_9 = Slider(0.1, range=0..1)  # disabled
deconstruct_vector_2 = DeconstructVector()  # -> XComponent, YComponent, ZComponent; disabled

# ----
number_slider_10 = Slider(1, range=0..1)  # disabled

# ---- group: Uniform scale
number_slider_11 = Slider(0.5, range=0..10)  # disabled
deconstruct_vector_3 = DeconstructVector()  # -> XComponent, YComponent, ZComponent; disabled

# ----
center_box_2 = CenterBox(Base=PlaneXY(0, 0, 0), X=1, Y=1, Z=1)  # disabled

polyline_2 = PolyLine(Closed=False)  # disabled
polyline_3 = PolyLine(Closed=False)  # disabled
polyline_4 = PolyLine(Closed=False)  # disabled
polyline_5 = PolyLine(Closed=False)  # disabled
polyline_6 = PolyLine(Closed=False)  # disabled
brep = Brep()  # disabled

box_properties_2 = BoxProperties(Box=center_box_2)  # -> Center, Diagonal, Area, Volume, Degeneracy; disabled
colour_swatch = ColourSwatch(SwatchColor=RGB(189, 189, 189))  # disabled

initial_geometry = ClusterInput()  # disabled
number_slider_12 = Slider(2, range=0..5)  # disabled
boolean_toggle = BooleanToggle(True)  # disabled
file_path_2 = FilePath("C:\Users\Albert Burgers\Desktop\Exceltest 1.xlsx")  # disabled
standard_height = Slider(3, range=0..10)  # disabled
number_slider_13 = Slider(1, range=0..10)  # disabled
list_item_4 = ListItem(Index=number_slider_13, Wrap=True)  # disabled
square_root = SquareRoot(Value=list_item_4)  # disabled
center_box_3 = CenterBox(Base=PlaneXY(0, 0, 0), X=square_root, Y=square_root, Z=standard_height)  # disabled
panel_8 = Panel(square_root)  # disabled

number_slider_14 = Slider(8, range=0..10)  # disabled
number_slider_15 = Slider(6, range=0..10)  # disabled
number_slider_16 = Slider(6, range=0..10)  # disabled
custom_preview = CustomPreview(Geometry=[polyline_6, polyline_5, polyline_3, polyline_4, polyline_2, brep], Material=colour_swatch)  # disabled
number_slider_17 = Slider(4, range=0..10)  # disabled

# ---- group: Uniform scale
number_slider_18 = Slider(0.113, range=0..1)  # disabled
deconstruct_vector_4 = DeconstructVector()  # -> XComponent, YComponent, ZComponent; disabled

# ----
number_slider_19 = Slider(34, range=0..100)  # disabled
brep_2 = Brep(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)  # disabled
bounding_box_2 = BoundingBox(Content=brep_2, Plane=PlaneXY(0, 0, 0))  # -> Box, Box_2; disabled
box_properties_3 = BoxProperties(Box=bounding_box_2.Box)  # -> Center, Diagonal, Area, Volume, Degeneracy; disabled
deconstruct_vector_5 = DeconstructVector(Vector=box_properties_3.Diagonal)  # -> XComponent, YComponent, ZComponent; disabled
expression_7 = Expression(Variable_x=deconstruct_vector_4.YComponent, Expression="ceiling(x)")  # disabled
expression_8 = Expression(Variable_x=deconstruct_vector_4.ZComponent, Expression="ceiling(x)")  # disabled
expression_9 = Expression(Variable_x=deconstruct_vector_4.XComponent, Expression="ceiling(x)")  # disabled
expression_10 = Expression(Variable_x=deconstruct_vector_5.ZComponent, Variable_y=expression_8, Expression="x/(2*Y)")  # disabled
expression_11 = Expression(Variable_x=deconstruct_vector_5.YComponent, Variable_y=expression_7, Expression="x/(2*Y)")  # disabled
expression_12 = Expression(Variable_x=deconstruct_vector_5.XComponent, Variable_y=expression_9, Expression="x/(2*Y)")  # disabled
range_5 = Range(Domain=Domain(0, 1), Steps=expression_9)  # disabled
range_6 = Range(Domain=Domain(0, 1), Steps=expression_7)  # disabled
range_7 = Range(Domain=Domain(0, 1), Steps=expression_8)  # disabled
center_box_4 = CenterBox(Base=PlaneXY(0, 0, 0), X=expression_12, Y=expression_11, Z=expression_10)  # disabled
number_slider_20 = Slider(1, range=0..1)  # disabled
cross_reference_2 = CrossReference(ListListA=range_5, ListListB=range_6, ListC=range_7, CrossMode=1)  # -> ListListA, ListListB, ListC; disabled
evaluate_box_2 = EvaluateBox(
    Box=bounding_box_2.Box,
    UParameter=cross_reference_2.ListListA,
    VParameter=cross_reference_2.ListListB,
    WParameter=cross_reference_2.ListC)  # -> Plane, Point, Include; disabled
mesh_box = MeshBox(Base=center_box_4, XCount=number_slider_20, YCount=number_slider_20, ZCount=number_slider_20)  # disabled
move = Move(Geometry=mesh_box, Motion=evaluate_box_2.Point)  # -> Geometry, Transform; disabled

# ---- group: TURN THIS BACK ON
mesh_sphere = MeshSphere(Base=PlaneXY(0, 0, 0), Radius=number_slider_19, UCount=10, VCount=20)  # disabled
sphere = Sphere(Base=PlaneXY(0, 0, 0), Radius=number_slider_19)  # disabled

# ----
number_slider_21 = Slider(8, range=0..10)  # disabled
number_slider_22 = Slider(8, range=0..10)  # disabled
number_slider_23 = Slider(6, range=0..10)  # disabled
center_box_5 = CenterBox(Base=PlaneXY(0, 0, 0), X=number_slider_21, Y=number_slider_22, Z=1)  # disabled
box_properties_4 = BoxProperties(Box=center_box_5)  # -> Center, Diagonal, Area, Volume, Degeneracy; disabled
number_slider_24 = Slider(2, range=0.1..6)

# ---- group: TURN THIS BACK ON
collision_one_many_2 = CollisionOneMany(Collider=move.Geometry, Obstacles=brep_2)  # -> Collision, Index; disabled
cull_pattern_2 = CullPattern(List=move.Geometry, CullPattern=collision_one_many_2.Collision)  # disabled

# ---- group: RHINO VIEWPORT TOOL / VOXEL GRID
number_slider_25 = Slider(1, range=0..1)  # disabled
number_slider_26 = Slider(1.2, range=0..10)  # disabled
multiplication = Multiplication(A=number_slider_25, B=number_slider_26)  # disabled

# ---- group: RHINO VIEWPORT TOOL / INITIAL STARTING POINT
panel_9 = Panel("0,0,0")  # disabled
point = Point(panel_9)  # disabled

# ----
other = ColourSwatch(SwatchColor=RGB(105, 112, 120))  # disabled
work = ColourSwatch(SwatchColor=RGB(232, 176, 44))  # disabled
civic = ColourSwatch(SwatchColor=RGB(184, 108, 84))  # disabled
social = ColourSwatch(SwatchColor=RGB(227, 43, 74))  # disabled
shopping = ColourSwatch(SwatchColor=RGB(62, 162, 163))  # disabled
sports = ColourSwatch(SwatchColor=RGB(242, 105, 41))  # disabled
religion = ColourSwatch(SwatchColor=RGB(52, 51, 61))  # disabled
education = ColourSwatch(SwatchColor=RGB(191, 196, 153))  # disabled
house = ColourSwatch(SwatchColor=RGB(99, 65, 91))  # disabled

# ---- group: RHINO VIEWPORT TOOL
boolean_toggle_2 = BooleanToggle(True)  # disabled
number_slider_27 = Slider(4, range=0..10)  # disabled
slider = Slider(900, range=100..1600)  # disabled
boolean_toggle_3 = BooleanToggle(True)  # disabled
slider_2 = Slider(900, range=100..2000)  # disabled
automatic_file_name_rebuild_solution = Panel("J:\Temp\001")  # disabled
view_capture_jpeg = DotNETVBScriptLEGACY(
    FileName=automatic_file_name_rebuild_solution,
    blnSave=boolean_toggle_2,
    Resolution_width=slider,
    Resolution_height=slider_2,
    PerspectiveYea=boolean_toggle_3,
    DisplayMode=number_slider_27)  # -> out, A; disabled
# ---------- view_capture_jpeg: VB ----------
    '////// Marc Hoppermann ///////////tweaked by Damien Almor ///////rewritten for curves by to]///////adapted by u]...www.utos.blogspot.com
    '///readapted to Batch ViewCapture by Victor Leung @ www.dreamationworks.com

    ' Note1: The script is actually calling Rhino commands.
    ' Note2: Remember you have to draw something and is selectable for the script to function. The script uses _SelAll then _Zoom _Selected
    ' Note3: After you toggle blnSave to True, a new viewport will popup, be patient while Rhino work, and wait for that viewport to disappear befor clicking on anything.
    ' Note4: The component is not stable if you try to mouse click on anywhere while the saving process is running. Some stupid move may crash your programme, save RH and GH files before using this component.

    ' FileName :  String Input    = Supply with the path and file name without ".jpg" extension : e.g.: "C:\Temp\001" (Without the quotes)
    ' blnSave :   Boolean Input   = Saves when toggles to True (Remember to toggle back to False after use, otherwise the script will re-run itself during next update)
    ' Resolution_width :    Integer Input = Resolution for the captured image
    ' Resolution_height :   Integer Input = well...
    ' TopYea :    Boolean Input =   Toggles if the Top View is captured (Default is False if not connected)
    ' FrontYea :  Boolean Input =   Toggles if the Front View is captured (Default is False if not connected)
    ' ...Yea :    Boolean Input =   Toggles if the corresponding View is captured (Default is False if not connected)
    ' DisplayMode : Integer Input(0-4) = Sets the display Mode 0:Shaded 1:Wireframe 2:Rendered 3:Ghosted 4:XRay Default:Shaded

    If blnSave Then

      'For i As Int32 = 0 To arrcrv.Count - 1
      app.RunScript("_NewFloatingViewport Projection=Perspective")
      app.RunScript("-ViewportProperties _Size " & Resolution_width * 500 / Resolution_height & " " & 500 & " _Display _Shaded _Enter")

      Select Case DisplayMode  '(If you know what you are doing and have other Custom Display Mode, you are welcomed to add it down here)
        Case 0
          app.RunScript(" _-SetDisplayMode _Mode _Shaded")
        Case 1
          app.RunScript(" _-SetDisplayMode _Mode _Wireframe")
        Case 2
          app.RunScript(" _-SetDisplayMode _Mode _Rendered")
        Case 3
          app.RunScript(" _-SetDisplayMode _Mode _Ghosted")
        Case 4
          app.RunScript(" _-SetDisplayMode _Mode _Pen")
        Case Else
          app.RunScript(" _-SetDisplayMode _Mode _Pen")
      End Select
      'app.RunScript(Resolution_width & "_Enter")
      'app.RunScript(Resolution_height & "_Enter")
      'app.RunScript("_Enter")

      doc.UnselectAll

      print(TopYea)

      If TopYea Then
        MRhinoView.EnableDrawing(False)
        app.RunScript("'_SelAll")
        app.RunScript("'_SetView _World _Top")
        app.RunScript("'_Zoom _Selected")
        app.RunScript("'_SelNone")
        'app.RunScript(Chr(34) & "Exporting Top View...")
        MRhinoView.EnableDrawing(True)
        app.RunScript("-viewcapturetofile " & FileName & "_top.jpg _DrawGrid=No Width=" & Resolution_width & " Height=" & Resolution_height & " _Enter")
      End If

      If LeftYea Then
        MRhinoView.EnableDrawing(False)
        app.RunScript("'_SelAll")
        app.RunScript("'_SetView _World _Left")
        app.RunScript("'_Zoom _Selected")
        app.RunScript("'_SelNone")
        'app.RunScript(Chr(34) & "Exporting Left View...")
        MRhinoView.EnableDrawing(True)
        app.RunScript("-viewcapturetofile " & FileName & "_left.jpg _DrawGrid=No Width=" & Resolution_width & " Height=" & Resolution_height & " _Enter")
      End If

      If RightYea Then
        MRhinoView.EnableDrawing(False)
        app.RunScript("'_SelAll")
        app.RunScript("'_SetView _World _Right")
        app.RunScript("'_Zoom _Selected")
        app.RunScript("'_SelNone")
        'app.RunScript(Chr(34) & "Exporting Right View ...")
        MRhinoView.EnableDrawing(True)
        app.RunScript("-viewcapturetofile " & FileName & "_right.jpg _DrawGrid=No Width=" & Resolution_width & " Height=" & Resolution_height & " _Enter")
      End If

      If FrontYea Then
        MRhinoView.EnableDrawing(False)
        app.RunScript("'_SelAll")
        app.RunScript("'_SetView _World _Front")
        app.RunScript("'_Zoom _Selected")
        app.RunScript("'_SelNone")
        'app.RunScript(Chr(34) & "Exporting Front View ...")
        MRhinoView.EnableDrawing(True)
        app.RunScript("-viewcapturetofile " & FileName & "_front.jpg _DrawGrid=No Width=" & Resolution_width & " Height=" & Resolution_height & " _Enter")
      End If

      If BackYea Then
        MRhinoView.EnableDrawing(False)
        app.RunScript("'_SelAll")
        app.RunScript("'_SetView _World _Back")
        app.RunScript("'_Zoom _Selected")
        app.RunScript("'_SelNone")
        'app.RunScript(Chr(34) & "Exporting Back View ...")
        MRhinoView.EnableDrawing(True)
        app.RunScript("-viewcapturetofile " & FileName & "_back.jpg _DrawGrid=No Width=" & Resolution_width & " Height=" & Resolution_height & " _Enter")
      End If

      If PerspectiveYea Then
        MRhinoView.EnableDrawing(False)
        app.RunScript("'_SelAll")
        app.RunScript("'_SetView _World _IsoMetric")
        app.RunScript("'_Zoom _Selected")
        app.RunScript("'_SelNone")
        'app.RunScript(Chr(34) & "Exporting Perspective View ...")
        MRhinoView.EnableDrawing(True)
        app.RunScript("-viewcapturetofile " & FileName & "_perspective.jpg _DrawGrid=No Width=" & Resolution_width & " Height=" & Resolution_height & " _Enter")
      End If

      app.RunScript("_CloseViewport")
      print("Done! Jpgs exported to " & FileName)

    Else print("inactive")

    End If
# ---------- end view_capture_jpeg ----------
write_file_status = Panel(view_capture_jpeg.out)  # disabled

# ---- group: RHINO VIEWPORT TOOL / UNIFORM SCALE BOX
number_slider_28 = Slider(5, range=0..100)  # disabled
integer_4 = Integer(number_slider_28)  # disabled

# ---- group: RHINO VIEWPORT TOOL / EXACT SCALE
number_slider_29 = Slider(3, range=0..100)  # disabled
number_slider_30 = Slider(2, range=0..100)  # disabled
number_slider_31 = Slider(2, range=0..100)  # disabled
integer_5 = Integer(number_slider_29)  # disabled
integer_6 = Integer(number_slider_31)  # disabled
integer_7 = Integer(number_slider_30)  # disabled

# ---- group: RHINO VIEWPORT TOOL
unit_x = UnitX(Factor=multiplication)  # disabled
unit_y = UnitY(Factor=multiplication)  # disabled
unit_z_2 = UnitZ(Factor=multiplication)  # disabled
move_2 = Move(Geometry=point, Motion=unit_x)  # -> Geometry, Transform; disabled
move_3 = Move(Geometry=point, Motion=unit_y)  # -> Geometry, Transform; disabled
move_4 = Move(Geometry=point, Motion=unit_z_2)  # -> Geometry, Transform; disabled
move_5 = Move(Geometry=move_2.Geometry, Motion=unit_z_2)  # -> Geometry, Transform; disabled
move_6 = Move(Geometry=move_3.Geometry, Motion=unit_z_2)  # -> Geometry, Transform; disabled
move_7 = Move(Geometry=move_2.Geometry, Motion=unit_y)  # -> Geometry, Transform; disabled
polyline_7 = PolyLine(Vertices=[move_2.Geometry, point], Closed=False)  # disabled
polyline_8 = PolyLine(Vertices=[point, move_3.Geometry], Closed=False)  # disabled
polyline_9 = PolyLine(Vertices=[point, move_4.Geometry], Closed=False)  # disabled
polyline_10 = PolyLine(Vertices=[move_2.Geometry, move_5.Geometry], Closed=False)  # disabled
polyline_11 = PolyLine(Vertices=[move_6.Geometry, move_3.Geometry], Closed=False)  # disabled
polyline_12 = PolyLine(Vertices=[move_4.Geometry, move_5.Geometry], Closed=False)  # disabled
polyline_13 = PolyLine(Vertices=[move_6.Geometry, move_4.Geometry], Closed=False)  # disabled
polyline_14 = PolyLine(Vertices=[move_2.Geometry, move_7.Geometry], Closed=False)  # disabled
polyline_15 = PolyLine(Vertices=[move_3.Geometry, move_7.Geometry], Closed=False)  # disabled
flip_curve = FlipCurve(Curve=polyline_13)  # -> Curve, Flag; disabled
flip_curve_2 = FlipCurve(Curve=polyline_12)  # -> Curve, Flag; disabled
loft = Loft(
    Curves=[polyline_7, flip_curve_2.Curve],
    Options={Adjust=False, Closed=False, LoftEnds=0, LoftSimp=0, LoftType=0, Rebuild=10, Refit=0.01})  # disabled
loft_2 = Loft(
    Curves=[polyline_8, flip_curve.Curve],
    Options={Adjust=False, Closed=False, LoftEnds=0, LoftSimp=0, LoftType=0, Rebuild=10, Refit=0.01})  # disabled
loft_3 = Loft(
    Curves=[polyline_14, polyline_8],
    Options={Adjust=False, Closed=False, LoftEnds=0, LoftSimp=0, LoftType=0, Rebuild=10, Refit=0.01})  # disabled
geometry = Geometry([polyline_8, polyline_9, polyline_11, polyline_13])  # disabled
geometry_2 = Geometry([polyline_7, polyline_9, polyline_10, polyline_12])  # disabled
geometry_3 = Geometry([polyline_15, polyline_14, polyline_8, polyline_7])  # disabled
number_slider_32 = Slider(1, range=0..100)  # disabled
extrude = Extrude(Base=loft_3, Direction=unit_z_2)  # disabled
box_array = BoxArray(Geometry=geometry_2, Cell=extrude, XCount=integer_4, YCount=number_slider_32, ZCount=integer_4)  # -> Geometry, Transform; disabled
box_array_2 = BoxArray(Geometry=geometry, Cell=extrude, XCount=number_slider_32, YCount=integer_4, ZCount=integer_4)  # -> Geometry, Transform; disabled
box_array_3 = BoxArray(Geometry=geometry_3, Cell=extrude, XCount=integer_4, YCount=integer_4, ZCount=number_slider_32)  # -> Geometry, Transform; disabled
box_array_4 = BoxArray(Geometry=loft, Cell=extrude, XCount=integer_5, YCount=number_slider_32, ZCount=integer_7)  # -> Geometry, Transform; disabled
box_array_5 = BoxArray(Geometry=loft_2, Cell=extrude, XCount=number_slider_32, YCount=integer_6, ZCount=integer_7)  # -> Geometry, Transform; disabled
box_array_6 = BoxArray(Geometry=loft_3, Cell=extrude, XCount=integer_5, YCount=integer_6, ZCount=number_slider_32)  # -> Geometry, Transform; disabled
number_slider_33 = Slider(270, range=0..1000)  # disabled
xy_plane = XYPlane(Origin=Point(0, 0, 0))  # disabled
rotate = Rotate(
    Geometry=[box_array.Geometry, box_array_3.Geometry, box_array_2.Geometry],
    Angle=degrees(number_slider_33),
    Plane=xy_plane)  # -> Geometry, Transform; disabled
rotate_2 = Rotate(
    Geometry=[box_array_4.Geometry, box_array_5.Geometry, box_array_6.Geometry],
    Angle=degrees(number_slider_33),
    Plane=xy_plane)  # -> Geometry, Transform; disabled

number_slider_34 = Slider(180, range=0..1000)  # disabled
number_slider_35 = Slider(0, range=0..1000)  # disabled
number_slider_36 = Slider(180, range=0..1000)  # disabled
geometry_4 = Geometry(rotate_2.Geometry)  # disabled
xz_plane = XZPlane(Origin=Point(0, 0, 0))  # disabled
yz_plane = YZPlane(Origin=Point(0, 0, 0))  # disabled
xy_plane_2 = XYPlane(Origin=Point(0, 0, 0))  # disabled
number_slider_37 = Slider(0.5, range=0..10)  # disabled
number_slider_38 = Slider(1.2, range=0..10)  # disabled
rotate_3 = Rotate(Geometry=geometry_4, Angle=degrees(number_slider_34), Plane=xz_plane)  # -> Geometry, Transform; disabled
rotate_4 = Rotate(Geometry=rotate_3.Geometry, Angle=degrees(number_slider_35), Plane=yz_plane)  # -> Geometry, Transform; disabled
rotate_5 = Rotate(Geometry=rotate_4.Geometry, Angle=degrees(number_slider_36), Plane=xy_plane_2)  # -> Geometry, Transform; disabled
mirror = Mirror(Geometry=rotate_5.Geometry, Plane=yz_plane)  # -> Geometry, Transform; disabled
multiplication_2 = Multiplication(A=integer_5, B=number_slider_38)  # disabled
multiplication_3 = Multiplication(A=integer_6, B=number_slider_38)  # disabled
multiplication_4 = Multiplication(A=integer_7, B=number_slider_38)  # disabled
number_slider_39 = Slider(250, range=0..1000)  # disabled
multiplication_5 = Multiplication(A=multiplication_2, B=number_slider_37)  # disabled
multiplication_6 = Multiplication(A=multiplication_3, B=number_slider_37)  # disabled
multiplication_7 = Multiplication(A=multiplication_4, B=number_slider_37)  # disabled
number_slider_40 = Slider(1, range=-10..10)  # disabled
number_slider_41 = Slider(1, range=-10..10)  # disabled
point_2 = Point(Point(0, 0, 0))  # disabled
number_slider_42 = Slider(-1, range=-10..10)  # disabled
center_box_6 = CenterBox(Base=point_2, X=multiplication_6, Y=multiplication_5, Z=multiplication_7)  # disabled
multiplication_8 = Multiplication(A=multiplication_7, B=number_slider_40)  # disabled
multiplication_9 = Multiplication(A=multiplication_6, B=number_slider_41)  # disabled
multiplication_10 = Multiplication(A=multiplication_5, B=number_slider_42)  # disabled
point_3 = Point(Point(0, 0, 0))  # disabled
number_slider_43 = Slider(250, range=0..1000)  # disabled
center_box_7 = CenterBox(Base=point_3, X=number_slider_39, Y=number_slider_39, Z=number_slider_39)  # disabled
panel_10 = Panel(multiplication_10)  # disabled
panel_11 = Panel(multiplication_9)  # disabled
panel_12 = Panel(multiplication_8)  # disabled
square = Square(Value=multiplication_5)  # disabled
square_2 = Square(Value=multiplication_6)  # disabled
square_3 = Square(Value=multiplication_7)  # disabled
vector_xyz = VectorXYZ(XComponent=multiplication_9, YComponent=multiplication_10, ZComponent=multiplication_8)  # -> Vector, Length; disabled
move_8 = Move(Geometry=center_box_6, Motion=vector_xyz.Vector)  # -> Geometry, Transform; disabled
unit_z_3 = UnitZ(Factor=number_slider_43)  # disabled
addition = Addition(A=square, B=square_2, C=square_3)  # disabled
square_root_2 = SquareRoot(Value=addition)  # disabled
move_9 = Move(Geometry=center_box_7, Motion=unit_z_3)  # -> Geometry, Transform; disabled

colour_swatch_2 = ColourSwatch(SwatchColor=RGBA(0, 0, 0, 150))  # disabled
geometry_5 = Geometry(rotate_2.Geometry)  # disabled
colour_swatch_3 = ColourSwatch(SwatchColor=RGBA(0, 0, 0, 30))  # disabled
geometry_6 = Geometry(rotate.Geometry)  # disabled
geometry_7 = Geometry(move_8.Geometry)  # disabled
colour_swatch_4 = ColourSwatch(SwatchColor=RGBA(102, 102, 102, 2))  # disabled
custom_preview_2 = CustomPreview(Geometry=geometry_6, Shader=colour_swatch_2)  # disabled
custom_preview_3 = CustomPreview(Geometry=geometry_5, Shader=colour_swatch_3)  # disabled
custom_preview_4 = CustomPreview(Geometry=geometry_7, Shader=colour_swatch_4)  # disabled

# ---- group: Half shape
# Symmetry can be defined as
# a transformation, in which case
# it remains a 'live' part of a file.
point_4 = Point([Point(0, 0, 0), Point(15, 0, 0), Point(20, 10, 0), Point(20, 30, 0), Point(10, 45, 0), Point(0, 45, 0)])  # disabled
nurbs_curve = NurbsCurve(Vertices=point_4, Degree=3, Periodic=False)  # -> Curve, Length, Domain; disabled

# ---- group: Retail
brep_3 = Brep(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)  # disabled

brep_4 = Brep(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)  # disabled

brep_5 = Brep(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)  # disabled

brep_6 = Brep(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)  # disabled

brep_7 = Brep(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)  # disabled

brep_8 = Brep(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)  # disabled

brep_9 = Brep(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)  # disabled

brep_10 = Brep(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)  # disabled

brep_11 = Brep(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)  # disabled

brep_12 = Brep(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)  # disabled

brep_13 = Brep(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)  # disabled

brep_14 = Brep(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)  # disabled

brep_15 = Brep(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)  # disabled

brep_16 = Brep(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)  # disabled

# ---- group: Mirror and join to create full shape
mirror_2 = Mirror(Geometry=nurbs_curve.Curve, Plane=PlaneYZ(0, 0, 0))  # -> Geometry, Transform; disabled
join_curves = JoinCurves(Curves=[nurbs_curve.Curve, mirror_2.Geometry], Preserve=False)  # disabled

# ----
solid_union = SolidUnion(Breps=[brep_7, brep_3, brep_5, brep_9, brep_6, brep_4, brep_8])  # disabled

solid_union_2 = SolidUnion(Breps=[brep_14, brep_10, brep_12, brep_16, brep_13, brep_11, brep_15])  # disabled

# ---- group: Measure bounds of full shape
# Finding the horizontal and
# vertical extent of a shape can
# be done using bounding boxes.
bounding_box_3 = BoundingBox(Content=join_curves, Plane=PlaneXY(0, 0, 0))  # -> Box, Box_2; disabled
box_corners = BoxCorners(Box=bounding_box_3.Box)  # -> CornerA, CornerB, CornerC, CornerD, CornerE, CornerF, CornerG, CornerH; disabled
distance = Distance(PointA=box_corners.CornerC, PointB=box_corners.CornerD)  # disabled
distance_2 = Distance(PointA=box_corners.CornerE, PointB=box_corners.CornerG)  # disabled

# ----
xy_plane_3 = XYPlane(Origin=Point(0, 0, 0))  # disabled
box = Box({Plane=PlaneXY(-38.02261219, -21.63326362, 0), X=Domain(0, 49.51774281), Y=Domain(0, 58.10195767), Z=Domain(0, 33.72050103)})  # disabled
bounding_box_4 = BoundingBox(Content=solid_union, Plane=xy_plane_3)  # -> Box, Box_2; disabled

xy_plane_4 = XYPlane(Origin=Point(0, 0, 0))  # disabled
box_2 = Box({Plane=PlaneXY(-38.02261219, -21.63326362, 0), X=Domain(0, 49.51774281), Y=Domain(0, 58.10195767), Z=Domain(0, 33.72050103)})  # disabled
bounding_box_5 = BoundingBox(Content=solid_union_2, Plane=xy_plane_4)  # -> Box, Box_2; disabled

number_slider_44 = Slider(8, range=0..30)  # disabled
number_slider_45 = Slider(3, range=0..30)  # disabled
number_slider_46 = Slider(6, range=0..30)  # disabled

brep_17 = Brep(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)  # disabled
number_slider_47 = Slider(2, range=0..10)  # disabled
division = Division(A=number_slider_46, B=number_slider_47)  # disabled
division_2 = Division(A=number_slider_45, B=number_slider_47)  # disabled
division_3 = Division(A=number_slider_44, B=number_slider_47)  # disabled
number_slider_48 = Slider(0, range=0..100)  # disabled
list_item_5 = ListItem(Index=number_slider_48, Wrap=True)  # disabled
center_box_8 = CenterBox(Base=list_item_5, X=division, Y=division_3, Z=division_2)  # disabled
center_box_9 = CenterBox(Base=PlaneXY(0, 0, 0), X=division, Y=division_3, Z=division_2)  # disabled
box_rectangle = BoxRectangle(Height=Domain(0, 10))  # disabled

number_slider_49 = Slider(8, range=0..30)  # disabled
number_slider_50 = Slider(3, range=0..30)  # disabled
number_slider_51 = Slider(6, range=0..30)  # disabled

# ---- group: Make big enough grid
# RELAY objects can be used to organise
# the wiring in a file. Double click on wires
# to insert them, and double click on relays
# to remove them.
hexagonal = Hexagonal(Plane=box_corners.CornerA, Size=1.5, ExtentX=expr("x/2", distance), ExtentY=expr("x/3", distance_2))  # -> Cells, flatten(Points); disabled

# ----
number_slider_52 = Slider(2, range=0..10)  # disabled
division_4 = Division(A=number_slider_51, B=number_slider_52)  # disabled
division_5 = Division(A=number_slider_50, B=number_slider_52)  # disabled
division_6 = Division(A=number_slider_49, B=number_slider_52)  # disabled

# ---- group: Remove exterior points
point_in_curve = PointInCurve(Point=hexagonal.Points, Curve=join_curves)  # -> Relationship, Point; disabled
cull_pattern_3 = CullPattern(List=hexagonal.Points, CullPattern=point_in_curve.Relationship)  # disabled

# ---- group: AMOUNT OF USERS
number_slider_53 = Slider(679, range=0..1000)  # disabled
number_slider_54 = Slider(0, range=0..100)  # disabled
construct_domain_2 = ConstructDomain(DomainStart=number_slider_54, DomainEnd=number_slider_53)  # disabled
sub_list = SubList(Domain=construct_domain_2, Wrap=True)  # -> List, Index; disabled
list_length = ListLength(List=sub_list.List)  # disabled
panel_13 = Panel(list_length)  # disabled

# ---- group: Measure and normalise distance to boundary curve
# Since distances can be any positive
# value, sometimes it's a good idea to
# 'remap' your numbers into a fixed domain.
# This makes subsequent mathematics
# easier to write.
curve_closest_point = CurveClosestPoint(Point=cull_pattern_3, Curve=join_curves)  # -> Point, Parameter, Distance; disabled
bounds = Bounds(Numbers=curve_closest_point.Distance)  # disabled
remap_numbers = RemapNumbers(Value=curve_closest_point.Distance, Source=bounds, Target=Domain(0, 1))  # -> Mapped, Clipped; disabled

# ----
center_box_10 = CenterBox(Base=sub_list.List, X=division_4, Y=division_6, Z=division_5)  # disabled
list_length_2 = ListLength()  # disabled
amount_of_users = Slider(1027, range=0..10000)  # disabled
collision_one_many_3 = CollisionOneMany(Collider=center_box_9, Obstacles=solid_union)  # -> Collision, Index; disabled
panel_14 = Panel(list_length_2)  # disabled
subtraction = Subtraction(A=list_length_2, B=amount_of_users)  # disabled
random_reduce = RandomReduce(Reduction=subtraction, Seed=1)  # disabled

# ---- group: Create circles based on modified, normalised distance
graph_mapper = GraphMapper(
    remap_numbers.Mapped,
    x0=0,
    x1=1,
    y0=0.2,
    y1=1,
    container_name="Bezier",
    cpx=[0, 0.6108490825, 0.2806603909, 1],
    cpy=[0, 0, 0.6578947306, 1])  # disabled
circle = Circle(Plane=cull_pattern_3, Radius=graph_mapper)  # disabled

# ----
brep_18 = Brep(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)  # disabled
brep_19 = Brep(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)  # disabled
cull_pattern_4 = CullPattern(List=center_box_9, CullPattern=collision_one_many_3.Collision)  # disabled
brep_20 = Brep(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)  # disabled
brep_21 = Brep(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)  # disabled
brep_22 = Brep(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)  # disabled
brep_23 = Brep(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)  # disabled
brep_24 = Brep(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)  # disabled
brep_25 = Brep(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)  # disabled
brep_26 = Brep(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)  # disabled
brep_27 = Brep(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)  # disabled
brep_28 = Brep(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)  # disabled
brep_29 = Brep(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)  # disabled
brep_30 = Brep(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)  # disabled
panel_15 = Panel(subtraction)  # disabled
collision_one_many_4 = CollisionOneMany(Collider=center_box_10, Obstacles=solid_union_2)  # -> Collision, Index; disabled
brep_31 = Brep(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)  # disabled
brep_32 = Brep(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)  # disabled
brep_33 = Brep(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)  # disabled
move_10 = Move(Geometry=brep_22, Motion=unit_z)  # -> Geometry, Transform; disabled
move_11 = Move(Geometry=brep_20, Motion=unit_z)  # -> Geometry, Transform; disabled
move_12 = Move(Geometry=brep_24, Motion=unit_z)  # -> Geometry, Transform; disabled
move_13 = Move(Geometry=brep_25, Motion=unit_z)  # -> Geometry, Transform; disabled
move_14 = Move(Geometry=brep_21, Motion=unit_z)  # -> Geometry, Transform; disabled
move_15 = Move(Geometry=brep_19, Motion=unit_z)  # -> Geometry, Transform; disabled
move_16 = Move(Geometry=brep_23, Motion=unit_z)  # -> Geometry, Transform; disabled
list_length_3 = ListLength(List=collision_one_many_4.Collision)  # disabled
move_17 = Move(Geometry=brep_18, Motion=unit_z)  # -> Geometry, Transform; disabled
panel_16 = Panel(collision_one_many_4.Collision)  # disabled
move_18 = Move(Geometry=brep_30, Motion=unit_z)  # -> Geometry, Transform; disabled
move_19 = Move(Geometry=brep_28, Motion=unit_z)  # -> Geometry, Transform; disabled
move_20 = Move(Geometry=brep_32, Motion=unit_z)  # -> Geometry, Transform; disabled
move_21 = Move(Geometry=brep_33, Motion=unit_z)  # -> Geometry, Transform; disabled
move_22 = Move(Geometry=brep_29, Motion=unit_z)  # -> Geometry, Transform; disabled
move_23 = Move(Geometry=brep_27, Motion=unit_z)  # -> Geometry, Transform; disabled
move_24 = Move(Geometry=brep_31, Motion=unit_z)  # -> Geometry, Transform; disabled
move_25 = Move(Geometry=brep_26, Motion=unit_z)  # -> Geometry, Transform; disabled
cull_pattern_5 = CullPattern(List=center_box_10, CullPattern=collision_one_many_4.Collision)  # disabled
panel_17 = Panel(list_length_3)  # disabled
number_slider_55 = Slider(247, range=0..1000)  # disabled
vector_xyz_2 = VectorXYZ(XComponent=number_slider_55, YComponent=number_slider_55, ZComponent=0)  # -> Vector, Length; disabled
unit_x_2 = UnitX(Factor=1)  # disabled

boolean_toggle_4 = BooleanToggle(True)  # disabled
number_slider_56 = Slider(2, range=0..5)  # disabled
file_path_3 = FilePath("C:\Users\Albert Burgers\Desktop\Excel\Exceltest 1.xlsx")  # disabled

# ---- group: SLEEP
colour_swatch_5 = ColourSwatch(SwatchColor=RGBA(17, 87, 87, 50))  # disabled
custom_preview_5 = CustomPreview(Geometry=move_14.Geometry, Shader=colour_swatch_5)  # disabled

# ---- group: HOUSE
colour_swatch_6 = ColourSwatch(SwatchColor=RGBA(99, 66, 92, 50))  # disabled
custom_preview_6 = CustomPreview(Geometry=move_17.Geometry, Shader=colour_swatch_6)

# ---- group: SHOPPING
colour_swatch_7 = ColourSwatch(SwatchColor=RGBA(65, 162, 166, 50))  # disabled
custom_preview_7 = CustomPreview(Geometry=move_10.Geometry, Shader=colour_swatch_7)  # disabled

# ----
plane_normal = PlaneNormal(Origin=vector_xyz_2.Vector, ZAxis=unit_x_2)  # disabled

# ---- group: SOCIAL
colour_swatch_8 = ColourSwatch(SwatchColor=RGBA(227, 45, 76, 50))  # disabled
custom_preview_8 = CustomPreview(Geometry=move_11.Geometry, Shader=colour_swatch_8)  # disabled

# ---- group: WORK
colour_swatch_9 = ColourSwatch(SwatchColor=RGBA(222, 178, 47, 50))  # disabled
custom_preview_9 = CustomPreview(Geometry=move_15.Geometry, Shader=colour_swatch_9)  # disabled

# ---- group: SPORTS
colour_swatch_10 = ColourSwatch(SwatchColor=RGBA(242, 105, 41, 50))  # disabled
custom_preview_10 = CustomPreview(Geometry=move_13.Geometry, Shader=colour_swatch_10)  # disabled

# ---- group: CIVIC
colour_swatch_11 = ColourSwatch(SwatchColor=RGBA(184, 108, 85, 50))  # disabled
custom_preview_11 = CustomPreview(Geometry=move_16.Geometry, Shader=colour_swatch_11)  # disabled

# ---- group: EDUCATION
colour_swatch_12 = ColourSwatch(SwatchColor=RGBA(191, 196, 153, 50))  # disabled
custom_preview_12 = CustomPreview(Geometry=move_12.Geometry, Shader=colour_swatch_12)  # disabled

# ----
brep_34 = Brep(<brep referenced from the Rhino model>)  # disabled

boolean_toggle_5 = BooleanToggle(True)  # disabled
number_slider_57 = Slider(2, range=0..5)  # disabled
file_path_4 = FilePath("C:\Users\Albert Burgers\Desktop\Excel\Exceltest 1.xlsx")  # disabled

brep_plane = BrepPlane(Brep=brep_34, Plane=graft(plane_normal))  # -> Curves, Points; disabled

# ---- group: SLEEP
colour_swatch_13 = ColourSwatch(SwatchColor=RGBA(17, 87, 87, 50))  # disabled
custom_preview_13 = CustomPreview(Geometry=move_22.Geometry, Shader=colour_swatch_13)  # disabled

# ---- group: HOUSE
colour_swatch_14 = ColourSwatch(SwatchColor=RGBA(99, 66, 92, 50))  # disabled
custom_preview_14 = CustomPreview(Geometry=move_25.Geometry, Shader=colour_swatch_14)  # disabled

# ---- group: SHOPPING
colour_swatch_15 = ColourSwatch(SwatchColor=RGBA(65, 162, 166, 50))  # disabled
custom_preview_15 = CustomPreview(Geometry=move_18.Geometry, Shader=colour_swatch_15)  # disabled

# ---- group: SOCIAL
colour_swatch_16 = ColourSwatch(SwatchColor=RGBA(227, 45, 76, 50))  # disabled
custom_preview_16 = CustomPreview(Geometry=move_19.Geometry, Shader=colour_swatch_16)  # disabled

# ---- group: WORK
colour_swatch_17 = ColourSwatch(SwatchColor=RGBA(222, 178, 47, 50))  # disabled
custom_preview_17 = CustomPreview(Geometry=move_23.Geometry, Shader=colour_swatch_17)  # disabled

# ---- group: SPORTS
colour_swatch_18 = ColourSwatch(SwatchColor=RGBA(242, 105, 41, 50))  # disabled
custom_preview_18 = CustomPreview(Geometry=move_21.Geometry, Shader=colour_swatch_18)  # disabled

# ---- group: CIVIC
colour_swatch_19 = ColourSwatch(SwatchColor=RGBA(184, 108, 85, 50))  # disabled
custom_preview_19 = CustomPreview(Geometry=move_24.Geometry, Shader=colour_swatch_19)  # disabled

# ---- group: EDUCATION
colour_swatch_20 = ColourSwatch(SwatchColor=RGBA(191, 196, 153, 50))  # disabled
custom_preview_20 = CustomPreview(Geometry=move_20.Geometry, Shader=colour_swatch_20)  # disabled

# ----
boolean_toggle_6 = BooleanToggle(True)  # disabled
number_slider_58 = Slider(2, range=0..5)  # disabled
file_path_5 = FilePath("C:\Users\Albert Burgers\Desktop\Excel\Exceltest 1.xlsx")  # disabled

# ---- group: SOCIAL
number_slider_59 = Slider(3, range=0..10)  # disabled
list_item_6 = ListItem(Index=number_slider_59, Wrap=True)  # disabled
panel_18 = Panel(list_item_6)  # disabled
explode_tree = ExplodeTree(Data=list_item_6)  # -> Branch0, Branch1, Branch2, Branch3; disabled

# ---- group: SLEEP
number_slider_60 = Slider(1, range=0..10)  # disabled
list_item_7 = ListItem(Index=number_slider_60, Wrap=True)  # disabled
panel_19 = Panel(list_item_7)  # disabled
explode_tree_2 = ExplodeTree(Data=list_item_7)  # -> Branch0, Branch1, Branch2, Branch3; disabled

# ---- group: WORK
number_slider_61 = Slider(2, range=0..10)  # disabled
list_item_8 = ListItem(Index=number_slider_61, Wrap=True)  # disabled
panel_20 = Panel(list_item_8)  # disabled
explode_tree_3 = ExplodeTree(Data=list_item_8)  # -> Branch0, Branch1, Branch2, Branch3; disabled

# ---- group: CIVIC
number_slider_62 = Slider(6, range=0..10)  # disabled
list_item_9 = ListItem(Index=number_slider_62, Wrap=True)  # disabled
panel_21 = Panel(list_item_9)  # disabled
explode_tree_4 = ExplodeTree(Data=list_item_9)  # -> Branch0, Branch1, Branch2, Branch3; disabled

# ---- group: HOUSE
number_slider_63 = Slider(0, range=0..10)  # disabled
list_item_10 = ListItem(Index=number_slider_63, Wrap=True)  # disabled
panel_22 = Panel(list_item_10)
explode_tree_5 = ExplodeTree(Data=list_item_10)  # -> Branch0, Branch1, Branch2, Branch3; disabled

# ---- group: SPORTS
number_slider_64 = Slider(4, range=0..10)  # disabled
list_item_11 = ListItem(Index=number_slider_64, Wrap=True)  # disabled
panel_23 = Panel(list_item_11)  # disabled
explode_tree_6 = ExplodeTree(Data=list_item_11)  # -> Branch0, Branch1, Branch2, Branch3; disabled

# ---- group: SHOPPING
number_slider_65 = Slider(5, range=0..10)  # disabled
list_item_12 = ListItem(Index=number_slider_65, Wrap=True)  # disabled
panel_24 = Panel(list_item_12)  # disabled
explode_tree_7 = ExplodeTree(Data=list_item_12)  # -> Branch0, Branch1, Branch2, Branch3; disabled

# ---- group: EDUCATION
number_slider_66 = Slider(7, range=0..10)  # disabled
list_item_13 = ListItem(Index=number_slider_66, Wrap=True)  # disabled
panel_25 = Panel(list_item_13)  # disabled
explode_tree_8 = ExplodeTree(Data=list_item_13)  # -> Branch0, Branch1, Branch2, Branch3; disabled

# ----
vec = VectorXYZ(XComponent=Slider(-250, range=-500..500), YComponent=Slider(-250, range=-500..500), ZComponent=unit_z)  # -> Vector, Length

# ---- group: SOCIAL
number_slider_67 = Slider(3, range=0..10)  # disabled
list_item_14 = ListItem(Index=number_slider_67, Wrap=True)  # disabled
panel_26 = Panel(list_item_14)  # disabled
explode_tree_9 = ExplodeTree(Data=list_item_14)  # -> Branch0, Branch1, Branch2, Branch3; disabled

# ---- group: SLEEP
number_slider_68 = Slider(1, range=0..10)  # disabled
list_item_15 = ListItem(Index=number_slider_68, Wrap=True)  # disabled
panel_27 = Panel(list_item_15)  # disabled
explode_tree_10 = ExplodeTree(Data=list_item_15)  # -> Branch0, Branch1, Branch2, Branch3; disabled

# ---- group: WORK
number_slider_69 = Slider(2, range=0..10)  # disabled
list_item_16 = ListItem(Index=number_slider_69, Wrap=True)  # disabled
panel_28 = Panel(list_item_16)  # disabled
explode_tree_11 = ExplodeTree(Data=list_item_16)  # -> Branch0, Branch1, Branch2, Branch3; disabled

# ---- group: CIVIC
number_slider_70 = Slider(6, range=0..10)  # disabled
list_item_17 = ListItem(Index=number_slider_70, Wrap=True)  # disabled
panel_29 = Panel(list_item_17)  # disabled
explode_tree_12 = ExplodeTree(Data=list_item_17)  # -> Branch0, Branch1, Branch2, Branch3; disabled

# ---- group: HOUSE
number_slider_71 = Slider(0, range=0..10)  # disabled
list_item_18 = ListItem(Index=number_slider_71, Wrap=True)  # disabled
panel_30 = Panel(list_item_18)  # disabled
explode_tree_13 = ExplodeTree(Data=list_item_18)  # -> Branch0, Branch1, Branch2, Branch3; disabled

# ---- group: SPORTS
number_slider_72 = Slider(4, range=0..10)  # disabled
list_item_19 = ListItem(Index=number_slider_72, Wrap=True)  # disabled
panel_31 = Panel(list_item_19)  # disabled
explode_tree_14 = ExplodeTree(Data=list_item_19)  # -> Branch0, Branch1, Branch2, Branch3; disabled

# ---- group: SHOPPING
number_slider_73 = Slider(5, range=0..10)  # disabled
list_item_20 = ListItem(Index=number_slider_73, Wrap=True)  # disabled
panel_32 = Panel(list_item_20)  # disabled
explode_tree_15 = ExplodeTree(Data=list_item_20)  # -> Branch0, Branch1, Branch2, Branch3; disabled

# ---- group: EDUCATION
number_slider_74 = Slider(7, range=0..10)  # disabled
list_item_21 = ListItem(Index=number_slider_74, Wrap=True)  # disabled
panel_33 = Panel(list_item_21)  # disabled
explode_tree_16 = ExplodeTree(Data=list_item_21)  # -> Branch0, Branch1, Branch2, Branch3; disabled

# ----
cluster = Cluster(path="\\Mac\Home\Downloads\3Dmove 19-01-10 objects coordinates.csv")
cluster_2 = Cluster(path="\\Mac\Home\Downloads\3Dmove 19-01-10 objects coordinates.csv")

# ---- group: SOCIAL
number_slider_75 = Slider(3, range=0..10)  # disabled
list_item_22 = ListItem(Index=number_slider_75, Wrap=True)  # disabled
panel_34 = Panel(list_item_22)  # disabled
explode_tree_17 = ExplodeTree(Data=list_item_22)  # -> Branch0, Branch1, Branch2, Branch3; disabled

# ---- group: SLEEP
number_slider_76 = Slider(1, range=0..10)  # disabled
list_item_23 = ListItem(Index=number_slider_76, Wrap=True)  # disabled
panel_35 = Panel(list_item_23)  # disabled
explode_tree_18 = ExplodeTree(Data=list_item_23)  # -> Branch0, Branch1, Branch2, Branch3; disabled

# ---- group: WORK
number_slider_77 = Slider(2, range=0..10)  # disabled
list_item_24 = ListItem(Index=number_slider_77, Wrap=True)  # disabled
panel_36 = Panel(list_item_24)  # disabled
explode_tree_19 = ExplodeTree(Data=list_item_24)  # -> Branch0, Branch1, Branch2, Branch3; disabled

# ---- group: CIVIC
number_slider_78 = Slider(6, range=0..10)  # disabled
list_item_25 = ListItem(Index=number_slider_78, Wrap=True)  # disabled
panel_37 = Panel(list_item_25)  # disabled
explode_tree_20 = ExplodeTree(Data=list_item_25)  # -> Branch0, Branch1, Branch2, Branch3; disabled

# ---- group: HOUSE
number_slider_79 = Slider(0, range=0..10)  # disabled
list_item_26 = ListItem(Index=number_slider_79, Wrap=True)  # disabled
panel_38 = Panel(list_item_26)  # disabled
explode_tree_21 = ExplodeTree(Data=list_item_26)  # -> Branch0, Branch1, Branch2, Branch3; disabled

# ---- group: SPORTS
number_slider_80 = Slider(4, range=0..10)  # disabled
list_item_27 = ListItem(Index=number_slider_80, Wrap=True)  # disabled
panel_39 = Panel(list_item_27)  # disabled
explode_tree_22 = ExplodeTree(Data=list_item_27)  # -> Branch0, Branch1, Branch2, Branch3; disabled

# ---- group: SHOPPING
number_slider_81 = Slider(5, range=0..10)  # disabled
list_item_28 = ListItem(Index=number_slider_81, Wrap=True)  # disabled
panel_40 = Panel(list_item_28)  # disabled
explode_tree_23 = ExplodeTree(Data=list_item_28)  # -> Branch0, Branch1, Branch2, Branch3; disabled

# ----
division_7 = Division(A=4, B=2)

# ---- group: EDUCATION
number_slider_82 = Slider(7, range=0..10)  # disabled
list_item_29 = ListItem(Index=number_slider_82, Wrap=True)  # disabled
panel_41 = Panel(list_item_29)  # disabled
explode_tree_24 = ExplodeTree(Data=list_item_29)  # -> Branch0, Branch1, Branch2, Branch3; disabled

# ----
number_slider_83 = Slider(6, range=0..30)  # disabled
number_slider_84 = Slider(8, range=0..30)  # disabled
number_slider_85 = Slider(3, range=0..30)  # disabled

number_slider_86 = Slider(6, range=0..30)  # disabled
number_slider_87 = Slider(8, range=0..30)  # disabled
number_slider_88 = Slider(3, range=0..30)  # disabled

xy_plane_5 = XYPlane(Origin=Point(0, 0, 0))
bounding_box_6 = BoundingBox(Content=move_17.Geometry, Plane=xy_plane_5)  # -> Box, Box_2

number_slider_89 = Slider(6, range=0..30)  # disabled
number_slider_90 = Slider(3, range=0..30)  # disabled
number_slider_91 = Slider(8, range=0..30)  # disabled

number_slider_92 = Slider(6, range=0..30)  # disabled
number_slider_93 = Slider(3, range=0..30)  # disabled
number_slider_94 = Slider(8, range=0..30)  # disabled

box_3 = CenterBox(Base=cluster_2, X=division_7, Y=division_7, Z=division_7)

xy_plane_6 = XYPlane(Origin=Point(0, 0, 0))  # disabled
bounding_box_7 = BoundingBox(Content=move_14.Geometry, Plane=xy_plane_6)  # -> Box, Box_2; disabled

xy_plane_7 = XYPlane(Origin=Point(0, 0, 0))  # disabled
bounding_box_8 = BoundingBox(Content=move_11.Geometry, Plane=xy_plane_7)  # -> Box, Box_2; disabled

xy_plane_8 = XYPlane(Origin=Point(0, 0, 0))  # disabled
bounding_box_9 = BoundingBox(Content=move_15.Geometry, Plane=xy_plane_8)  # -> Box, Box_2; disabled

number_slider_95 = Slider(6, range=0..30)  # disabled
number_slider_96 = Slider(3, range=0..30)  # disabled
number_slider_97 = Slider(8, range=0..30)  # disabled

xy_plane_9 = XYPlane(Origin=Point(0, 0, 0))  # disabled
bounding_box_10 = BoundingBox(Content=move_13.Geometry, Plane=xy_plane_9)  # -> Box, Box_2; disabled

number_slider_98 = Slider(6, range=0..30)  # disabled
number_slider_99 = Slider(8, range=0..30)  # disabled
number_slider_100 = Slider(3, range=0..30)  # disabled

number_slider_101 = Slider(6, range=0..30)  # disabled
number_slider_102 = Slider(8, range=0..30)  # disabled
number_slider_103 = Slider(3, range=0..30)  # disabled

xy_plane_10 = XYPlane(Origin=Point(0, 0, 0))  # disabled
bounding_box_11 = BoundingBox(Content=move_10.Geometry, Plane=xy_plane_10)  # -> Box, Box_2; disabled

xy_plane_11 = XYPlane(Origin=Point(0, 0, 0))  # disabled
bounding_box_12 = BoundingBox(Content=move_16.Geometry, Plane=xy_plane_11)  # -> Box, Box_2; disabled

number_slider_104 = Slider(6, range=0..30)  # disabled
number_slider_105 = Slider(3, range=0..30)  # disabled
number_slider_106 = Slider(8, range=0..30)  # disabled

xy_plane_12 = XYPlane(Origin=Point(0, 0, 0))  # disabled
bounding_box_13 = BoundingBox(Content=move_12.Geometry, Plane=xy_plane_12)  # -> Box, Box_2; disabled

box_4 = CenterBox(Base=cluster, X=Slider(4, range=0.1..10), Y=Slider(4, range=0.1..10), Z=Slider(4, range=0.1..10))

number_slider_107 = Slider(6, range=0..30)  # disabled
number_slider_108 = Slider(8, range=0..30)  # disabled
number_slider_109 = Slider(3, range=0..30)  # disabled

number_slider_110 = Slider(6, range=0..30)  # disabled
number_slider_111 = Slider(8, range=0..30)  # disabled
number_slider_112 = Slider(3, range=0..30)  # disabled

number_slider_113 = Slider(6, range=0..30)  # disabled
number_slider_114 = Slider(8, range=0..30)  # disabled
number_slider_115 = Slider(3, range=0..30)  # disabled

xy_plane_13 = XYPlane(Origin=Point(0, 0, 0))  # disabled
bounding_box_14 = BoundingBox(Content=move_25.Geometry, Plane=xy_plane_13)  # -> Box, Box_2; disabled

number_slider_116 = Slider(6, range=0..30)  # disabled
number_slider_117 = Slider(8, range=0..30)  # disabled
number_slider_118 = Slider(3, range=0..30)  # disabled

xy_plane_14 = XYPlane(Origin=Point(0, 0, 0))  # disabled
bounding_box_15 = BoundingBox(Content=move_22.Geometry, Plane=xy_plane_14)  # -> Box, Box_2; disabled

xy_plane_15 = XYPlane(Origin=Point(0, 0, 0))  # disabled
bounding_box_16 = BoundingBox(Content=move_19.Geometry, Plane=xy_plane_15)  # -> Box, Box_2; disabled

xy_plane_16 = XYPlane(Origin=Point(0, 0, 0))  # disabled
bounding_box_17 = BoundingBox(Content=move_23.Geometry, Plane=xy_plane_16)  # -> Box, Box_2; disabled

number_slider_119 = Slider(6, range=0..30)  # disabled
number_slider_120 = Slider(8, range=0..30)  # disabled
number_slider_121 = Slider(3, range=0..30)  # disabled

xy_plane_17 = XYPlane(Origin=Point(0, 0, 0))  # disabled
bounding_box_18 = BoundingBox(Content=move_21.Geometry, Plane=xy_plane_17)  # -> Box, Box_2; disabled

number_slider_122 = Slider(6, range=0..30)  # disabled
number_slider_123 = Slider(3, range=0..30)  # disabled
number_slider_124 = Slider(8, range=0..30)  # disabled

number_slider_125 = Slider(6, range=0..30)  # disabled
number_slider_126 = Slider(8, range=0..30)  # disabled
number_slider_127 = Slider(3, range=0..30)  # disabled

xy_plane_18 = XYPlane(Origin=Point(0, 0, 0))  # disabled
bounding_box_19 = BoundingBox(Content=move_18.Geometry, Plane=xy_plane_18)  # -> Box, Box_2; disabled

xy_plane_19 = XYPlane(Origin=Point(0, 0, 0))  # disabled
bounding_box_20 = BoundingBox(Content=move_24.Geometry, Plane=xy_plane_19)  # -> Box, Box_2; disabled

number_slider_128 = Slider(6, range=0..30)  # disabled
number_slider_129 = Slider(3, range=0..30)  # disabled
number_slider_130 = Slider(8, range=0..30)  # disabled

move_26 = Move(Geometry=cluster, Motion=vec.Vector)  # -> Geometry, Transform

xy_plane_20 = XYPlane(Origin=Point(0, 0, 0))  # disabled
bounding_box_21 = BoundingBox(Content=move_20.Geometry, Plane=xy_plane_20)  # -> Box, Box_2; disabled

move_27 = Move(Geometry=box_4, Motion=vec.Vector)  # -> Geometry, Transform
move_28 = Move(Geometry=vec.Vector, Motion=box_3)  # -> Geometry, Transform

number_slider_131 = Slider(6, range=0..30)  # disabled
number_slider_132 = Slider(8, range=0..30)  # disabled
number_slider_133 = Slider(3, range=0..30)  # disabled

number_slider_134 = Slider(6, range=0..30)  # disabled
number_slider_135 = Slider(3, range=0..30)  # disabled
number_slider_136 = Slider(8, range=0..30)  # disabled

number_slider_137 = Slider(6, range=0..30)  # disabled
number_slider_138 = Slider(3, range=0..30)  # disabled
number_slider_139 = Slider(8, range=0..30)  # disabled

number_slider_140 = Slider(6, range=0..30)  # disabled
number_slider_141 = Slider(3, range=0..30)  # disabled
number_slider_142 = Slider(8, range=0..30)  # disabled

number_slider_143 = Slider(6, range=0..30)  # disabled
number_slider_144 = Slider(3, range=0..30)  # disabled
number_slider_145 = Slider(8, range=0..30)  # disabled

number_slider_146 = Slider(6, range=0..30)  # disabled
number_slider_147 = Slider(8, range=0..30)  # disabled
number_slider_148 = Slider(3, range=0..30)  # disabled

number_slider_149 = Slider(6, range=0..30)  # disabled
number_slider_150 = Slider(8, range=0..30)  # disabled
number_slider_151 = Slider(3, range=0..30)  # disabled

scale = Scale(Geometry=move_27.Geometry, Center=move_26.Geometry, Factor=Slider(3, range=0..10))  # -> Geometry, Transform

number_slider_152 = Slider(6, range=0..30)  # disabled
number_slider_153 = Slider(3, range=0..30)  # disabled
number_slider_154 = Slider(8, range=0..30)  # disabled

preview = CustomPreview(
    Geometry=simplify(graft(move_28.Geometry)),
    Material=simplify(graft(Tree({0}: [{diffuse=RGB(176, 48, 71), emission=RGB(176, 48, 71), shine=0, specular=RGB(176, 48, 71), transparency=0}], {1}: [{diffuse=RGB(82, 42, 66), emission=RGB(82, 42, 66), shine=0, specular=RGB(82, 42, 66), transparency=0}], {2}: [{diffuse=RGB(52, 51, 61), emission=RGB(52, 51, 61), shine=0, specular=RGB(52, 51, 61), transparency=0}], {3}: [{diffuse=RGB(166, 124, 0), emission=RGB(166, 124, 0), shine=0, specular=RGB(166, 124, 0), transparency=0}], {4}: [{diffuse=RGB(82, 42, 66), emission=RGB(82, 42, 66), shine=0, specular=RGB(82, 42, 66), transparency=0}], {5}: [{diffuse=RGB(166, 124, 0), emission=RGB(166, 124, 0), shine=0, specular=RGB(166, 124, 0), transparency=0}]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))))
preview_2 = CustomPreview(
    Geometry=simplify(graft(move_27.Geometry)),
    Material=simplify(graft(Tree({0}: [{diffuse=RGB(82, 42, 66), emission=RGB(82, 42, 66), shine=0, specular=RGB(82, 42, 66), transparency=0}], {1}: [{diffuse=RGB(166, 124, 0), emission=RGB(166, 124, 0), shine=0, specular=RGB(166, 124, 0), transparency=0}], {2}: [{diffuse=RGB(145, 65, 38), emission=RGB(145, 65, 38), shine=0, specular=RGB(145, 65, 38), transparency=0}], {3}: [{diffuse=RGB(176, 48, 71), emission=RGB(176, 48, 71), shine=0, specular=RGB(176, 48, 71), transparency=0}], {4}: [{diffuse=RGB(13, 122, 128), emission=RGB(13, 122, 128), shine=0, specular=RGB(13, 122, 128), transparency=0}], {5}: [{diffuse=RGB(189, 77, 17), emission=RGB(189, 77, 17), shine=0, specular=RGB(189, 77, 17), transparency=0}]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))))
bbox = BoundingBox(Content=scale.Geometry, Plane=PlaneXY(0, 0, 0))  # -> Box, Box_2
education_2 = ColourSwatch(SwatchColor=RGBA(191, 196, 153, 8))
box_5 = EvaluateBox(Box=bbox.Box, UParameter=0.5, VParameter=0.5, WParameter=0.5)  # -> Plane, Point, Include
sph = Sphere(Base=box_5.Point, Radius=Slider(10, range=0..10))
preview_3 = CustomPreview(Geometry=sph, Material=education_2)

# ---- group: Count time steps
# MAKE INDIVIDUAL SCRIPTS
# 
# Amount of time steps cant be limited to the amount of users. Now all the amount of pods is limited to a ‘random’ 240
boolean_toggle_7 = BooleanToggle(False)  # disabled
amount_of_pods = Panel("500")  # disabled
timer = Timer(TimerInterval=200)  # disabled
modulus = Modulus(B=amount_of_pods)  # disabled
panel_42 = Panel(modulus)  # disabled

# ----
amount_of_pods_2 = Panel("500")  # disabled

# ---- group: Count time steps
# MAKE INDIVIDUAL SCRIPTS
# 
# Amount of time steps cant be limited to the amount of users. Now all the amount of pods is limited to a ‘random’ 240
boolean_toggle_8 = BooleanToggle(True)  # disabled
timer_2 = Timer(TimerInterval=200)  # disabled
modulus_2 = Modulus(B=amount_of_pods_2)  # disabled
panel_43 = Panel(modulus_2)  # disabled

# ----
amount_of_pods_3 = Panel("500")  # disabled

# ---- group: Count time steps
# MAKE INDIVIDUAL SCRIPTS
# 
# Amount of time steps cant be limited to the amount of users. Now all the amount of pods is limited to a ‘random’ 240
boolean_toggle_9 = BooleanToggle(False)  # disabled
timer_3 = Timer(TimerInterval=50)  # disabled
modulus_3 = Modulus(B=amount_of_pods_3)  # disabled

# ----
panel_44 = Panel(modulus_3)  # disabled
number_slider_155 = Slider(450, range=0..1000)

amount_of_users_2 = Slider(200, range=0..10000)  # disabled
list_length_4 = ListLength()  # disabled
subtraction_2 = Subtraction(A=list_length_4, B=panel_42)  # disabled
panel_45 = Panel(list_length_4)  # disabled
random_reduce_2 = RandomReduce(Reduction=subtraction_2, Seed=1)  # disabled
panel_46 = Panel(subtraction_2)  # disabled

boolean_toggle_10 = BooleanToggle(True)
timer_4 = Timer(TimerInterval=50)  # disabled

list_length_5 = ListLength()  # disabled
subtraction_3 = Subtraction(A=list_length_5, B=panel_42)  # disabled
random_reduce_3 = RandomReduce(Reduction=subtraction_3, Seed=1)
panel_47 = Panel(subtraction_3)  # disabled

amount_of_users_3 = Slider(200, range=0..10000)  # disabled
panel_48 = Panel(list_length_5)  # disabled

list_length_6 = ListLength()  # disabled
subtraction_4 = Subtraction(A=list_length_6, B=panel_42)  # disabled
random_reduce_4 = RandomReduce(Reduction=subtraction_4, Seed=1)  # disabled
panel_49 = Panel(subtraction_4)  # disabled

amount_of_users_4 = Slider(200, range=0..10000)  # disabled
panel_50 = Panel(list_length_6)  # disabled

list_length_7 = ListLength()  # disabled
subtraction_5 = Subtraction(A=list_length_7, B=panel_42)  # disabled
random_reduce_5 = RandomReduce(Reduction=subtraction_5, Seed=1)  # disabled
panel_51 = Panel(subtraction_5)  # disabled

amount_of_users_5 = Slider(200, range=0..10000)  # disabled
panel_52 = Panel(list_length_7)  # disabled

list_length_8 = ListLength()  # disabled
subtraction_6 = Subtraction(A=list_length_8, B=panel_42)  # disabled
random_reduce_6 = RandomReduce(Reduction=subtraction_6, Seed=1)  # disabled
panel_53 = Panel(subtraction_6)  # disabled

amount_of_users_6 = Slider(200, range=0..10000)  # disabled
panel_54 = Panel(list_length_8)  # disabled

list_length_9 = ListLength()  # disabled
subtraction_7 = Subtraction(A=list_length_9, B=panel_42)  # disabled
random_reduce_7 = RandomReduce(Reduction=subtraction_7, Seed=1)  # disabled
panel_55 = Panel(subtraction_7)  # disabled

amount_of_users_7 = Slider(200, range=0..10000)  # disabled
panel_56 = Panel(list_length_9)  # disabled

list_length_10 = ListLength()  # disabled
subtraction_8 = Subtraction(A=list_length_10, B=panel_42)  # disabled
random_reduce_8 = RandomReduce(Reduction=subtraction_8, Seed=1)  # disabled
panel_57 = Panel(subtraction_8)  # disabled

amount_of_users_8 = Slider(200, range=0..10000)  # disabled
panel_58 = Panel(list_length_10)  # disabled

list_length_11 = ListLength()  # disabled
subtraction_9 = Subtraction(A=list_length_11, B=panel_42)  # disabled
random_reduce_9 = RandomReduce(Reduction=subtraction_9, Seed=1)  # disabled
panel_59 = Panel(subtraction_9)  # disabled

amount_of_users_9 = Slider(200, range=0..10000)  # disabled
panel_60 = Panel(list_length_11)  # disabled

vector_xyz_3 = VectorXYZ(XComponent=Slider(-40, range=-500..500), YComponent=Slider(260, range=0..1000), ZComponent=number_slider_155)  # -> Vector, Length
unit_z_4 = UnitZ(Factor=number_slider_155)

amount_of_users_10 = Slider(200, range=0..10000)  # disabled
list_length_12 = ListLength()  # disabled
subtraction_10 = Subtraction(A=list_length_12, B=panel_43)  # disabled
panel_61 = Panel(list_length_12)  # disabled
random_reduce_10 = RandomReduce(Reduction=subtraction_10, Seed=1)  # disabled
panel_62 = Panel(subtraction_10)  # disabled

list_length_13 = ListLength()  # disabled
subtraction_11 = Subtraction(A=list_length_13, B=panel_43)  # disabled
random_reduce_11 = RandomReduce(Reduction=subtraction_11, Seed=1)  # disabled
panel_63 = Panel(subtraction_11)  # disabled

amount_of_users_11 = Slider(200, range=0..10000)  # disabled
panel_64 = Panel(list_length_13)  # disabled

list_length_14 = ListLength()  # disabled
subtraction_12 = Subtraction(A=list_length_14, B=panel_43)  # disabled
random_reduce_12 = RandomReduce(Reduction=subtraction_12, Seed=1)  # disabled
panel_65 = Panel(subtraction_12)  # disabled

amount_of_users_12 = Slider(200, range=0..10000)  # disabled
panel_66 = Panel(list_length_14)  # disabled

list_length_15 = ListLength()  # disabled
subtraction_13 = Subtraction(A=list_length_15, B=panel_43)  # disabled
random_reduce_13 = RandomReduce(Reduction=subtraction_13, Seed=1)  # disabled
panel_67 = Panel(subtraction_13)  # disabled

amount_of_users_13 = Slider(200, range=0..10000)  # disabled
panel_68 = Panel(list_length_15)  # disabled

list_length_16 = ListLength()  # disabled
subtraction_14 = Subtraction(A=list_length_16, B=panel_43)  # disabled
random_reduce_14 = RandomReduce(Reduction=subtraction_14, Seed=1)  # disabled
panel_69 = Panel(subtraction_14)  # disabled

amount_of_users_14 = Slider(200, range=0..10000)  # disabled
panel_70 = Panel(list_length_16)  # disabled

boolean_toggle_11 = BooleanToggle(False)  # disabled
timer_5 = Timer(TimerInterval=50)  # disabled

list_length_17 = ListLength()  # disabled
subtraction_15 = Subtraction(A=list_length_17, B=panel_43)  # disabled
random_reduce_15 = RandomReduce(Reduction=subtraction_15, Seed=1)  # disabled
panel_71 = Panel(subtraction_15)  # disabled

amount_of_users_15 = Slider(200, range=0..10000)  # disabled
panel_72 = Panel(list_length_17)  # disabled

list_length_18 = ListLength()  # disabled
subtraction_16 = Subtraction(A=list_length_18, B=panel_43)  # disabled
random_reduce_16 = RandomReduce(Reduction=subtraction_16, Seed=1)  # disabled
panel_73 = Panel(subtraction_16)  # disabled

amount_of_users_16 = Slider(200, range=0..10000)  # disabled
panel_74 = Panel(list_length_18)  # disabled

list_length_19 = ListLength()  # disabled
subtraction_17 = Subtraction(A=list_length_19, B=panel_43)  # disabled
random_reduce_17 = RandomReduce(Reduction=subtraction_17, Seed=1)  # disabled
panel_75 = Panel(subtraction_17)  # disabled

amount_of_users_17 = Slider(200, range=0..10000)  # disabled
panel_76 = Panel(list_length_19)  # disabled

vector_xyz_4 = VectorXYZ(XComponent=0, YComponent=0, ZComponent=0)  # -> Vector, Length

# ---- group: WORK
colour_swatch_21 = ColourSwatch(SwatchColor=RGB(223, 178, 46))  # disabled

# ---- group: HOUSE
colour_swatch_22 = ColourSwatch(SwatchColor=RGB(99, 64, 91))  # disabled

# ---- group: SOCIAL
colour_swatch_23 = ColourSwatch(SwatchColor=RGB(228, 45, 76))  # disabled

# ---- group: SLEEP
colour_swatch_24 = ColourSwatch(SwatchColor=RGB(17, 87, 87))  # disabled

# ----
amount_of_users_18 = Slider(200, range=0..10000)  # disabled
list_length_20 = ListLength()  # disabled
subtraction_18 = Subtraction(A=list_length_20, B=panel_44)  # disabled
panel_77 = Panel(list_length_20)  # disabled
random_reduce_18 = RandomReduce(Reduction=subtraction_18, Seed=1)  # disabled
panel_78 = Panel(subtraction_18)  # disabled

# ---- group: SPORTS
colour_swatch_25 = ColourSwatch(SwatchColor=RGB(242, 105, 40))  # disabled

# ---- group: CIVIC
colour_swatch_26 = ColourSwatch(SwatchColor=RGB(184, 108, 85))  # disabled

# ----
brep_35 = Brep(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)

# ---- group: EDUCATION
colour_swatch_27 = ColourSwatch(SwatchColor=RGB(191, 196, 40))  # disabled

# ---- group: SHOPPING
colour_swatch_28 = ColourSwatch(SwatchColor=RGB(64, 162, 165))  # disabled

# ----
list_length_21 = ListLength()  # disabled
subtraction_19 = Subtraction(A=list_length_21, B=panel_44)  # disabled
random_reduce_19 = RandomReduce(Reduction=subtraction_19, Seed=1)  # disabled
panel_79 = Panel(subtraction_19)  # disabled

amount_of_users_19 = Slider(200, range=0..10000)  # disabled
panel_80 = Panel(list_length_21)  # disabled

list_length_22 = ListLength()  # disabled
subtraction_20 = Subtraction(A=list_length_22, B=panel_44)  # disabled
random_reduce_20 = RandomReduce(Reduction=subtraction_20, Seed=1)  # disabled
panel_81 = Panel(subtraction_20)  # disabled

amount_of_users_20 = Slider(200, range=0..10000)  # disabled
panel_82 = Panel(list_length_22)  # disabled

list_length_23 = ListLength()  # disabled
subtraction_21 = Subtraction(A=list_length_23, B=panel_44)  # disabled
random_reduce_21 = RandomReduce(Reduction=subtraction_21, Seed=1)  # disabled
panel_83 = Panel(subtraction_21)  # disabled

amount_of_users_21 = Slider(200, range=0..10000)  # disabled
panel_84 = Panel(list_length_23)  # disabled

list_length_24 = ListLength()  # disabled
subtraction_22 = Subtraction(A=list_length_24, B=panel_44)  # disabled
random_reduce_22 = RandomReduce(Reduction=subtraction_22, Seed=1)  # disabled
panel_85 = Panel(subtraction_22)  # disabled

amount_of_users_22 = Slider(200, range=0..10000)  # disabled
panel_86 = Panel(list_length_24)  # disabled

list_length_25 = ListLength()  # disabled
subtraction_23 = Subtraction(A=list_length_25, B=panel_44)  # disabled
random_reduce_23 = RandomReduce(Reduction=subtraction_23, Seed=1)  # disabled
panel_87 = Panel(subtraction_23)  # disabled

amount_of_users_23 = Slider(200, range=0..10000)  # disabled
panel_88 = Panel(list_length_25)  # disabled

custom_preview_21 = CustomPreview(Geometry=random_reduce_6, Shader=colour_swatch_21)  # disabled
custom_preview_22 = CustomPreview(Geometry=random_reduce_3, Shader=colour_swatch_22)  # disabled
custom_preview_23 = CustomPreview(Geometry=random_reduce_4, Shader=colour_swatch_24)  # disabled
custom_preview_24 = CustomPreview(Geometry=random_reduce_5, Shader=colour_swatch_23)  # disabled
custom_preview_25 = CustomPreview(Geometry=random_reduce_7, Shader=colour_swatch_25)  # disabled
custom_preview_26 = CustomPreview(Geometry=random_reduce_9, Shader=colour_swatch_26)  # disabled
custom_preview_27 = CustomPreview(Geometry=random_reduce_8, Shader=colour_swatch_28)  # disabled
custom_preview_28 = CustomPreview(Geometry=random_reduce_2, Shader=colour_swatch_27)  # disabled

list_length_26 = ListLength()  # disabled
subtraction_24 = Subtraction(A=list_length_26, B=panel_44)  # disabled
random_reduce_24 = RandomReduce(Reduction=subtraction_24, Seed=1)  # disabled
panel_89 = Panel(subtraction_24)  # disabled

amount_of_users_24 = Slider(200, range=0..10000)  # disabled
panel_90 = Panel(list_length_26)  # disabled

list_length_27 = ListLength()  # disabled
subtraction_25 = Subtraction(A=list_length_27, B=panel_44)  # disabled
random_reduce_25 = RandomReduce(Reduction=subtraction_25, Seed=1)  # disabled
panel_91 = Panel(subtraction_25)  # disabled

amount_of_users_25 = Slider(200, range=0..10000)  # disabled
panel_92 = Panel(list_length_27)  # disabled

list_length_28 = ListLength(List=random_reduce_6)  # disabled
move_29 = Move(Geometry=brep_35, Motion=vector_xyz_3.Vector)  # -> Geometry, Transform
list_length_29 = ListLength(List=random_reduce_3)  # disabled
list_length_30 = ListLength(List=random_reduce_4)  # disabled
list_length_31 = ListLength(List=random_reduce_5)  # disabled

# ---- group: WORK
colour_swatch_29 = ColourSwatch(SwatchColor=RGB(223, 178, 46))  # disabled

# ---- group: HOUSE
colour_swatch_30 = ColourSwatch(SwatchColor=RGB(99, 64, 91))  # disabled

# ----
list_length_32 = ListLength(List=random_reduce_8)  # disabled
list_length_33 = ListLength(List=random_reduce_7)  # disabled
list_length_34 = ListLength(List=random_reduce_9)  # disabled

boolean_toggle_12 = BooleanToggle(True)
number_slider_156 = Slider(2, range=0..5)
file_path_6 = FilePath("C:\Users\Albert Burgers\Downloads\Exceltest 1.xlsx")

# ---- group: SOCIAL
colour_swatch_31 = ColourSwatch(SwatchColor=RGB(228, 45, 76))  # disabled

# ---- group: SLEEP
colour_swatch_32 = ColourSwatch(SwatchColor=RGB(17, 87, 87))  # disabled

# ----
list_length_35 = ListLength(List=random_reduce_14)  # disabled
list_length_36 = ListLength(List=random_reduce_11)  # disabled
list_length_37 = ListLength(List=random_reduce_12)  # disabled
list_length_38 = ListLength(List=random_reduce_2)  # disabled

# ---- group: SPORTS
colour_swatch_33 = ColourSwatch(SwatchColor=RGB(242, 105, 40))  # disabled

# ---- group: CIVIC
colour_swatch_34 = ColourSwatch(SwatchColor=RGB(184, 108, 85))  # disabled

# ---- group: EDUCATION
colour_swatch_35 = ColourSwatch(SwatchColor=RGB(191, 196, 40))  # disabled

# ----
list_length_39 = ListLength(List=random_reduce_13)  # disabled

# ---- group: SHOPPING
colour_swatch_36 = ColourSwatch(SwatchColor=RGB(64, 162, 165))  # disabled

# ----
panel_93 = Panel(list_length_28)  # disabled
list_length_40 = ListLength(List=random_reduce_16)  # disabled
panel_94 = Panel(list_length_29)  # disabled
panel_95 = Panel(list_length_30)  # disabled
list_length_41 = ListLength(List=random_reduce_15)  # disabled
list_length_42 = ListLength(List=random_reduce_17)  # disabled
list_length_43 = ListLength(List=random_reduce_10)  # disabled
panel_96 = Panel(list_length_31)  # disabled

custom_preview_29 = CustomPreview(Geometry=random_reduce_14, Shader=colour_swatch_29)  # disabled
custom_preview_30 = CustomPreview(Geometry=random_reduce_11, Shader=colour_swatch_30)  # disabled
custom_preview_31 = CustomPreview(Geometry=random_reduce_12, Shader=colour_swatch_32)  # disabled
custom_preview_32 = CustomPreview(Geometry=random_reduce_13, Shader=colour_swatch_31)  # disabled
custom_preview_33 = CustomPreview(Geometry=random_reduce_15, Shader=colour_swatch_33)  # disabled
custom_preview_34 = CustomPreview(Geometry=random_reduce_17, Shader=colour_swatch_34)  # disabled
custom_preview_35 = CustomPreview(Geometry=random_reduce_16, Shader=colour_swatch_36)  # disabled
custom_preview_36 = CustomPreview(Geometry=random_reduce_10, Shader=colour_swatch_35)  # disabled

panel_97 = Panel(list_length_32)  # disabled
panel_98 = Panel(list_length_33)  # disabled
panel_99 = Panel(list_length_34)  # disabled
move_30 = Move(Geometry=move_29.Geometry, Motion=vector_xyz_4.Vector)  # -> Geometry, Transform

# ---- group: CIVIC
custom_preview_37 = CustomPreview(Geometry=move_30.Geometry, Shader=ColourSwatch(SwatchColor=RGBA(184, 108, 85, 50)))

# ----
panel_100 = Panel(list_length_35)  # disabled
panel_101 = Panel(list_length_36)  # disabled
panel_102 = Panel(list_length_37)  # disabled
panel_103 = Panel(list_length_38)  # disabled
file_path_7 = FilePath("\\Mac\Home\Desktop\OSM DATA FOR ELK\map.osm-5.xml")
panel_104 = Panel(list_length_39)  # disabled
panel_105 = Panel(list_length_40)  # disabled
panel_106 = Panel(list_length_41)  # disabled
panel_107 = Panel(list_length_42)  # disabled

# ---- group: WORK
colour_swatch_37 = ColourSwatch(SwatchColor=RGB(223, 178, 46))  # disabled

# ---- group: HOUSE
colour_swatch_38 = ColourSwatch(SwatchColor=RGB(99, 64, 91))  # disabled

# ----
panel_108 = Panel(list_length_43)  # disabled

# ---- group: SOCIAL
colour_swatch_39 = ColourSwatch(SwatchColor=RGB(228, 45, 76))  # disabled

# ---- group: SLEEP
colour_swatch_40 = ColourSwatch(SwatchColor=RGB(17, 87, 87))  # disabled

# ----
file_path_8 = FilePath("\\Mac\Home\Desktop\OSM DATA FOR ELK\OLD\map.osm-6.xml")

# ---- group: SPORTS
colour_swatch_41 = ColourSwatch(SwatchColor=RGB(242, 105, 40))  # disabled

# ----
list_length_44 = ListLength(List=random_reduce_22)  # disabled
list_length_45 = ListLength(List=random_reduce_19)  # disabled
list_length_46 = ListLength(List=random_reduce_20)  # disabled

# ---- group: CIVIC
colour_swatch_42 = ColourSwatch(SwatchColor=RGB(184, 108, 85))  # disabled

# ---- group: EDUCATION
colour_swatch_43 = ColourSwatch(SwatchColor=RGB(191, 196, 40))  # disabled

# ----
boolean_toggle_13 = BooleanToggle(True)  # disabled
number_slider_157 = Slider(2, range=0..5)  # disabled
file_path_9 = FilePath("C:\Users\Albert Burgers\Downloads\Exceltest 1.xlsx")  # disabled

# ---- group: SHOPPING
colour_swatch_44 = ColourSwatch(SwatchColor=RGB(64, 162, 165))  # disabled

# ----
list_length_47 = ListLength(List=random_reduce_21)  # disabled
list_length_48 = ListLength(List=random_reduce_24)  # disabled
list_length_49 = ListLength(List=random_reduce_23)  # disabled
list_length_50 = ListLength(List=random_reduce_25)  # disabled
list_length_51 = ListLength(List=random_reduce_18)  # disabled
file_path_10 = FilePath("\\Mac\Home\Desktop\OSM DATA FOR ELK\OLD\map.osm-6.xml")
panel_109 = Panel(list_length_44)  # disabled
panel_110 = Panel(list_length_46)  # disabled
panel_111 = Panel(list_length_47)  # disabled
panel_112 = Panel(list_length_48)  # disabled
panel_113 = Panel(list_length_49)  # disabled
panel_114 = Panel(list_length_50)  # disabled
file_path_11 = FilePath("\\Mac\Home\Desktop\OSM DATA FOR ELK\map.osm-5.xml")

# ---- group: SOCIAL
list_item_30 = ListItem(Index=Slider(3, range=0..10), Wrap=True)
panel_115 = Panel(list_item_30)
explode_tree_25 = ExplodeTree(Data=list_item_30)  # -> Branch0, Branch1, Branch2, Branch3

# ---- group: SLEEP
list_item_31 = ListItem(Index=Slider(1, range=0..10), Wrap=True)
panel_116 = Panel(list_item_31)
explode_tree_26 = ExplodeTree(Data=list_item_31)  # -> Branch0, Branch1, Branch2, Branch3

# ---- group: WORK
list_item_32 = ListItem(Index=Slider(2, range=0..10), Wrap=True)
panel_117 = Panel(list_item_32)
explode_tree_27 = ExplodeTree(Data=list_item_32)  # -> Branch0, Branch1, Branch2, Branch3

# ---- group: CIVIC
list_item_33 = ListItem(Index=Slider(6, range=0..10), Wrap=True)
panel_118 = Panel(list_item_33)
explode_tree_28 = ExplodeTree(Data=list_item_33)  # -> Branch0, Branch1, Branch2, Branch3

# ---- group: HOUSE
list_item_34 = ListItem(Index=Slider(0, range=0..10), Wrap=True)
panel_119 = Panel(list_item_34)
explode_tree_29 = ExplodeTree(Data=list_item_34)  # -> Branch0, Branch1, Branch2, Branch3

# ---- group: SPORTS
list_item_35 = ListItem(Index=Slider(4, range=0..10), Wrap=True)
panel_120 = Panel(list_item_35)
explode_tree_30 = ExplodeTree(Data=list_item_35)  # -> Branch0, Branch1, Branch2, Branch3

# ---- group: SHOPPING
list_item_36 = ListItem(Index=Slider(5, range=0..10), Wrap=True)
panel_121 = Panel(list_item_36)
explode_tree_31 = ExplodeTree(Data=list_item_36)  # -> Branch0, Branch1, Branch2, Branch3

# ----
panel_122 = Panel(list_length_51)  # disabled

# ---- group: EDUCATION
list_item_37 = ListItem(Index=Slider(7, range=0..10), Wrap=True)
panel_123 = Panel(list_item_37)
explode_tree_32 = ExplodeTree(Data=list_item_37)  # -> Branch0, Branch1, Branch2, Branch3

# ----
boolean_toggle_14 = BooleanToggle(True)  # disabled
number_slider_158 = Slider(2, range=0..5)  # disabled
file_path_12 = FilePath("C:\Users\Albert Burgers\Desktop\Exceltest 1.xlsx")  # disabled

custom_preview_38 = CustomPreview(Geometry=random_reduce_22, Shader=colour_swatch_37)  # disabled
custom_preview_39 = CustomPreview(Geometry=random_reduce_19, Shader=colour_swatch_38)  # disabled
custom_preview_40 = CustomPreview(Geometry=random_reduce_20, Shader=colour_swatch_40)  # disabled
custom_preview_41 = CustomPreview(Geometry=random_reduce_21, Shader=colour_swatch_39)  # disabled
custom_preview_42 = CustomPreview(Geometry=random_reduce_23, Shader=colour_swatch_41)  # disabled
custom_preview_43 = CustomPreview(Geometry=random_reduce_25, Shader=colour_swatch_42)  # disabled
custom_preview_44 = CustomPreview(Geometry=random_reduce_24, Shader=colour_swatch_44)  # disabled
custom_preview_45 = CustomPreview(Geometry=random_reduce_18, Shader=colour_swatch_43)  # disabled

# ---- group: HOUSE
number_slider_159 = Slider(0, range=0..10)  # disabled
list_item_38 = ListItem(Index=number_slider_159, Wrap=True)  # disabled
panel_124 = Panel(list_item_38)  # disabled
explode_tree_33 = ExplodeTree(Data=list_item_38)  # -> Branch0, Branch1, Branch2, Branch3; disabled

# ----
location = Location(FilePathText=file_path_7)  # -> OSMPointData, OSMData, LongitudeDomain, LatitudeDomain
location_2 = Location(FilePathText=file_path_10)  # -> OSMPointData, OSMData, LongitudeDomain, LatitudeDomain

# ---- group: HOUSE
colour_swatch_45 = ColourSwatch(SwatchColor=RGBA(99, 66, 92, 50))  # disabled
brep_36 = Brep(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)  # disabled
custom_preview_46 = CustomPreview(Geometry=brep_36, Shader=colour_swatch_45)  # disabled

# ---- group: CIVIC
number_slider_160 = Slider(6, range=0..10)  # disabled
list_item_39 = ListItem(Index=number_slider_160, Wrap=True)  # disabled
panel_125 = Panel(list_item_39)  # disabled
explode_tree_34 = ExplodeTree(Data=list_item_39)  # -> Branch0, Branch1, Branch2, Branch3; disabled

# ----
boolean_toggle_15 = BooleanToggle(True)  # disabled
number_slider_161 = Slider(2, range=0..5)  # disabled
file_path_13 = FilePath("C:\Users\Albert Burgers\Downloads\Exceltest 1.xlsx")  # disabled

number_slider_162 = Slider(6, range=0..30)
number_slider_163 = Slider(3, range=0..30)
number_slider_164 = Slider(8, range=0..30)

number_slider_165 = Slider(6, range=0..30)
number_slider_166 = Slider(3, range=0..30)
number_slider_167 = Slider(8, range=0..30)

xy_plane_21 = XYPlane(Origin=Point(0, 0, 0))  # disabled
bounding_box_22 = BoundingBox(Content=brep_36, Plane=xy_plane_21)  # -> Box, Box_2; disabled

number_slider_168 = Slider(6, range=0..30)
number_slider_169 = Slider(8, range=0..30)
number_slider_170 = Slider(3, range=0..30)

number_slider_171 = Slider(6, range=0..30)
number_slider_172 = Slider(8, range=0..30)
number_slider_173 = Slider(3, range=0..30)

number_slider_174 = Slider(8, range=0..30)
number_slider_175 = Slider(3, range=0..30)

number_slider_176 = Slider(6, range=0..30)
number_slider_177 = Slider(3, range=0..30)
number_slider_178 = Slider(8, range=0..30)

number_slider_179 = Slider(6, range=0..30)
number_slider_180 = Slider(3, range=0..30)
number_slider_181 = Slider(8, range=0..30)

xy_plane_22 = XYPlane(Origin=Point(0, 0, 0))
bounding_box_23 = BoundingBox(Content=move_30.Geometry, Plane=xy_plane_22)  # -> Box, Box_2

number_slider_182 = Slider(6, range=0..30)
number_slider_183 = Slider(3, range=0..30)
number_slider_184 = Slider(8, range=0..30)

number_slider_185 = Slider(-736, range=-10000..10000)
number_slider_186 = Slider(-852, range=-10000..10000)
subtraction_26 = Subtraction(A=number_slider_186, B=Slider(604, range=-10000..10000))
vector_xyz_5 = VectorXYZ(XComponent=number_slider_185, YComponent=number_slider_186, ZComponent=Slider(450, range=-10000..10000))  # -> Vector, Length
surface = Surface(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)
subtraction_27 = Subtraction(A=number_slider_185, B=Slider(344, range=-10000..10000))
move_31 = Move(Geometry=surface, Motion=vector_xyz_5.Vector)  # -> Geometry, Transform
box_properties_5 = BoxProperties(Box=surface)  # -> Center, Diagonal, Area, Volume, Degeneracy
deconstruct_vector_6 = DeconstructVector(Vector=box_properties_5.Center)  # -> XComponent, YComponent, ZComponent
number_slider_187 = Slider(180, range=0..360)
xy_plane_23 = XYPlane(Origin=Point(0, 0, 0))

number_slider_188 = Slider(1, range=1..10, expression="x*100")  # disabled
number_slider_189 = Slider(5, range=1..10)  # disabled
number_slider_190 = Slider(1, range=1..10, expression="x*100")  # disabled
number_slider_191 = Slider(1, range=1..10, expression="x*100")  # disabled
number_slider_192 = Slider(1, range=1..10, expression="x*100")  # disabled
number_slider_193 = Slider(1, range=1..10, expression="x*100")  # disabled
number_slider_194 = Slider(1, range=1..10, expression="x*100")  # disabled
number_slider_195 = Slider(1, range=1..10, expression="x*100")  # disabled
number_slider_196 = Slider(1, range=1..10, expression="x*100")  # disabled

panel_126 = Panel(list_length_45)  # disabled

number_slider_197 = Slider(8, range=0..10)  # disabled
number_slider_198 = Slider(2, range=0..10)  # disabled
number_slider_199 = Slider(3, range=0..10)  # disabled
number_slider_200 = Slider(1, range=0..10)  # disabled
number_slider_201 = Slider(4, range=0..10)  # disabled
number_slider_202 = Slider(5, range=0..10)  # disabled
number_slider_203 = Slider(6, range=0..10)  # disabled
number_slider_204 = Slider(9, range=0..10)  # disabled
number_slider_205 = Slider(0, range=0..10)  # disabled
number_slider_206 = Slider(7, range=0..10)  # disabled
list_item_40 = ListItem(Index=number_slider_205, Wrap=True)  # disabled
list_item_41 = ListItem(Index=number_slider_200, Wrap=True)  # disabled
list_item_42 = ListItem(Index=number_slider_198, Wrap=True)  # disabled
list_item_43 = ListItem(Index=number_slider_199, Wrap=True)  # disabled
list_item_44 = ListItem(Index=number_slider_197, Wrap=True)  # disabled
list_item_45 = ListItem(Index=number_slider_201, Wrap=True)  # disabled
list_item_46 = ListItem(Index=number_slider_202, Wrap=True)  # disabled
list_item_47 = ListItem(Index=number_slider_204, Wrap=True)  # disabled
list_item_48 = ListItem(Index=number_slider_203, Wrap=True)  # disabled
list_item_49 = ListItem(Index=number_slider_206, Wrap=True)  # disabled

# ---- group: Count time steps
# MAKE INDIVIDUAL SCRIPTS
# 
# Amount of time steps cant be limited to the amount of users. Now all the amount of pods is limited to a ‘random’ 240
boolean_toggle_16 = BooleanToggle(True)  # disabled
timer_6 = Timer(TimerInterval=100)  # disabled
amount_of_time_steps = Panel("240")  # disabled
modulus_4 = Modulus(B=amount_of_time_steps)  # disabled
panel_127 = Panel(modulus_4)  # disabled

# ----
list_length_52 = ListLength()  # disabled
subtraction_28 = Subtraction(A=list_length_52, B=panel_127)  # disabled
random_reduce_26 = RandomReduce(Reduction=subtraction_28, Seed=1)  # disabled
panel_128 = Panel(subtraction_28)  # disabled

amount_of_users_26 = Slider(200, range=0..10000)  # disabled
panel_129 = Panel(list_length_52)  # disabled

boolean_toggle_17 = BooleanToggle(False)  # disabled
timer_7 = Timer(TimerInterval=50)  # disabled

# ---- group: Count time steps
# MAKE INDIVIDUAL SCRIPTS
# 
# Amount of time steps cant be limited to the amount of users. Now all the amount of pods is limited to a ‘random’ 240
boolean_toggle_18 = BooleanToggle(True)
timer_8 = Timer(TimerInterval=100)
amount_of_time_steps_2 = Panel("240")
modulus_5 = Modulus(B=amount_of_time_steps_2)
panel_130 = Panel(modulus_5)

# ----
boolean_toggle_19 = BooleanToggle(False)
timer_9 = Timer(TimerInterval=50)

# ---- group: HOUSE
colour_swatch_46 = ColourSwatch(SwatchColor=RGB(99, 64, 91))  # disabled

# ----
custom_preview_47 = CustomPreview(Geometry=random_reduce_26, Shader=colour_swatch_46)  # disabled

number_slider_207 = Slider(1916, range=1900..2100)
vec_2 = VectorXYZ(XComponent=0, YComponent=Slider(1879, range=-10000..10000), ZComponent=0)  # -> Vector, Length
vec_3 = VectorXYZ(
    XComponent=Slider(450, range=-10000..10000),
    YComponent=Slider(-850, range=-10000..10000),
    ZComponent=Slider(-400, range=-1000..600))  # -> Vector, Length

number_slider_208 = Slider(1199, range=600..1200)
brep_37 = Brep(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)
list_length_53 = ListLength()

number_slider_209 = Slider(1, range=0..1)  # disabled
boolean_toggle_20 = BooleanToggle(True)  # disabled
file_path_14 = FilePath("C:\Users\Albert Burgers\Desktop\Excel FILE.xlsx")  # disabled
list_item_50 = ListItem(Index=0, Wrap=True)  # disabled
param_viewer = ParamViewer()  # disabled
panel_131 = Panel(list_item_50)  # disabled
flatten_tree = FlattenTree(Tree=list_item_50, Path="{0}")  # disabled
param_viewer_2 = ParamViewer(flatten_tree)  # disabled
panel_132 = Panel(flatten_tree)  # disabled

panel_133 = Panel("0 to 500")  # disabled
domain_box = DomainBox(Base=PlaneXY(0, 0, 0), X=panel_133, Y=panel_133, Z=panel_133)  # disabled
colour_swatch_47 = ColourSwatch(SwatchColor=RGB(194, 194, 194))  # disabled
brep_edges = BrepEdges(Brep=domain_box)  # -> Naked, Interior, NonManifold; disabled
deconstruct_domain = DeconstructDomain(Domain=panel_133)  # -> Start, End; disabled
custom_preview_48 = CustomPreview(Geometry=brep_edges.Interior, Material=colour_swatch_47)  # disabled

list_item_51 = ListItem(Index=0, Wrap=True)

boolean_toggle_21 = BooleanToggle(False)  # disabled
number_slider_210 = Slider(0, range=0..1)  # disabled
number_slider_211 = Slider(400, range=0..400)  # disabled
construct_domain_3 = ConstructDomain(DomainStart=number_slider_210, DomainEnd=number_slider_211)  # disabled
number_slider_212 = Slider(1, range=0..1)  # disabled
timer_10 = Timer(TimerInterval=500)  # disabled

list_length_54 = ListLength()
box_6 = EvaluateBox(Box=brep_37, UParameter=0.5, VParameter=0.5, WParameter=0.5)  # -> Plane, Point, Include

# ---- group: Count time steps
modulus_6 = Modulus(B=list_length_54)
panel_134 = Panel(modulus_6)

modulus_7 = Modulus(B=list_length_53)
panel_135 = Panel(modulus_7)

# ----
number_slider_213 = Slider(2, range=0..10)  # disabled
division_8 = Division(A=explode_tree_34.Branch1, B=number_slider_213)  # disabled
division_9 = Division(A=explode_tree_34.Branch3, B=number_slider_213)  # disabled
division_10 = Division(A=explode_tree_34.Branch2, B=number_slider_213)  # disabled

move_32 = Move(Geometry=box_6.Point, Motion=vec_3.Vector)  # -> Geometry, Transform
list_length_55 = ListLength()

# ---- group: Count time steps
modulus_8 = Modulus(B=list_length_55)
panel_136 = Panel(modulus_8)

# ----
max_amount_of_users = Panel(list_length_55)
list_length_56 = ListLength()

# ---- group: Count time steps
modulus_9 = Modulus(B=list_length_56)
panel_137 = Panel(modulus_9)

# ----
list_length_57 = ListLength()

# ---- group: Count time steps
modulus_10 = Modulus(B=list_length_57)
panel_138 = Panel(modulus_10)

# ----
modulus_11 = Modulus(B=list_length_57)
panel_139 = Panel(modulus_11)
max_amount_of_users_2 = Panel(list_length_57)
max_amount_of_users_3 = Panel(list_length_56)
list_length_58 = ListLength()

# ---- group: Count time steps
modulus_12 = Modulus(B=list_length_58)
panel_140 = Panel(modulus_12)

# ----
max_amount_of_users_4 = Panel(list_length_58)
list_length_59 = ListLength()
max_amount_of_users_5 = Panel(list_length_59)
max_amount_of_users_6 = Panel(list_length_53)
max_amount_of_users_7 = Panel(list_length_54)
list_length_60 = ListLength()

# ---- group: Count time steps
modulus_13 = Modulus(B=list_length_60)
panel_141 = Panel(modulus_13)

# ----
max_amount_of_users_8 = Panel(list_length_60)
subtraction_29 = Subtraction(A=list_length_55, B=panel_136)
subtraction_30 = Subtraction(A=list_length_56, B=panel_137)
subtraction_31 = Subtraction(A=list_length_57, B=panel_138)
subtraction_32 = Subtraction(A=list_length_58, B=panel_140)
subtraction_33 = Subtraction(A=list_length_54, B=panel_134)
subtraction_34 = Subtraction(A=list_length_53, B=panel_135)
subtraction_35 = Subtraction(A=list_length_59, B=modulus_11)
subtraction_36 = Subtraction(A=list_length_60, B=panel_141)
random_reduce_27 = RandomReduce(Reduction=subtraction_29, Seed=1)
random_reduce_28 = RandomReduce(Reduction=subtraction_30, Seed=1)
random_reduce_29 = RandomReduce(Reduction=subtraction_31, Seed=1)
random_reduce_30 = RandomReduce(Reduction=subtraction_32, Seed=1)
panel_142 = Panel(subtraction_29)
random_reduce_31 = RandomReduce(Reduction=subtraction_34, Seed=1)

# ---- group: CIVIC
colour_swatch_48 = ColourSwatch(SwatchColor=RGB(184, 108, 85))  # disabled

# ----
panel_143 = Panel(subtraction_30)
panel_144 = Panel(subtraction_31)
random_reduce_32 = RandomReduce(Reduction=subtraction_35, Seed=1)
panel_145 = Panel(subtraction_32)
random_reduce_33 = RandomReduce(Reduction=subtraction_33, Seed=1)
cull_pattern_6 = CullPattern(CullPattern=random_reduce_33)
panel_146 = Panel(subtraction_34)
panel_147 = Panel(subtraction_35)
random_reduce_34 = RandomReduce(Reduction=subtraction_36, Seed=1)
panel_148 = Panel(subtraction_33)
panel_149 = Panel(subtraction_36)

# ---- group: WORK
colour_swatch_49 = ColourSwatch(SwatchColor=RGB(223, 178, 46))

# ---- group: HOUSE
colour_swatch_50 = ColourSwatch(SwatchColor=RGB(99, 64, 91))

# ---- group: SOCIAL
colour_swatch_51 = ColourSwatch(SwatchColor=RGB(228, 45, 76))

# ---- group: SLEEP
colour_swatch_52 = ColourSwatch(SwatchColor=RGB(17, 87, 87))

# ----
number_slider_214 = Slider(2, range=0..10)  # disabled
division_11 = Division(A=explode_tree_34.Branch1, B=number_slider_214)  # disabled
division_12 = Division(A=explode_tree_34.Branch3, B=number_slider_214)  # disabled
division_13 = Division(A=explode_tree_34.Branch2, B=number_slider_214)  # disabled

panel_150 = Panel(cull_pattern_6)

# ---- group: CIVIC
colour_swatch_53 = ColourSwatch(SwatchColor=RGB(184, 108, 85))

# ---- group: EDUCATION
colour_swatch_54 = ColourSwatch(SwatchColor=RGB(191, 196, 40))

# ---- group: SHOPPING
colour_swatch_55 = ColourSwatch(SwatchColor=RGB(64, 162, 165))

# ----
volume = Volume(Geometry=random_reduce_33)  # -> Volume, Centroid
custom_preview_49 = CustomPreview(Geometry=random_reduce_30, Shader=colour_swatch_49)
custom_preview_50 = CustomPreview(Geometry=random_reduce_27, Shader=colour_swatch_50)
custom_preview_51 = CustomPreview(Geometry=random_reduce_28, Shader=colour_swatch_52)
move_33 = Move(Motion=vec_2.Vector)  # -> Geometry, Transform
custom_preview_52 = CustomPreview(Geometry=random_reduce_29, Shader=colour_swatch_51)

number_slider_215 = Slider(2, range=0..10)
division_14 = Division(A=explode_tree_28.Branch1, B=number_slider_215)
division_15 = Division(A=explode_tree_28.Branch3, B=number_slider_215)
division_16 = Division(A=explode_tree_28.Branch2, B=number_slider_215)

custom_preview_53 = CustomPreview(Geometry=random_reduce_32, Shader=ColourSwatch(SwatchColor=RGB(242, 105, 41)))
custom_preview_54 = CustomPreview(Geometry=random_reduce_33, Shader=colour_swatch_53)
custom_preview_55 = CustomPreview(Geometry=random_reduce_31, Shader=colour_swatch_55)
custom_preview_56 = CustomPreview(Geometry=random_reduce_34, Shader=colour_swatch_54)
reverse_list = ReverseList(List=volume.Centroid)
move_34 = Move(Geometry=move_33.Geometry, Motion=vec_3.Vector)  # -> Geometry, Transform
center_box_11 = CenterBox(Base=reverse_list, X=division_14, Y=division_16, Z=division_15)
other_2 = ColourSwatch(SwatchColor=RGB(199, 199, 199))
cull_pattern_7 = CullPattern(CullPattern=volume.Centroid)
gate_not_2 = GateNot(A=center_box_11)
panel_151 = Panel(volume.Centroid)
graft_tree = GraftTree(Tree=graft_tree, IncludeEmptyLists=True, IncludeNullItems=True)
custom_preview_57 = CustomPreview(Geometry=move_34.Geometry, Material=other_2)
tree_statistics = TreeStatistics(Tree=graft_tree)  # -> Paths, Length, Count
custom_preview_58 = CustomPreview(Shader=ColourSwatch(SwatchColor=RGB(27, 223, 85)))
panel_152 = Panel(cull_pattern_7)
panel_153 = Panel(graft_tree)
split_tree = SplitTree(Masks=flatten(random_reduce_33))  # -> Positive, Negative
shift_paths = ShiftPaths(Data=split_tree.Positive, Offset=-1)
param_viewer_3 = ParamViewer(shift_paths)

# ---- group: Amount of users from Data sheet
number_slider_216 = Slider(1, range=0..1)  # disabled
boolean_toggle_22 = BooleanToggle(True)  # disabled
file_path_15 = FilePath("C:\Users\Albert Burgers\Desktop\Excel FILE.xlsx")  # disabled
number_slider_217 = Slider(0, range=0..1)  # disabled
tree_branch = TreeBranch(Path=number_slider_217, MaintainPaths=True)  # disabled
list_length_61 = ListLength(List=tree_branch)  # disabled

# ---- group: Box environment
panel_154 = Panel("0 to 50")  # disabled
domain_box_2 = DomainBox(Base=PlaneXY(0, 0, 0), X=panel_154, Y=panel_154, Z=panel_154)  # disabled

# ----
number_slider_218 = Slider(8, range=0..30)  # disabled
number_slider_219 = Slider(3, range=0..30)  # disabled
number_slider_220 = Slider(6, range=0..30)  # disabled

# ---- group: AMOUNT OF USERS
number_slider_221 = Slider(679, range=0..1000)  # disabled
number_slider_222 = Slider(0, range=0..100)  # disabled
construct_domain_4 = ConstructDomain(DomainStart=number_slider_222, DomainEnd=number_slider_221)  # disabled
sub_list_2 = SubList(Domain=construct_domain_4, Wrap=True)  # -> List, Index; disabled
list_length_62 = ListLength(List=sub_list_2.List)  # disabled
panel_155 = Panel(list_length_62)  # disabled

# ----
panel_156 = Panel("1")  # disabled
number_slider_223 = Slider(0.155, range=0..1)  # disabled
multiplication_11 = Multiplication(B=number_slider_223)  # disabled

number_slider_224 = Slider(0.235, range=0..1)  # disabled
multiplication_12 = Multiplication(B=number_slider_224)  # disabled

number_slider_225 = Slider(0.32, range=0..1)  # disabled
multiplication_13 = Multiplication(B=number_slider_225)  # disabled

number_slider_226 = Slider(4.2, range=0..10)  # disabled
panel_159 = Panel("0")  # disabled
construct_domain_5 = ConstructDomain(DomainStart=panel_159, DomainEnd=number_slider_226)  # disabled
number_slider_227 = Slider(0.204, range=0..1)  # disabled
multiplication_14 = Multiplication(B=number_slider_227)  # disabled

number_slider_228 = Slider(4.3, range=0..10)  # disabled
panel_160 = Panel("0")  # disabled
construct_domain_6 = ConstructDomain(DomainStart=panel_160, DomainEnd=number_slider_228)  # disabled
number_slider_229 = Slider(0.167, range=0..1)  # disabled
multiplication_15 = Multiplication(B=number_slider_229)  # disabled

number_slider_230 = Slider(4.2, range=0..10)  # disabled
panel_161 = Panel("0")  # disabled
construct_domain_7 = ConstructDomain(DomainStart=panel_161, DomainEnd=number_slider_230)  # disabled
number_slider_231 = Slider(0.189, range=0..1)  # disabled
multiplication_16 = Multiplication(B=number_slider_231)  # disabled

# ----
# Object schedule input
path = FilePath("C:\Users\Albert Burgers\Downloads\test_168_users.csv")
file = ReadFile(File=path, PerLineParse=True)
split = TextSplit(Text=file, Separators=";")  # -> simplify(Result)

number_slider_232 = Slider(0.3, range=0..1)  # disabled
number_slider_233 = Slider(5.1, range=0..10)  # disabled
construct_domain_8 = ConstructDomain(DomainStart=number_slider_232, DomainEnd=number_slider_233)  # disabled

number_slider_234 = Slider(0.2, range=0..1)  # disabled
number_slider_235 = Slider(2.3, range=0..10)  # disabled
construct_domain_9 = ConstructDomain(DomainStart=number_slider_234, DomainEnd=number_slider_235)  # disabled

number_slider_236 = Slider(0.4, range=0..1)  # disabled
number_slider_237 = Slider(5.4, range=0..10)  # disabled
construct_domain_10 = ConstructDomain(DomainStart=number_slider_236, DomainEnd=number_slider_237)  # disabled

number_slider_238 = Slider(34, range=0..100)  # disabled
number_slider_239 = Slider(0.386, range=0..1)  # disabled
number_slider_240 = Slider(1, range=0..1)  # disabled
number_slider_241 = Slider(0.778, range=0..1)  # disabled
mesh_sphere_2 = MeshSphere(Base=PlaneXY(0, 0, 0), Radius=number_slider_238, UCount=10, VCount=20)  # disabled
sphere_2 = Sphere(Base=PlaneXY(0, 0, 0), Radius=number_slider_238)  # disabled
brep_38 = Brep(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)  # disabled
scale_nu = ScaleNU(
    Geometry=mesh_sphere_2,
    Plane=PlaneXY(0, 0, 0),
    ScaleX=number_slider_241,
    ScaleY=number_slider_239,
    ScaleZ=number_slider_240)  # -> Geometry, Transform; disabled
bounding_box_24 = BoundingBox(Content=mesh_sphere_2, Plane=PlaneXY(0, 0, 0))  # -> Box, Box_2; disabled
box_properties_6 = BoxProperties(Box=bounding_box_24.Box)  # -> Center, Diagonal, Area, Volume, Degeneracy; disabled
deconstruct_vector_7 = DeconstructVector(Vector=box_properties_6.Diagonal)  # -> XComponent, YComponent, ZComponent; disabled
expression_13 = Expression(Variable_x=deconstruct_vector_2.YComponent, Expression="ceiling(x)")  # disabled
expression_14 = Expression(Variable_x=deconstruct_vector_2.ZComponent, Expression="ceiling(x)")  # disabled
expression_15 = Expression(Variable_x=deconstruct_vector_2.XComponent, Expression="ceiling(x)")  # disabled
expression_16 = Expression(Variable_x=deconstruct_vector_7.YComponent, Variable_y=expression_13, Expression="x/(2*Y)")  # disabled
expression_17 = Expression(Variable_x=deconstruct_vector_7.ZComponent, Variable_y=expression_14, Expression="x/(2*Y)")  # disabled
expression_18 = Expression(Variable_x=deconstruct_vector_7.XComponent, Variable_y=expression_15, Expression="x/(2*Y)")  # disabled
sphere_3 = Sphere(Base=PlaneXY(0, 0, 0), Radius=1)  # disabled
range_8 = Range(Domain=Domain(0, 1), Steps=expression_15)  # disabled
range_9 = Range(Domain=Domain(0, 1), Steps=expression_13)  # disabled
range_10 = Range(Domain=Domain(0, 1), Steps=expression_14)  # disabled
number_slider_242 = Slider(1, range=0..1)  # disabled
scale_nu_2 = ScaleNU(Geometry=sphere_3, Plane=PlaneXY(0, 0, 0), ScaleX=1, ScaleY=1, ScaleZ=1)  # -> Geometry, Transform; disabled
cross_reference_3 = CrossReference(ListListA=range_8, ListListB=range_9, ListC=range_10, CrossMode=1)  # -> ListListA, ListListB, ListC; disabled
expression_19 = Expression(Variable_x=expression_15, Variable_y=expression_13, z=expression_14, Expression="hypot(hypot(x,y),z)")  # disabled
evaluate_box_3 = EvaluateBox(
    Box=bounding_box_24.Box,
    UParameter=cross_reference_3.ListListA,
    VParameter=cross_reference_3.ListListB,
    WParameter=cross_reference_3.ListC)  # -> Plane, Point, Include; disabled
data_dam = DataDam(BufferDelay=10000000, BufferMode=0)  # disabled
deconstruct_mesh = DeconstructMesh()  # -> Vertices, Faces, Colours, Normals; disabled
construct_mesh = ConstructMesh(Vertices=deconstruct_mesh.Vertices, Faces=graft(deconstruct_mesh.Faces))  # -> flatten(Mesh); disabled
mesh = Mesh(construct_mesh)  # disabled

center_box_12 = CenterBox(Base=PlaneXY(0, 0, 0), X=expression_18, Y=expression_16, Z=expression_17)  # disabled

# ---- group: THE SHAPE OF THE OBJECT/MESH DETERMINES WHICH ONE YOU USE
mesh_closest_point = MeshClosestPoint(Point=evaluate_box_3.Point, Mesh=mesh_sphere_2)  # -> Point, Index, Parameter; disabled
brep_closest_point = BrepClosestPoint()  # -> Point, Normal, Distance; disabled

# ----
mesh_box_2 = MeshBox(Base=center_box_12, XCount=number_slider_242, YCount=number_slider_242, ZCount=number_slider_242)  # disabled
distance_3 = Distance(PointA=evaluate_box_3.Point, PointB=mesh_closest_point.Point)  # disabled
smaller_than = SmallerThan(FirstNumber=distance_3, SecondNumber=expression_19)  # -> SmallerThan, OrEqualTo; disabled
cull_pattern_8 = CullPattern(List=evaluate_box_3.Point, CullPattern=smaller_than.SmallerThan)  # disabled
move_35 = Move(Geometry=center_box_12, Motion=cull_pattern_8)  # -> Geometry, Transform; disabled

panel_162 = Panel([distance_3, expression_19])  # disabled

number_slider_243 = Slider(34, range=0..100)  # disabled
number_slider_244 = Slider(0.386, range=0..1)  # disabled
number_slider_245 = Slider(1, range=0..1)  # disabled
number_slider_246 = Slider(0.778, range=0..1)  # disabled
mesh_sphere_3 = MeshSphere(Base=PlaneXY(0, 0, 0), Radius=number_slider_243, UCount=10, VCount=20)  # disabled
sphere_4 = Sphere(Base=PlaneXY(0, 0, 0), Radius=number_slider_243)  # disabled
brep_39 = Brep(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)  # disabled
scale_nu_3 = ScaleNU(Geometry=brep_39, Plane=PlaneXY(0, 0, 0), ScaleX=number_slider_246, ScaleY=number_slider_244, ScaleZ=number_slider_245)  # -> Geometry, Transform; disabled
bounding_box_25 = BoundingBox(Content=brep_39, Plane=PlaneXY(0, 0, 0))  # -> Box, Box_2; disabled
box_properties_7 = BoxProperties(Box=bounding_box_25.Box)  # -> Center, Diagonal, Area, Volume, Degeneracy; disabled
deconstruct_vector_8 = DeconstructVector(Vector=box_properties_7.Diagonal)  # -> XComponent, YComponent, ZComponent; disabled
sphere_5 = Sphere(Base=PlaneXY(0, 0, 0), Radius=1)  # disabled
number_slider_247 = Slider(1, range=0..1)  # disabled
data_dam_2 = DataDam(BufferDelay=10000000, BufferMode=0)  # disabled
deconstruct_mesh_2 = DeconstructMesh()  # -> Vertices, Faces, Colours, Normals; disabled
construct_mesh_2 = ConstructMesh(Vertices=deconstruct_mesh_2.Vertices, Faces=graft(deconstruct_mesh_2.Faces))  # -> flatten(Mesh); disabled
mesh_2 = Mesh(construct_mesh_2)  # disabled

# ---- group: Uniform scale
number_slider_248 = Slider(0.1, range=0..10)  # disabled
deconstruct_vector_9 = DeconstructVector(Vector=box_properties_7.Diagonal)  # -> XComponent, YComponent, ZComponent; disabled

# ----
number_slider_249 = Slider(34, range=0..100)  # disabled
number_slider_250 = Slider(0.386, range=0..1)  # disabled
number_slider_251 = Slider(1, range=0..1)  # disabled
number_slider_252 = Slider(0.778, range=0..1)  # disabled
mesh_sphere_4 = MeshSphere(Base=PlaneXY(0, 0, 0), Radius=number_slider_249, UCount=10, VCount=20)  # disabled
sphere_6 = Sphere(Base=PlaneXY(0, 0, 0), Radius=number_slider_249)  # disabled
scale_nu_4 = ScaleNU(
    Geometry=mesh_sphere_4,
    Plane=PlaneXY(0, 0, 0),
    ScaleX=number_slider_252,
    ScaleY=number_slider_250,
    ScaleZ=number_slider_251)  # -> Geometry, Transform; disabled
brep_40 = Brep(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)  # disabled
bounding_box_26 = BoundingBox(Content=brep_40, Plane=PlaneXY(0, 0, 0))  # -> Box, Box_2; disabled
box_properties_8 = BoxProperties(Box=bounding_box_26.Box)  # -> Center, Diagonal, Area, Volume, Degeneracy; disabled
deconstruct_vector_10 = DeconstructVector(Vector=box_properties_8.Diagonal)  # -> XComponent, YComponent, ZComponent; disabled
expression_20 = Expression(Variable_x=deconstruct_vector_3.YComponent, Expression="ceiling(x)")  # disabled
expression_21 = Expression(Variable_x=deconstruct_vector_3.ZComponent, Expression="ceiling(x)")  # disabled
expression_22 = Expression(Variable_x=deconstruct_vector_3.XComponent, Expression="ceiling(x)")  # disabled
expression_23 = Expression(Variable_x=deconstruct_vector_10.YComponent, Variable_y=expression_20, Expression="x/(2*Y)")  # disabled
expression_24 = Expression(Variable_x=deconstruct_vector_10.ZComponent, Variable_y=expression_21, Expression="x/(2*Y)")  # disabled
expression_25 = Expression(Variable_x=deconstruct_vector_10.XComponent, Variable_y=expression_22, Expression="x/(2*Y)")  # disabled
range_11 = Range(Domain=Domain(0, 1), Steps=expression_22)  # disabled
range_12 = Range(Domain=Domain(0, 1), Steps=expression_20)  # disabled
range_13 = Range(Domain=Domain(0, 1), Steps=expression_21)  # disabled
center_box_13 = CenterBox(Base=PlaneXY(0, 0, 0), X=expression_25, Y=expression_23, Z=expression_24)  # disabled
number_slider_253 = Slider(1, range=0..1)  # disabled
expression_26 = Expression(Variable_x=expression_25, Variable_y=expression_23, z=expression_24, Expression="hypot(hypot(x,y),z)")  # disabled
cross_reference_4 = CrossReference(ListListA=range_11, ListListB=range_12, ListC=range_13, CrossMode=1)  # -> ListListA, ListListB, ListC; disabled
evaluate_box_4 = EvaluateBox(
    Box=bounding_box_26.Box,
    UParameter=cross_reference_4.ListListA,
    VParameter=cross_reference_4.ListListB,
    WParameter=cross_reference_4.ListC)  # -> Plane, Point, Include; disabled
mesh_box_3 = MeshBox(Base=center_box_13, XCount=number_slider_253, YCount=number_slider_253, ZCount=number_slider_253)  # disabled
data_dam_3 = DataDam(BufferDelay=10000000, BufferMode=0)  # disabled
deconstruct_mesh_3 = DeconstructMesh()  # -> Vertices, Faces, Colours, Normals; disabled
construct_mesh_3 = ConstructMesh(Vertices=deconstruct_mesh_3.Vertices, Faces=graft(deconstruct_mesh_3.Faces))  # -> flatten(Mesh); disabled
mesh_3 = Mesh(construct_mesh_3)  # disabled

# ---- group: THE SHAPE OF THE OBJECT/MESH DETERMINES WHICH ONE YOU USE
mesh_closest_point_2 = MeshClosestPoint(Point=evaluate_box_4.Point, Mesh=brep_40)  # -> Point, Index, Parameter; disabled
brep_closest_point_2 = BrepClosestPoint()  # -> Point, Normal, Distance

# ----
distance_4 = Distance(PointA=evaluate_box_4.Point, PointB=mesh_closest_point_2.Point)  # disabled
smaller_than_2 = SmallerThan(FirstNumber=distance_4, SecondNumber=expression_26)  # -> SmallerThan, OrEqualTo; disabled
cull_pattern_9 = CullPattern(List=evaluate_box_4.Point, CullPattern=smaller_than_2.SmallerThan)  # disabled
move_36 = Move(Geometry=mesh_box_3, Motion=cull_pattern_9)  # -> Geometry, Transform; disabled

number_slider_254 = Slider(34, range=0..100)  # disabled
brep_41 = Brep(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)  # disabled
number_slider_255 = Slider(4, range=0..10)  # disabled
number_slider_256 = Slider(3, range=0..10)  # disabled
number_slider_257 = Slider(3, range=0..10)  # disabled
bounding_box_27 = BoundingBox(Content=brep_41, Plane=PlaneXY(0, 0, 0))  # -> Box, Box_2; disabled
box_properties_9 = BoxProperties(Box=bounding_box_27.Box)  # -> Center, Diagonal, Area, Volume, Degeneracy; disabled
center_box_14 = CenterBox(Base=PlaneXY(0, 0, 0), X=number_slider_255, Y=number_slider_256, Z=number_slider_257)  # disabled
box_properties_10 = BoxProperties(Box=center_box_14)  # -> Center, Diagonal, Area, Volume, Degeneracy; disabled
deconstruct_vector_11 = DeconstructVector(Vector=box_properties_9.Diagonal)  # -> XComponent, YComponent, ZComponent; disabled
number_slider_258 = Slider(1, range=0..1)  # disabled

# ---- group: TURN THIS BACK ON
mesh_sphere_5 = MeshSphere(Base=PlaneXY(0, 0, 0), Radius=number_slider_254, UCount=10, VCount=20)  # disabled
sphere_7 = Sphere(Base=PlaneXY(0, 0, 0), Radius=number_slider_254)  # disabled

# ---- group: Uniform scale
number_slider_259 = Slider(0.929, range=0..1)  # disabled
deconstruct_vector_12 = DeconstructVector(Vector=box_properties_9.Diagonal)  # -> XComponent, YComponent, ZComponent; disabled

# ----
expression_27 = Expression(Variable_x=deconstruct_vector_12.YComponent, Expression="ceiling(x)")  # disabled
expression_28 = Expression(Variable_x=deconstruct_vector_12.ZComponent, Expression="ceiling(x)")  # disabled
expression_29 = Expression(Variable_x=deconstruct_vector_12.XComponent, Expression="ceiling(x)")  # disabled
expression_30 = Expression(Variable_x=deconstruct_vector_11.YComponent, Variable_y=expression_27, Expression="x/(2*Y)")  # disabled
expression_31 = Expression(Variable_x=deconstruct_vector_11.ZComponent, Variable_y=expression_28, Expression="x/(2*Y)")  # disabled
expression_32 = Expression(Variable_x=deconstruct_vector_11.XComponent, Variable_y=expression_29, Expression="x/(2*Y)")  # disabled
range_14 = Range(Domain=Domain(0, 1), Steps=deconstruct_vector_12.XComponent)  # disabled
range_15 = Range(Domain=Domain(0, 1), Steps=deconstruct_vector_12.YComponent)  # disabled
range_16 = Range(Domain=Domain(0, 1), Steps=deconstruct_vector_12.ZComponent)  # disabled
center_box_15 = CenterBox(Base=PlaneXY(0, 0, 0), X=expression_32, Y=expression_30, Z=expression_31)  # disabled
cross_reference_5 = CrossReference(ListListA=range_14, ListListB=range_15, ListC=range_16, CrossMode=1)  # -> ListListA, ListListB, ListC; disabled
evaluate_box_5 = EvaluateBox(
    Box=bounding_box_27.Box,
    UParameter=cross_reference_5.ListListA,
    VParameter=cross_reference_5.ListListB,
    WParameter=cross_reference_5.ListC)  # -> Plane, Point, Include; disabled
mesh_box_4 = MeshBox(Base=center_box_15, XCount=number_slider_258, YCount=number_slider_258, ZCount=number_slider_258)  # disabled
move_37 = Move(Geometry=mesh_box_4, Motion=evaluate_box_5.Point)  # -> Geometry, Transform; disabled

# ---- group: TURN THIS BACK ON
collision_one_many_5 = CollisionOneMany(Collider=move_37.Geometry, Obstacles=brep_41)  # -> Collision, Index; disabled
cull_pattern_10 = CullPattern(List=move_37.Geometry, CullPattern=collision_one_many_5.Collision)  # disabled

# ----
expression_33 = Expression(Variable_x=deconstruct_vector_9.YComponent, Expression="ceiling(x)")  # disabled
expression_34 = Expression(Variable_x=deconstruct_vector_9.ZComponent, Expression="ceiling(x)")  # disabled
expression_35 = Expression(Variable_x=deconstruct_vector_9.XComponent, Expression="ceiling(x)")  # disabled
expression_36 = Expression(Variable_x=deconstruct_vector_8.YComponent, Variable_y=expression_33, Expression="x/(2*Y)")  # disabled
expression_37 = Expression(Variable_x=deconstruct_vector_8.ZComponent, Variable_y=expression_34, Expression="x/(2*Y)")  # disabled
expression_38 = Expression(Variable_x=deconstruct_vector_8.XComponent, Variable_y=expression_35, Expression="x/(2*Y)")  # disabled
scale_nu_5 = ScaleNU(Geometry=sphere_5, Plane=PlaneXY(0, 0, 0), ScaleX=expression_38, ScaleY=expression_36, ScaleZ=expression_37)  # -> Geometry, Transform; disabled
range_17 = Range(Domain=Domain(0, 1), Steps=expression_35)  # disabled
range_18 = Range(Domain=Domain(0, 1), Steps=expression_33)  # disabled
range_19 = Range(Domain=Domain(0, 1), Steps=expression_34)  # disabled
cross_reference_6 = CrossReference(ListListA=range_17, ListListB=range_18, ListC=range_19, CrossMode=1)  # -> ListListA, ListListB, ListC; disabled
expression_39 = Expression(Variable_x=expression_38, Variable_y=expression_36, z=expression_37, Expression="hypot(hypot(x,y),z)")  # disabled
evaluate_box_6 = EvaluateBox(
    Box=bounding_box_25.Box,
    UParameter=cross_reference_6.ListListA,
    VParameter=cross_reference_6.ListListB,
    WParameter=cross_reference_6.ListC)  # -> Plane, Point, Include; disabled
mesh_box_5 = MeshBox(Base=scale_nu_5.Geometry, XCount=number_slider_247, YCount=number_slider_247, ZCount=number_slider_247)  # disabled

# ---- group: THE SHAPE OF THE OBJECT/MESH DETERMINES WHICH ONE YOU USE
mesh_closest_point_3 = MeshClosestPoint(Point=evaluate_box_6.Point, Mesh=brep_39)  # -> Point, Index, Parameter; disabled
brep_closest_point_3 = BrepClosestPoint()  # -> Point, Normal, Distance; disabled

# ----
distance_5 = Distance(PointA=evaluate_box_6.Point, PointB=mesh_closest_point_3.Point)  # disabled
smaller_than_3 = SmallerThan(FirstNumber=distance_5, SecondNumber=expression_39)  # -> SmallerThan, OrEqualTo; disabled
cull_pattern_11 = CullPattern(List=evaluate_box_6.Point, CullPattern=smaller_than_3.SmallerThan)  # disabled
move_38 = Move(Geometry=scale_nu_5.Geometry, Motion=cull_pattern_11)  # -> Geometry, Transform; disabled

# ---- group: RHINO VIEWPORT TOOL
panel_163 = Panel("RHINO VIEWPORT TOOL")  # disabled
colour_swatch_56 = ColourSwatch(SwatchColor=RGBA(255, 255, 255, 10))  # disabled
move_39 = Move(Geometry=move_9.Geometry, Motion=unit_z)  # -> Geometry, Transform; disabled
geometry_8 = Geometry(move_39.Geometry)  # disabled
custom_preview_59 = CustomPreview(Geometry=geometry_8, Shader=colour_swatch_56)  # disabled

multiplication_17 = Multiplication(A=integer_4, B=number_slider_26)  # disabled
unit_x_3 = UnitX(Factor=multiplication_17)  # disabled
unit_y_2 = UnitY(Factor=multiplication_17)  # disabled
unit_z_5 = UnitZ(Factor=multiplication_17)  # disabled
move_40 = Move(Geometry=point, Motion=unit_x_3)  # -> Geometry, Transform; disabled
move_41 = Move(Geometry=point, Motion=unit_y_2)  # -> Geometry, Transform; disabled
move_42 = Move(Geometry=move_40.Geometry, Motion=unit_y_2)  # -> Geometry, Transform; disabled
move_43 = Move(Geometry=move_41.Geometry, Motion=unit_z_5)  # -> Geometry, Transform; disabled
move_44 = Move(Geometry=move_41.Geometry, Motion=unit_x_3)  # -> Geometry, Transform; disabled
number_slider_260 = Slider(-1, range=-1..1)  # disabled
polyline_16 = PolyLine(Vertices=[move_41.Geometry, move_44.Geometry], Closed=False)  # disabled
polyline_17 = PolyLine(Vertices=[move_41.Geometry, move_43.Geometry], Closed=False)  # disabled
polyline_18 = PolyLine(Vertices=[move_40.Geometry, move_42.Geometry], Closed=False)  # disabled
yz_plane_2 = YZPlane(Origin=Point(0, 0, 0))  # disabled
xy_plane_24 = XYPlane(Origin=Point(0, 0, 0))  # disabled

number_slider_261 = Slider(1, range=0.5..4)  # disabled
colour_swatch_57 = ColourSwatch(SwatchColor=RGBA(217, 217, 217, 20))  # disabled

multiplication_18 = Multiplication(A=number_slider_261, B=number_slider_26)  # disabled
multiplication_19 = Multiplication(A=multiplication_18, B=number_slider_260)  # disabled
offset = Offset(Curve=polyline_18, Distance=multiplication_18, Plane=xy_plane_24, Corners=1)  # disabled
offset_2 = Offset(Curve=polyline_16, Distance=multiplication_19, Plane=xy_plane_24, Corners=1)  # disabled
offset_3 = Offset(Curve=polyline_17, Distance=multiplication_18, Plane=yz_plane_2, Corners=1)  # disabled
rotate_6 = Rotate(Geometry=[offset_3, offset_2, offset], Angle=degrees(number_slider_33), Plane=xy_plane)  # -> Geometry, Transform; disabled

geometry_9 = Geometry(rotate_6.Geometry)  # disabled

custom_preview_60 = CustomPreview(Geometry=geometry_9, Shader=colour_swatch_57)  # disabled

# ---- group: HOUSE
brep_42 = Brep(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)  # disabled
colour_swatch_58 = ColourSwatch(SwatchColor=RGBA(99, 66, 92, 50))  # disabled

# ----
move_45 = Move(Geometry=brep_42, Motion=unit_z)  # -> Geometry, Transform; disabled

# ---- group: HOUSE (continued)
custom_preview_61 = CustomPreview(Geometry=move_45.Geometry, Shader=colour_swatch_58)  # disabled

# ----
xy_plane_25 = XYPlane(Origin=Point(0, 0, 0))  # disabled
bounding_box_28 = BoundingBox(Content=move_45.Geometry, Plane=xy_plane_25)  # -> Box, Box_2; disabled

# ---- group: WORK
brep_43 = Brep(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)  # disabled
colour_swatch_59 = ColourSwatch(SwatchColor=RGBA(222, 178, 47, 50))  # disabled

# ----
move_46 = Move(Geometry=brep_43, Motion=unit_z)  # -> Geometry, Transform; disabled

# ---- group: WORK (continued)
custom_preview_62 = CustomPreview(Geometry=move_46.Geometry, Shader=colour_swatch_59)  # disabled

# ----
xy_plane_26 = XYPlane(Origin=Point(0, 0, 0))  # disabled
bounding_box_29 = BoundingBox(Content=move_46.Geometry, Plane=xy_plane_26)  # -> Box, Box_2; disabled

# ---- group: SOCIAL
brep_44 = Brep(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)  # disabled
colour_swatch_60 = ColourSwatch(SwatchColor=RGBA(227, 45, 76, 50))  # disabled

# ----
move_47 = Move(Geometry=brep_44, Motion=unit_z)  # -> Geometry, Transform; disabled

# ---- group: SOCIAL (continued)
custom_preview_63 = CustomPreview(Geometry=move_47.Geometry, Shader=colour_swatch_60)  # disabled

# ----
xy_plane_27 = XYPlane(Origin=Point(0, 0, 0))  # disabled
bounding_box_30 = BoundingBox(Content=move_47.Geometry, Plane=xy_plane_27)  # -> Box, Box_2; disabled

# ---- group: SLEEP
brep_45 = Brep(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)  # disabled
colour_swatch_61 = ColourSwatch(SwatchColor=RGBA(17, 87, 87, 50))  # disabled

# ----
move_48 = Move(Geometry=brep_45, Motion=unit_z)  # -> Geometry, Transform; disabled

# ---- group: SLEEP (continued)
custom_preview_64 = CustomPreview(Geometry=move_48.Geometry, Shader=colour_swatch_61)  # disabled

# ----
xy_plane_28 = XYPlane(Origin=Point(0, 0, 0))  # disabled
bounding_box_31 = BoundingBox(Content=move_48.Geometry, Plane=xy_plane_28)  # -> Box, Box_2; disabled

# ---- group: SHOPPING
brep_46 = Brep(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)  # disabled
colour_swatch_62 = ColourSwatch(SwatchColor=RGBA(65, 162, 166, 50))  # disabled

# ----
move_49 = Move(Geometry=brep_46, Motion=unit_z)  # -> Geometry, Transform; disabled

# ---- group: SHOPPING (continued)
custom_preview_65 = CustomPreview(Geometry=move_49.Geometry, Shader=colour_swatch_62)  # disabled

# ----
xy_plane_29 = XYPlane(Origin=Point(0, 0, 0))  # disabled
bounding_box_32 = BoundingBox(Content=move_49.Geometry, Plane=xy_plane_29)  # -> Box, Box_2; disabled

# ---- group: CIVIC
brep_47 = Brep(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)  # disabled
colour_swatch_63 = ColourSwatch(SwatchColor=RGBA(184, 108, 85, 50))  # disabled

# ----
move_50 = Move(Geometry=brep_47, Motion=unit_z)  # -> Geometry, Transform; disabled

# ---- group: CIVIC (continued)
custom_preview_66 = CustomPreview(Geometry=move_50.Geometry, Shader=colour_swatch_63)  # disabled

# ----
xy_plane_30 = XYPlane(Origin=Point(0, 0, 0))  # disabled
bounding_box_33 = BoundingBox(Content=move_50.Geometry, Plane=xy_plane_30)  # -> Box, Box_2; disabled

# ---- group: SPORTS
brep_48 = Brep(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)  # disabled
colour_swatch_64 = ColourSwatch(SwatchColor=RGBA(242, 105, 41, 50))  # disabled

# ----
move_51 = Move(Geometry=brep_48, Motion=unit_z)  # -> Geometry, Transform; disabled

# ---- group: SPORTS (continued)
custom_preview_67 = CustomPreview(Geometry=move_51.Geometry, Shader=colour_swatch_64)  # disabled

# ----
xy_plane_31 = XYPlane(Origin=Point(0, 0, 0))  # disabled
bounding_box_34 = BoundingBox(Content=move_51.Geometry, Plane=xy_plane_31)  # -> Box, Box_2; disabled

# ---- group: EDUCATION
brep_49 = Brep(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)  # disabled
colour_swatch_65 = ColourSwatch(SwatchColor=RGBA(191, 196, 153, 50))  # disabled

# ----
move_52 = Move(Geometry=brep_49, Motion=unit_z)  # -> Geometry, Transform; disabled

# ---- group: EDUCATION (continued)
custom_preview_68 = CustomPreview(Geometry=move_52.Geometry, Shader=colour_swatch_65)  # disabled

# ----
xy_plane_32 = XYPlane(Origin=Point(0, 0, 0))  # disabled
bounding_box_35 = BoundingBox(Content=move_52.Geometry, Plane=xy_plane_32)  # -> Box, Box_2; disabled

# ---- group: SHOPPING
brep_50 = Brep(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)

# ----
move_53 = Move(Geometry=brep_50, Motion=vector_xyz_3.Vector)  # -> Geometry, Transform

# ---- group: SHOPPING (continued)
custom_preview_69 = CustomPreview(Geometry=move_53.Geometry, Shader=ColourSwatch(SwatchColor=RGBA(65, 162, 166, 50)))

# ----
xy_plane_33 = XYPlane(Origin=Point(0, 0, 0))
bounding_box_36 = BoundingBox(Content=move_53.Geometry, Plane=xy_plane_33)  # -> Box, Box_2

# ---- group: SOCIAL
brep_51 = Brep(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)

# ----
move_54 = Move(Geometry=brep_51, Motion=vector_xyz_3.Vector)  # -> Geometry, Transform

# ---- group: SOCIAL (continued)
custom_preview_70 = CustomPreview(Geometry=move_54.Geometry, Shader=ColourSwatch(SwatchColor=RGBA(227, 45, 76, 50)))

# ----
xy_plane_34 = XYPlane(Origin=Point(0, 0, 0))
bounding_box_37 = BoundingBox(Content=move_54.Geometry, Plane=xy_plane_34)  # -> Box, Box_2

# ---- group: SLEEP
brep_52 = Brep(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)

# ----
move_55 = Move(Geometry=brep_52, Motion=vector_xyz_3.Vector)  # -> Geometry, Transform

# ---- group: SLEEP (continued)
custom_preview_71 = CustomPreview(Geometry=move_55.Geometry, Shader=ColourSwatch(SwatchColor=RGBA(17, 87, 87, 50)))

# ----
xy_plane_35 = XYPlane(Origin=Point(0, 0, 0))
bounding_box_38 = BoundingBox(Content=move_55.Geometry, Plane=xy_plane_35)  # -> Box, Box_2

# ---- group: HOUSE
brep_53 = Brep(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)

# ----
move_56 = Move(Geometry=brep_53, Motion=vector_xyz_3.Vector)  # -> Geometry, Transform

# ---- group: HOUSE (continued)
custom_preview_72 = CustomPreview(Geometry=move_56.Geometry, Shader=ColourSwatch(SwatchColor=RGBA(99, 66, 92, 50)))

# ----
xy_plane_36 = XYPlane(Origin=Point(0, 0, 0))
bounding_box_39 = BoundingBox(Content=move_56.Geometry, Plane=xy_plane_36)  # -> Box, Box_2

# ---- group: WORK
brep_54 = Brep(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)

# ----
move_57 = Move(Geometry=brep_54, Motion=vector_xyz_3.Vector)  # -> Geometry, Transform

# ---- group: WORK (continued)
custom_preview_73 = CustomPreview(Geometry=move_57.Geometry, Shader=ColourSwatch(SwatchColor=RGBA(222, 178, 47, 50)))

# ----
xy_plane_37 = XYPlane(Origin=Point(0, 0, 0))
bounding_box_40 = BoundingBox(Content=move_57.Geometry, Plane=xy_plane_37)  # -> Box, Box_2

# ---- group: SPORTS
brep_55 = Brep(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)

# ----
move_58 = Move(Geometry=brep_55, Motion=vector_xyz_3.Vector)  # -> Geometry, Transform

# ---- group: SPORTS (continued)
custom_preview_74 = CustomPreview(Geometry=move_58.Geometry, Shader=ColourSwatch(SwatchColor=RGBA(242, 105, 41, 50)))

# ----
xy_plane_38 = XYPlane(Origin=Point(0, 0, 0))
bounding_box_41 = BoundingBox(Content=move_58.Geometry, Plane=xy_plane_38)  # -> Box, Box_2

# ---- group: EDUCATION
brep_56 = Brep(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)

# ----
move_59 = Move(Geometry=brep_56, Motion=vector_xyz_3.Vector)  # -> Geometry, Transform

# ---- group: EDUCATION (continued)
custom_preview_75 = CustomPreview(Geometry=move_59.Geometry, Shader=ColourSwatch(SwatchColor=RGBA(191, 196, 153, 50)))

# ----
xy_plane_39 = XYPlane(Origin=Point(0, 0, 0))
bounding_box_42 = BoundingBox(Content=move_59.Geometry, Plane=xy_plane_39)  # -> Box, Box_2

vector_xyz_6 = VectorXYZ(XComponent=0, YComponent=0, ZComponent=0)  # -> Vector, Length; disabled
file_path_16 = FilePath("C:\Users\Albert Burgers\Downloads\test_168_users.csv")  # disabled
panel_164 = Panel(file_path_16)  # disabled
brep_57 = Brep(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)  # disabled
move_60 = Move(Geometry=brep_57, Motion=vector_xyz_6.Vector)  # -> Geometry, Transform; disabled
number_slider_262 = Slider(0, range=0..100)  # disabled
panel_165 = Panel("SLEEP")  # disabled
panel_166 = Panel("HOUSE ACTIVITY")  # disabled
colors_of_buildings = Merge(
    Data1=list_item_40,
    Data2=list_item_41,
    Data3=list_item_42,
    Data4=list_item_43,
    Data5=list_item_45,
    Data6=list_item_46,
    Data7=list_item_48,
    Data8=list_item_49,
    Data9=list_item_44)  # disabled
panel_167 = Panel(colors_of_buildings)  # disabled
list_length_63 = ListLength()  # disabled
volume_2 = Volume()  # -> Volume, Centroid; disabled
max_amount_of_users_9 = Panel(list_length_63)  # disabled
lenght_of_the_final_movement_vector = Slider(5, range=1..10)  # disabled
number_slider_263 = Slider(0.1, range=0..1)  # disabled

# ----
# Object schedule input
panel_168 = Panel("C:\Users\filip\Documents\Architektura\MSc1\MSc1 The Why Factory\3Dmove code\3Dmove schedules\test_168_users.csv")
file_path_17 = FilePath(panel_168)  # disabled
read_file = ReadFile(File=file_path_16, PerLineParse=True)  # disabled
panel_169 = Panel(";")  # disabled
text_split = TextSplit(Text=read_file, Separators=panel_169)  # -> simplify(Result); disabled

# ---- group: CIVIC
colour_swatch_66 = ColourSwatch(SwatchColor=RGBA(184, 108, 85, 50))  # disabled
custom_preview_76 = CustomPreview(Geometry=move_60.Geometry, Shader=colour_swatch_66)  # disabled
brep_58 = Brep(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)  # disabled

# ----
xy_plane_40 = XYPlane(Origin=Point(0, 0, 0))  # disabled
bounding_box_43 = BoundingBox(Content=move_60.Geometry, Plane=xy_plane_40)  # -> Box, Box_2; disabled

# ---- group: Count time steps
modulus_14 = Modulus(B=list_length_63)  # disabled
panel_170 = Panel(modulus_14)  # disabled

# ----
xy_plane_41 = XYPlane(Origin=Point(0, 0, 0))  # disabled
box_7 = Box({Plane=PlaneXY(-38.02261219, -21.63326362, 0), X=Domain(0, 49.51774281), Y=Domain(0, 58.10195767), Z=Domain(0, 33.72050103)})  # disabled
bounding_box_44 = BoundingBox(Content=brep_58, Plane=xy_plane_41)  # -> Box, Box_2; disabled

number_slider_264 = Slider(2, range=0..10)  # disabled
division_17 = Division(A=number_slider_220, B=number_slider_264)  # disabled
division_18 = Division(A=number_slider_219, B=number_slider_264)  # disabled
division_19 = Division(A=number_slider_218, B=number_slider_264)  # disabled
center_box_16 = CenterBox(Base=sub_list_2.List, X=division_17, Y=division_19, Z=division_18)  # disabled
list_length_64 = ListLength()  # disabled
amount_of_users_27 = Slider(1027, range=0..10000)  # disabled
panel_171 = Panel(list_length_64)  # disabled
subtraction_37 = Subtraction(A=list_length_64, B=amount_of_users_27)  # disabled
panel_172 = Panel(center_box_16)  # disabled
collision_one_many_6 = CollisionOneMany(Collider=center_box_16, Obstacles=brep_58)  # -> Collision, Index; disabled
panel_173 = Panel(subtraction_37)  # disabled
list_length_65 = ListLength(List=collision_one_many_6.Collision)  # disabled
panel_174 = Panel(collision_one_many_6.Collision)  # disabled
cull_pattern_12 = CullPattern(List=center_box_16, CullPattern=collision_one_many_6.Collision)  # disabled
panel_175 = Panel(list_length_65)  # disabled

replace_text = ReplaceText(Text=text_split, Find=panel_165, Replace=panel_166, RecursiveReplace=False)  # disabled
cull_i_removes_names_of_users = CullIndex(List=replace_text, Indices=number_slider_262, Wrap=True)  # disabled
random_reduce_35 = RandomReduce(Reduction=panel_170, Seed=1)  # disabled
volume_3 = Volume(Geometry=random_reduce_35)  # -> Volume, Centroid; disabled
custom_preview_77 = CustomPreview(Geometry=random_reduce_35, Shader=colour_swatch_48)  # disabled

# ---- group: MAX CAPACITY OBJECT
create_set = CreateSet(List=flatten(cull_i_removes_names_of_users))  # -> Set, Map; disabled
panel_176 = Panel(create_set.Set)  # disabled
explode_tree_35 = ExplodeTree(Data=simplify(graft(panel_176)))  # -> simplify(Branch0), simplify(Branch1), simplify(Branch2), simplify(Branch3), simplify(Branch4), simplify(Branch5), simplify(Branch6), simplify(Branch7), simplify(Branch8); disabled
data = Data(["OTHER", "HOUSE ACTIVITY", "WORK", "CIVIC", "SOCIALIZING", "SHOPPING", "SPORTS", "RELIGION", "EDUCATION"])  # disabled
panel_177 = Panel(data)  # disabled
panel_178 = Panel(explode_tree_35.Branch6)  # disabled
panel_179 = Panel(explode_tree_35.Branch7)  # disabled
panel_180 = Panel(explode_tree_35.Branch0)  # disabled
panel_181 = Panel(explode_tree_35.Branch1)  # disabled
panel_182 = Panel(explode_tree_35.Branch2)  # disabled
panel_183 = Panel(explode_tree_35.Branch3)  # disabled
panel_184 = Panel(explode_tree_35.Branch4)  # disabled
panel_185 = Panel(explode_tree_35.Branch5)  # disabled
other_3 = ColourSwatch(SwatchColor=RGB(105, 112, 120))  # disabled
work_2 = ColourSwatch(SwatchColor=RGB(232, 176, 44))  # disabled
civic_2 = ColourSwatch(SwatchColor=RGB(184, 108, 84))  # disabled
social_2 = ColourSwatch(SwatchColor=RGB(227, 43, 74))  # disabled
shopping_2 = ColourSwatch(SwatchColor=RGB(62, 162, 163))  # disabled
sports_2 = ColourSwatch(SwatchColor=RGB(242, 105, 41))  # disabled
religion_2 = ColourSwatch(SwatchColor=RGB(52, 51, 61))  # disabled
house_2 = ColourSwatch(SwatchColor=RGB(99, 65, 91))  # disabled
education_3 = ColourSwatch(SwatchColor=RGB(191, 196, 153))  # disabled
merge = Merge(Data1=panel_177)  # -> simplify(flatten(Result)); disabled
max_occupacy_of_buildings = Merge(
    Data1=number_slider_188,
    Data2=number_slider_189,
    Data3=number_slider_191,
    Data4=number_slider_192,
    Data5=number_slider_193,
    Data6=number_slider_194,
    Data7=number_slider_195,
    Data8=number_slider_196,
    Data9=number_slider_190)  # disabled
colors_of_buildings_2 = Merge(
    Data1=other_3,
    Data2=house_2,
    Data3=work_2,
    Data4=civic_2,
    Data5=social_2,
    Data6=shopping_2,
    Data7=sports_2,
    Data8=religion_2,
    Data9=education_3)  # disabled
ghpython_script = GhPythonScript(buildingsTYPESfullNAMES=merge)  # -> out, buildingTYPES; inputs buildingsTYPESfullNAMES: list; disabled
# ---------- ghpython_script: Python ----------
__author__ = "filip"
__version__ = "2018.12.04"

import rhinoscriptsyntax as rs

buildingTYPES = []

for i in range(len(buildingsTYPESfullNAMES)):
    buildingTYPES.append(buildingsTYPESfullNAMES[i][0:4])

def buildingtypeCHECK(buildingTYPES,locationsNAMES):
    TYPEofBUILDINGS
    for i in ranege(len(locationsNAMES)):
        for j in range(len(buildingTYPES)):
            if locationsNAMES[i][0:4] == buildingTYPES[j]:
                TYPEofBUILDINGS.append(buildingTYPES[j])
# ---------- end ghpython_script ----------

# ----
osm_data = OSMData(
    OSMPointData=location.OSMPointData,
    OSMDataText=location.OSMData,
    Feature="building",
    Generate3d=True,
    IndividualOutputs=False,
    SelectedTypes=["apartments", "bungalow", "cabin", "dormitory", "hotel", "house", "houseboat", "residential"])  # -> Ways, Buildings, FeatureKey
osm_data_2 = OSMData(
    OSMPointData=location.OSMPointData,
    OSMDataText=location.OSMData,
    Feature="building",
    Generate3d=True,
    IndividualOutputs=False,
    SelectedTypes=["barn", "bridge", "cowshed", "farm_auxilliary", "hangar", "hut", "ruins", "shed", "static_caravan"])  # -> Ways, Buildings, FeatureKey
osm_data_3 = OSMData(
    OSMPointData=location.OSMPointData,
    OSMDataText=location.OSMData,
    Feature="building",
    Generate3d=True,
    IndividualOutputs=False,
    SelectedTypes=["commercial", "construction", "cowshed", "farm", "greenhouse", "hangar", "industrial", "office", "transformer_tower", "warehouse"])  # -> Ways, Buildings, FeatureKey
osm_data_4 = OSMData(
    OSMPointData=location.OSMPointData,
    OSMDataText=location.OSMData,
    Feature="building",
    Generate3d=True,
    IndividualOutputs=False,
    SelectedTypes="yes")  # -> Ways, Buildings, FeatureKey
osm_data_5 = OSMData(
    OSMPointData=location.OSMPointData,
    OSMDataText=location.OSMData,
    Feature="building",
    Generate3d=True,
    IndividualOutputs=False,
    SelectedTypes="stadium")  # -> Ways, Buildings, FeatureKey
osm_data_6 = OSMData(
    OSMPointData=location.OSMPointData,
    OSMDataText=location.OSMData,
    Feature="building",
    Generate3d=True,
    IndividualOutputs=False,
    SelectedTypes=["civic", "garage", "garages", "hospital", "public", "service", "transportation"])  # -> Ways, Buildings, FeatureKey
osm_data_7 = OSMData(
    OSMPointData=location.OSMPointData,
    OSMDataText=location.OSMData,
    Feature="building",
    Generate3d=True,
    IndividualOutputs=False,
    SelectedTypes="retail")  # -> Ways, Buildings, FeatureKey
osm_data_8 = OSMData(
    OSMPointData=location.OSMPointData,
    OSMDataText=location.OSMData,
    Feature="building",
    Generate3d=True,
    IndividualOutputs=False,
    SelectedTypes=["cathedral", "chapel", "church", "mosque", "synagogue", "temple"])  # -> Ways, Buildings, FeatureKey
osm_data_9 = OSMData(
    OSMPointData=location.OSMPointData,
    OSMDataText=location.OSMData,
    Feature="building",
    Generate3d=True,
    IndividualOutputs=False,
    SelectedTypes=["school", "university"])  # -> Ways, Buildings, FeatureKey
brep_59 = Brep(osm_data.Buildings)
brep_60 = Brep(osm_data_4.Buildings)
brep_61 = Brep(osm_data_2.Buildings)
brep_62 = Brep(osm_data_5.Buildings)
brep_63 = Brep(osm_data_8.Buildings)
brep_64 = Brep(osm_data_9.Buildings)
brep_65 = Brep(osm_data_6.Buildings)
brep_66 = Brep(osm_data_7.Buildings)
brep_67 = Brep(osm_data_3.Buildings)
move_61 = Move(Geometry=brep_65, Motion=vector_xyz_5.Vector)  # -> Geometry, Transform
move_62 = Move(Geometry=brep_66, Motion=vector_xyz_5.Vector)  # -> Geometry, Transform
move_63 = Move(Geometry=brep_63, Motion=vector_xyz_5.Vector)  # -> Geometry, Transform
move_64 = Move(Geometry=brep_62, Motion=vector_xyz_5.Vector)  # -> Geometry, Transform
move_65 = Move(Geometry=brep_60, Motion=vector_xyz_5.Vector)  # -> Geometry, Transform
move_66 = Move(Geometry=brep_61, Motion=vector_xyz_5.Vector)  # -> Geometry, Transform
move_67 = Move(Geometry=brep_64, Motion=vector_xyz_5.Vector)  # -> Geometry, Transform
move_68 = Move(Geometry=brep_67, Motion=vector_xyz_5.Vector)  # -> Geometry, Transform
move_69 = Move(Geometry=brep_59, Motion=vector_xyz_5.Vector)  # -> Geometry, Transform
rotate_7 = Rotate(Geometry=move_64.Geometry, Angle=degrees(number_slider_187), Plane=xy_plane_23)  # -> Geometry, Transform
rotate_8 = Rotate(Geometry=move_67.Geometry, Angle=degrees(number_slider_187), Plane=xy_plane_23)  # -> Geometry, Transform
rotate_9 = Rotate(Geometry=move_62.Geometry, Angle=degrees(number_slider_187), Plane=xy_plane_23)  # -> Geometry, Transform
rotate_10 = Rotate(Geometry=move_65.Geometry, Angle=degrees(number_slider_187), Plane=xy_plane_23)  # -> Geometry, Transform
rotate_11 = Rotate(Geometry=move_61.Geometry, Angle=degrees(number_slider_187), Plane=xy_plane_23)  # -> Geometry, Transform
rotate_12 = Rotate(Geometry=move_68.Geometry, Angle=degrees(number_slider_187), Plane=xy_plane_23)  # -> Geometry, Transform
rotate_13 = Rotate(Geometry=move_63.Geometry, Angle=degrees(number_slider_187), Plane=xy_plane_23)  # -> Geometry, Transform
rotate_14 = Rotate(Geometry=move_69.Geometry, Angle=degrees(number_slider_187), Plane=xy_plane_23)  # -> Geometry, Transform
rotate_15 = Rotate(Geometry=move_66.Geometry, Angle=degrees(number_slider_187), Plane=xy_plane_23)  # -> Geometry, Transform
education_4 = ColourSwatch(SwatchColor=RGB(191, 196, 153))
education_5 = ColourSwatch(SwatchColor=RGBA(191, 196, 153, 150))
shopping_3 = ColourSwatch(SwatchColor=RGB(62, 162, 163))
social_3 = ColourSwatch(SwatchColor=RGBA(227, 43, 74, 150))
shopping_4 = ColourSwatch(SwatchColor=RGBA(62, 162, 163, 150))
social_4 = ColourSwatch(SwatchColor=RGB(227, 43, 74))
religion_3 = ColourSwatch(SwatchColor=RGB(52, 51, 61))
house_3 = ColourSwatch(SwatchColor=RGB(99, 65, 91))
religion_4 = ColourSwatch(SwatchColor=RGBA(52, 51, 61, 150))
house_4 = ColourSwatch(SwatchColor=RGBA(99, 66, 92, 150))
work_3 = ColourSwatch(SwatchColor=RGB(232, 176, 44))
work_4 = ColourSwatch(SwatchColor=RGBA(232, 176, 44, 150))
sports_3 = ColourSwatch(SwatchColor=RGB(242, 105, 41))
sports_4 = ColourSwatch(SwatchColor=RGBA(242, 105, 41, 150))
other_4 = ColourSwatch(SwatchColor=RGB(105, 112, 120))
other_5 = ColourSwatch(SwatchColor=RGBA(104, 112, 120, 150))
civic_3 = ColourSwatch(SwatchColor=RGB(184, 108, 84))
civic_4 = ColourSwatch(SwatchColor=RGBA(184, 108, 84, 150))

move_70 = Move(Geometry=rotate_13.Geometry, Motion=vec_2.Vector)  # -> Geometry, Transform
move_71 = Move(Geometry=rotate_8.Geometry, Motion=vec_2.Vector)  # -> Geometry, Transform
move_72 = Move(Geometry=rotate_7.Geometry, Motion=vec_2.Vector)  # -> Geometry, Transform
move_73 = Move(Geometry=rotate_14.Geometry, Motion=vec_2.Vector)  # -> Geometry, Transform
move_74 = Move(Geometry=rotate_9.Geometry, Motion=vec_2.Vector)  # -> Geometry, Transform
move_75 = Move(Geometry=rotate_11.Geometry, Motion=vec_2.Vector)  # -> Geometry, Transform
move_76 = Move(Geometry=rotate_10.Geometry, Motion=vec_2.Vector)  # -> Geometry, Transform
move_77 = Move(Geometry=rotate_12.Geometry, Motion=vec_2.Vector)  # -> Geometry, Transform
move_78 = Move(Geometry=rotate_15.Geometry, Motion=vec_2.Vector)  # -> Geometry, Transform
move_79 = Move(Geometry=move_70.Geometry, Motion=vec_3.Vector)  # -> Geometry, Transform
move_80 = Move(Geometry=move_71.Geometry, Motion=vec_3.Vector)  # -> Geometry, Transform
move_81 = Move(Geometry=move_72.Geometry, Motion=vec_3.Vector)  # -> Geometry, Transform
move_82 = Move(Geometry=move_73.Geometry, Motion=vec_3.Vector)  # -> Geometry, Transform
move_83 = Move(Geometry=move_74.Geometry, Motion=vec_3.Vector)  # -> Geometry, Transform
move_84 = Move(Geometry=move_75.Geometry, Motion=vec_3.Vector)  # -> Geometry, Transform
move_85 = Move(Geometry=move_76.Geometry, Motion=vec_3.Vector)  # -> Geometry, Transform
move_86 = Move(Geometry=move_77.Geometry, Motion=vec_3.Vector)  # -> Geometry, Transform
move_87 = Move(Geometry=move_78.Geometry, Motion=vec_3.Vector)  # -> Geometry, Transform

custom_preview_78 = CustomPreview(Geometry=move_82.Geometry, Material=house_4)
custom_preview_79 = CustomPreview(Geometry=move_87.Geometry, Material=other_5)
custom_preview_80 = CustomPreview(Geometry=move_81.Geometry, Material=sports_4)
custom_preview_81 = CustomPreview(Geometry=move_84.Geometry, Material=civic_4)
custom_preview_82 = CustomPreview(Geometry=move_85.Geometry, Material=social_3)
custom_preview_83 = CustomPreview(Geometry=move_83.Geometry, Material=shopping_4)
custom_preview_84 = CustomPreview(Geometry=move_79.Geometry, Material=religion_4)
custom_preview_85 = CustomPreview(Geometry=move_80.Geometry, Material=education_5)
custom_preview_86 = CustomPreview(Geometry=move_86.Geometry, Material=work_4)

osm_data_10 = OSMData(
    OSMPointData=location_2.OSMPointData,
    OSMDataText=location_2.OSMData,
    Feature="building",
    Generate3d=True,
    IndividualOutputs=False,
    SelectedTypes=["apartments", "bungalow", "cabin", "dormitory", "hotel", "house", "houseboat", "residential"])  # -> Ways, Buildings, FeatureKey
osm_data_11 = OSMData(
    OSMPointData=location_2.OSMPointData,
    OSMDataText=location_2.OSMData,
    Feature="building",
    Generate3d=True,
    IndividualOutputs=False,
    SelectedTypes=["barn", "bridge", "cowshed", "farm_auxilliary", "hangar", "hut", "ruins", "shed", "static_caravan"])  # -> Ways, Buildings, FeatureKey
osm_data_12 = OSMData(
    OSMPointData=location_2.OSMPointData,
    OSMDataText=location_2.OSMData,
    Feature="building",
    Generate3d=True,
    IndividualOutputs=False,
    SelectedTypes=["commercial", "construction", "cowshed", "farm", "greenhouse", "hangar", "industrial", "office", "transformer_tower", "warehouse"])  # -> Ways, Buildings, FeatureKey
osm_data_13 = OSMData(
    OSMPointData=location_2.OSMPointData,
    OSMDataText=location_2.OSMData,
    Feature="building",
    Generate3d=True,
    IndividualOutputs=False,
    SelectedTypes="yes")  # -> Ways, Buildings, FeatureKey
osm_data_14 = OSMData(
    OSMPointData=location_2.OSMPointData,
    OSMDataText=location_2.OSMData,
    Feature="building",
    Generate3d=True,
    IndividualOutputs=False,
    SelectedTypes="stadium")  # -> Ways, Buildings, FeatureKey
osm_data_15 = OSMData(
    OSMPointData=location_2.OSMPointData,
    OSMDataText=location_2.OSMData,
    Feature="building",
    Generate3d=True,
    IndividualOutputs=False,
    SelectedTypes=["civic", "garage", "garages", "hospital", "public", "service", "transportation"])  # -> Ways, Buildings, FeatureKey
osm_data_16 = OSMData(
    OSMPointData=location_2.OSMPointData,
    OSMDataText=location_2.OSMData,
    Feature="building",
    Generate3d=True,
    IndividualOutputs=False,
    SelectedTypes="retail")  # -> Ways, Buildings, FeatureKey
osm_data_17 = OSMData(
    OSMPointData=location_2.OSMPointData,
    OSMDataText=location_2.OSMData,
    Feature="building",
    Generate3d=True,
    IndividualOutputs=False,
    SelectedTypes=["cathedral", "chapel", "church", "mosque", "synagogue", "temple"])  # -> Ways, Buildings, FeatureKey
osm_data_18 = OSMData(
    OSMPointData=location_2.OSMPointData,
    OSMDataText=location_2.OSMData,
    Feature="building",
    Generate3d=True,
    IndividualOutputs=False,
    SelectedTypes=["school", "university"])  # -> Ways, Buildings, FeatureKey
brep_68 = Brep(osm_data_10.Buildings)
brep_69 = Brep(osm_data_13.Buildings)
brep_70 = Brep(osm_data_11.Buildings)
brep_71 = Brep(osm_data_15.Buildings)
brep_72 = Brep(osm_data_16.Buildings)
brep_73 = Brep(osm_data_14.Buildings)
brep_74 = Brep(osm_data_17.Buildings)
brep_75 = Brep(osm_data_18.Buildings)
brep_76 = Brep(osm_data_12.Buildings)
move_88 = Move(Geometry=brep_71, Motion=vector_xyz_5.Vector)  # -> Geometry, Transform
move_89 = Move(Geometry=brep_72, Motion=vector_xyz_5.Vector)  # -> Geometry, Transform
move_90 = Move(Geometry=brep_74, Motion=vector_xyz_5.Vector)  # -> Geometry, Transform
move_91 = Move(Geometry=brep_73, Motion=vector_xyz_5.Vector)  # -> Geometry, Transform
move_92 = Move(Geometry=brep_69, Motion=vector_xyz_5.Vector)  # -> Geometry, Transform
move_93 = Move(Geometry=brep_70, Motion=vector_xyz_5.Vector)  # -> Geometry, Transform
move_94 = Move(Geometry=brep_75, Motion=vector_xyz_5.Vector)  # -> Geometry, Transform
move_95 = Move(Geometry=brep_76, Motion=vector_xyz_5.Vector)  # -> Geometry, Transform
move_96 = Move(Geometry=brep_68, Motion=vector_xyz_5.Vector)  # -> Geometry, Transform
rotate_16 = Rotate(Geometry=move_91.Geometry, Angle=degrees(number_slider_187), Plane=xy_plane_23)  # -> Geometry, Transform
rotate_17 = Rotate(Geometry=move_94.Geometry, Angle=degrees(number_slider_187), Plane=xy_plane_23)  # -> Geometry, Transform
rotate_18 = Rotate(Geometry=move_89.Geometry, Angle=degrees(number_slider_187), Plane=xy_plane_23)  # -> Geometry, Transform
rotate_19 = Rotate(Geometry=move_92.Geometry, Angle=degrees(number_slider_187), Plane=xy_plane_23)  # -> Geometry, Transform
rotate_20 = Rotate(Geometry=move_88.Geometry, Angle=degrees(number_slider_187), Plane=xy_plane_23)  # -> Geometry, Transform
rotate_21 = Rotate(Geometry=move_95.Geometry, Angle=degrees(number_slider_187), Plane=xy_plane_23)  # -> Geometry, Transform
rotate_22 = Rotate(Geometry=move_90.Geometry, Angle=degrees(number_slider_187), Plane=xy_plane_23)  # -> Geometry, Transform
rotate_23 = Rotate(Geometry=move_96.Geometry, Angle=degrees(number_slider_187), Plane=xy_plane_23)  # -> Geometry, Transform
rotate_24 = Rotate(Geometry=move_93.Geometry, Angle=degrees(number_slider_187), Plane=xy_plane_23)  # -> Geometry, Transform
education_6 = ColourSwatch(SwatchColor=RGB(191, 196, 153))
education_7 = ColourSwatch(SwatchColor=RGBA(191, 196, 153, 150))
shopping_5 = ColourSwatch(SwatchColor=RGB(62, 162, 163))
shopping_6 = ColourSwatch(SwatchColor=RGBA(62, 162, 163, 150))
social_5 = ColourSwatch(SwatchColor=RGB(227, 43, 74))
religion_5 = ColourSwatch(SwatchColor=RGB(52, 51, 61))
house_5 = ColourSwatch(SwatchColor=RGB(99, 65, 91))
work_5 = ColourSwatch(SwatchColor=RGB(232, 176, 44))
social_6 = ColourSwatch(SwatchColor=RGBA(227, 43, 74, 150))
religion_6 = ColourSwatch(SwatchColor=RGBA(52, 51, 61, 150))
house_6 = ColourSwatch(SwatchColor=RGBA(99, 66, 92, 150))
work_6 = ColourSwatch(SwatchColor=RGBA(232, 176, 44, 150))
sports_5 = ColourSwatch(SwatchColor=RGB(242, 105, 41))
sports_6 = ColourSwatch(SwatchColor=RGBA(242, 105, 41, 150))
other_6 = ColourSwatch(SwatchColor=RGB(105, 112, 120))
other_7 = ColourSwatch(SwatchColor=RGBA(104, 112, 120, 150))
civic_5 = ColourSwatch(SwatchColor=RGB(184, 108, 84))
civic_6 = ColourSwatch(SwatchColor=RGBA(184, 108, 84, 150))

move_97 = Move(Geometry=rotate_23.Geometry, Motion=vec_3.Vector)  # -> Geometry, Transform
move_98 = Move(Geometry=rotate_24.Geometry, Motion=vec_3.Vector)  # -> Geometry, Transform
move_99 = Move(Geometry=rotate_21.Geometry, Motion=vec_3.Vector)  # -> Geometry, Transform
move_100 = Move(Geometry=rotate_16.Geometry, Motion=vec_3.Vector)  # -> Geometry, Transform
move_101 = Move(Geometry=rotate_22.Geometry, Motion=vec_3.Vector)  # -> Geometry, Transform
move_102 = Move(Geometry=rotate_20.Geometry, Motion=vec_3.Vector)  # -> Geometry, Transform
move_103 = Move(Geometry=rotate_17.Geometry, Motion=vec_3.Vector)  # -> Geometry, Transform
move_104 = Move(Geometry=rotate_19.Geometry, Motion=vec_3.Vector)  # -> Geometry, Transform
move_105 = Move(Geometry=rotate_18.Geometry, Motion=vec_3.Vector)  # -> Geometry, Transform

custom_preview_87 = CustomPreview(Geometry=move_97.Geometry, Material=house_6)
custom_preview_88 = CustomPreview(Geometry=move_98.Geometry, Material=other_7)
custom_preview_89 = CustomPreview(Geometry=move_100.Geometry, Material=sports_6)
custom_preview_90 = CustomPreview(Geometry=move_102.Geometry, Material=civic_6)
custom_preview_91 = CustomPreview(Geometry=move_104.Geometry, Material=social_6)
custom_preview_92 = CustomPreview(Geometry=move_105.Geometry, Material=shopping_6)
custom_preview_93 = CustomPreview(Geometry=move_101.Geometry, Material=religion_6)
custom_preview_94 = CustomPreview(Geometry=move_103.Geometry, Material=education_7)
custom_preview_95 = CustomPreview(Geometry=move_99.Geometry, Material=work_6)

osm_data_19 = OSMData(
    OSMPointData=location.OSMPointData,
    OSMDataText=location.OSMData,
    Feature="landuse",
    Generate3d=False,
    IndividualOutputs=False)  # -> Ways, FeatureKey
osm_data_20 = OSMData(
    OSMPointData=location.OSMPointData,
    OSMDataText=location.OSMData,
    Feature="route",
    Generate3d=False,
    IndividualOutputs=True,
    SelectedTypes=["light_rail", "railway", "road", "train", "tram"])  # -> Light_rail, Railway, Road, Train, Tram, FeatureKey
polyline_19 = PolyLine(Vertices=osm_data_19.Ways, Closed=False)
polyline_20 = PolyLine(Vertices=osm_data_20.Road, Closed=False)
polyline_21 = PolyLine(Vertices=osm_data_20.Railway, Closed=False)
polyline_22 = PolyLine(Vertices=osm_data_20.Light_rail, Closed=False)
geometry_10 = Geometry([polyline_22, polyline_21, polyline_20, polyline_19])
move_106 = Move(Geometry=geometry_10, Motion=vector_xyz_5.Vector)  # -> Geometry, Transform
rotate_25 = Rotate(Geometry=move_106.Geometry, Angle=degrees(number_slider_187), Plane=xy_plane_23)  # -> Geometry, Transform
infra = ColourSwatch(SwatchColor=RGB(150, 150, 150))

move_107 = Move(Geometry=rotate_25.Geometry, Motion=vec_2.Vector)  # -> Geometry, Transform
move_108 = Move(Geometry=move_107.Geometry, Motion=vec_3.Vector)  # -> Geometry, Transform

custom_preview_96 = CustomPreview(Geometry=move_108.Geometry, Material=infra)

osm_data_21 = OSMData(
    OSMPointData=location_2.OSMPointData,
    OSMDataText=location_2.OSMData,
    Feature="landuse",
    Generate3d=False,
    IndividualOutputs=False)  # -> Ways, FeatureKey
osm_data_22 = OSMData(
    OSMPointData=location_2.OSMPointData,
    OSMDataText=location_2.OSMData,
    Feature="route",
    Generate3d=False,
    IndividualOutputs=True,
    SelectedTypes=["light_rail", "railway", "road", "train", "tram"])  # -> Light_rail, Railway, Road, Train, Tram, FeatureKey
polyline_23 = PolyLine(Vertices=osm_data_21.Ways, Closed=False)
polyline_24 = PolyLine(Vertices=osm_data_22.Road, Closed=False)
polyline_25 = PolyLine(Vertices=osm_data_22.Railway, Closed=False)
polyline_26 = PolyLine(Vertices=osm_data_22.Light_rail, Closed=False)
geometry_11 = Geometry([polyline_26, polyline_25, polyline_24, polyline_23])
move_109 = Move(Geometry=geometry_11, Motion=vector_xyz_5.Vector)  # -> Geometry, Transform
rotate_26 = Rotate(Geometry=move_109.Geometry, Angle=degrees(number_slider_187), Plane=xy_plane_23)  # -> Geometry, Transform
infra_2 = ColourSwatch(SwatchColor=RGB(150, 150, 150))

move_110 = Move(Geometry=rotate_26.Geometry, Motion=vec_3.Vector)  # -> Geometry, Transform

custom_preview_97 = CustomPreview(Geometry=move_110.Geometry, Material=infra_2)

panel_186 = Panel(data)  # disabled
ghpython_script_2 = GhPythonScript(
    locationsLIST=cull_i_removes_names_of_users,
    builidingsNAMES=ghpython_script.buildingTYPES,
    MAXoccupancy=max_occupacy_of_buildings)  # -> out, locationsLIST; inputs locationsLIST: tree, builidingsNAMES: list, MAXoccupancy: list of Int32; disabled
# ---------- ghpython_script_2: Python ----------
__author__ = "filip"
__version__ = "2018.12.01"

import rhinoscriptsyntax as rs

colors=[]
print(locationsLIST.BranchCount)

for u in range(locationsLIST.BranchCount):
    for i in range(len(locationsLIST.Branch(u))):
        location = locationsLIST.Branch(u)[i]
        location = location[0:4]
        for n in range(len(builidingsNAMES)):
            if location == builidingsNAMES[n]:
                number = int(u/MAXoccupancy[n])
        location = str(location)+str(number)
        locationsLIST.Branch(u)[i] = location
# ---------- end ghpython_script_2 ----------
list_length_66 = ListLength(List=ghpython_script_2.locationsLIST)  # disabled
panel_187 = Panel(list_length_66)  # disabled
text = Text(ghpython_script_2.locationsLIST)  # disabled

# ---- group: Building list
create_set_2 = CreateSet(List=flatten(text))  # -> Set, Map; disabled
panel_188 = Panel(create_set_2.Set)  # disabled

# ---- group: Amount of users from Data sheet
number_slider_265 = Slider(0, range=0..1)  # disabled
flip_matrix_2 = FlipMatrix(Data=simplify(text))  # disabled
tree_branch_2 = TreeBranch(Tree=flip_matrix_2, Path=number_slider_265, MaintainPaths=True)  # disabled
list_length_67 = ListLength(List=tree_branch_2)  # disabled
populate_3d = Populate3D(Region=domain_box, Count=list_length_67, Seed=1)  # -> flatten(Population); disabled

# ----
list_length_68 = ListLength(List=panel_188)  # disabled
series = Series(Start=0, Step=1, Count=list_length_68)  # disabled
populate_3d_2 = Populate3D(Region=domain_box, Count=1, Seed=series)  # -> simplify(flatten(Population)); disabled

number_slider_266 = Slider(0, range=0..100)  # disabled
number_slider_267 = Slider(15, range=0..50)  # disabled
number_slider_268 = Slider(2, range=0..96)  # disabled
retrodicted_steps = Slider(0, range=-3..0)  # disabled
squeezing_power = Slider(-4, range=-4..-1, expression="-x*2")  # disabled
predicted_steps = Slider(2, range=0..10)  # disabled
number_slider_269 = Slider(25, range=5..100)  # disabled
vector_creator_for_objects = GhPythonScript(
    simulationLENGHT=number_slider_268,
    ITERATIONSperTIMEframe=number_slider_267,
    startingTIMEframeNUMBER=number_slider_266,
    SCHEDULES=text,
    retrodiction=retrodicted_steps,
    prediction=predicted_steps,
    buildingsLIST=panel_188,
    buildingLOCATIONS=populate_3d_2,
    haloSIZE=number_slider_269,
    squeezingPOWER=squeezing_power,
    movementSPEED=lenght_of_the_final_movement_vector,
    boxSIZE=deconstruct_domain.End)  # -> out, BUILDINGS_LOCATIONS_fromPYTHON, buildingLOCATIONS; inputs simulationLENGHT: Int32, ITERATIONSperTIMEframe: Int32, startingTIMEframeNUMBER: Int32, SCHEDULES: tree, retrodiction: Int32, prediction: Int32, buildingsLIST: list, buildingLOCATIONS: list of Point3d, squeezingPOWER: Int32; disabled
# ---------- vector_creator_for_objects: Python ----------
__author__ = "filip"
__version__ = "2018.11.30"

import rhinoscriptsyntax as rs
import ghpythonlib as gpl


bL = buildingsLIST

haloSIZE
bC = len(bL)
bC2 = bC**2
Vzero = rs.CreateVector(0,0,0)

hbS = boxSIZE/2 # half of box size

BUILDINGS_LOCATIONS_fromPYTHON=[]


def Squeezer(coordinate):
    positioninthebox = (coordinate-hbS)/hbS
    squeezerVECTORcoordinate = -(positioninthebox*positioninthebox**squeezingPOWER)
    return squeezerVECTORcoordinate

steps = abs(retrodiction) + 1 + prediction
frameRANGE = []
for schedualFRAME in range(simulationLENGHT):
    t = startingTIMEframeNUMBER +schedualFRAME
    uS = []
    for user in range(SCHEDULES.BranchCount):
        uS.append([])
        for frameSTEP in range(steps):
            time = max(retrodiction+frameSTEP+t,0)
            uS[user].append(SCHEDULES.Branch(user)[time])

    ######################## FLOWS between all OBJECTS ########################
    
    objectsFLOWS=[]
    
    for i in range(bC2):
        objectsFLOWS.append(0)
    
    for u in range(len(uS)):
        for locatin in range(len(uS[u])-1):
            if uS[u][locatin] != uS[u][locatin+1]:
                for B1 in range(bC):
                    for B2 in range(bC):
                        if uS[u][locatin] == bL[B1] and  uS[u][locatin+1] == bL[B2]:
                            objectsFLOWS[B1*bC+B2]=objectsFLOWS[B1*bC+B2]+1
                            objectsFLOWS[B2*bC+B1]=objectsFLOWS[B2*bC+B1]+1
    
    maxflow=max(objectsFLOWS)
    
    #####################################################################
    ############################ ITERATIONS #############################
    #####################################################################

    for iteration in range(ITERATIONSperTIMEframe):
        
        print("time frame: "+str(t)+"    |    iteration: "+str(iteration))
        
        BUILDINGS_LOCATIONS_fromPYTHON.append([])
        
        objectsVECTORS=[]
        objectsDISTANCES=[]
        objectsUNITS=[]
        antyproxmityVECTORS=[]
        squeezingVECTORS = []
        objectMOVEMNT=[]

        ######################## VECTORS and DISTANCES between all OBJECTS ########################
        
        for i in range(bC):
            B1 = buildingLOCATIONS[i]
            for j in range(bC):
                v = rs.VectorCreate(buildingLOCATIONS[j],B1)
                if v == Vzero:
                    d = 0
                    uv = Vzero
                    sp = Vzero
                else:
                    d = rs.VectorLength(v)
                    uv = v/d
                    sp = -uv*haloSIZE**2/d**2
        
                objectsUNITS.append(uv)
                antyproxmityVECTORS.append(sp)
            squeezingVECTORS.append(rs.CreateVector(Squeezer(B1[0]),Squeezer(B1[1]),Squeezer(B1[2])))
        
        
        ######################## MOVEMNET of OBJECTS according to FLOWS ########################
        
        flowVECTORS=[]
        if maxflow == 0:
            for i in range(bC2):
                flowVECTORS.append(Vzero)
        else:
            for i in range(bC2):
                flowVECTORS.append(objectsUNITS[i]*objectsFLOWS[i]/maxflow)
        
        
        ######################## MOVEMNET of OBJECTS according to DISTANCES ########################
        for i in range(bC):
            objectMOVEMNT.append(Vzero)
            objectMOVEMNT[i]=rs.VectorAdd(objectMOVEMNT[i],squeezingVECTORS[i])
            for j in range(bC):
                objectMOVEMNT[i]=rs.VectorAdd(objectMOVEMNT[i],flowVECTORS[i*bC+j])
                objectMOVEMNT[i]=rs.VectorAdd(objectMOVEMNT[i],antyproxmityVECTORS[i*bC+j])
            buildingLOCATIONS[i] = rs.VectorAdd(buildingLOCATIONS[i],objectMOVEMNT[i]*movementSPEED)
            BUILDINGS_LOCATIONS_fromPYTHON[schedualFRAME*ITERATIONSperTIMEframe+iteration].append(buildingLOCATIONS[i])
# ---------- end vector_creator_for_objects ----------

ghpython_script_3 = GhPythonScript(
    MAXoccupancy=max_occupacy_of_buildings,
    buildngCOLORS=colors_of_buildings_2,
    locationsLIST=panel_188,
    builidingsNAMES=ghpython_script.buildingTYPES,
    x=colors_of_buildings)  # -> out, colors, sizes; inputs MAXoccupancy: list, buildngCOLORS: list of Color, locationsLIST: list, builidingsNAMES: list; disabled
# ---------- ghpython_script_3: Python ----------
__author__ = "filip"
__version__ = "2018.12.01"

import rhinoscriptsyntax as rs

colors=[]
sizes=[]



for i in range(len(locationsLIST)):
    location = locationsLIST[i]
    print(location[0:4])
    for n in range(len(builidingsNAMES)):
        if location[0:4] == builidingsNAMES[n]:
            colors.append(buildngCOLORS[n])
            sizes.append(int(MAXoccupancy[n]))
# ---------- end ghpython_script_3 ----------
multiplication_20 = Multiplication(A=number_slider_268, B=number_slider_267)  # disabled
number_of_iterartions = Panel(multiplication_20)  # disabled
create_material = CreateMaterial(
    Diffuse=ghpython_script_3.colors,
    Specular=RGB(255, 255, 255),
    Emission=ghpython_script_3.colors,
    Transparency=0,
    Shine=0)  # disabled
panel_189 = Panel(ghpython_script_3.sizes)  # disabled
multiplication_21 = Multiplication(A=ghpython_script_3.sizes, B=number_slider_263)  # disabled
panel_191 = Panel(ghpython_script_3.colors)  # disabled

# ---- group: AMOUNT OF USERS
integer_8 = Integer(multiplication_21)  # disabled

# ----
boolean_toggle_23 = BooleanToggle(True)  # disabled
timer_11 = Timer(TimerInterval=30)  # disabled
list_length_69 = ListLength(List=vector_creator_for_objects.BUILDINGS_LOCATIONS_fromPYTHON)  # disabled
modulus_15 = Modulus(B=list_length_69)  # disabled
panel_192 = Panel(modulus_15)  # disabled
ghpython_script_4 = GhPythonScript(t=modulus_15, x=vector_creator_for_objects.BUILDINGS_LOCATIONS_fromPYTHON)  # -> out, postions; inputs t: Int32, x: list; disabled
# ---------- ghpython_script_4: Python ----------
__author__ = "filip"
__version__ = "2018.12.07"

import rhinoscriptsyntax as rs

y=x[t]
postions = y
print(y)
# ---------- end ghpython_script_4 ----------
sphere_8 = Sphere(Base=ghpython_script_4.postions, Radius=integer_8)  # disabled
custom_preview_98 = CustomPreview(Geometry=graft(sphere_8), Material=graft(create_material))  # disabled

colour_swatch_67 = ColourSwatch(SwatchColor=RGBA(255, 0, 0, 50))  # disabled
cpl = ComparePointLists(point_list_1=volume_3.Centroid, point_list_2=volume_2.Centroid)  # -> points_in_common, points_not_in_commom; disabled
colour_swatch_68 = ColourSwatch(SwatchColor=RGB(255, 0, 0))  # disabled

center_box_17 = CenterBox(Base=cpl.points_not_in_commom, X=division_8, Y=division_10, Z=division_9)  # disabled
center_box_18 = CenterBox(Base=cpl.points_in_common, X=division_11, Y=division_13, Z=division_12)  # disabled
panel_193 = Panel(list_length_69)  # disabled
center_box_19 = CenterBox(Base=PlaneXY(0, 0, 0), X=integer_8, Y=integer_8, Z=integer_8)  # disabled
panel_194 = Panel(ghpython_script_4.postions)  # disabled
bounding_box_45 = BoundingBox(Content=sphere_8, Plane=PlaneXY(0, 0, 0))  # -> Box, Box_2; disabled

custom_preview_99 = CustomPreview(Geometry=center_box_18, Shader=colour_swatch_67)  # disabled
custom_preview_100 = CustomPreview(Geometry=center_box_17, Shader=colour_swatch_68)  # disabled

initial_geometry_2 = ClusterInput()  # disabled
boolean_toggle_24 = BooleanToggle(True)  # disabled
number_slider_270 = Slider(10, range=0..10)  # disabled
number_slider_271 = Slider(5, range=0..10)  # disabled
number_slider_272 = Slider(7, range=0..10)  # disabled
waspsetup = Wasp_Setup(RUN=boolean_toggle_24)  # -> log; inputs RUN: Boolean; disabled; plug-in component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
center_box_20 = CenterBox(Base=PlaneXY(0, 0, 0), X=number_slider_270, Y=number_slider_271, Z=number_slider_272)  # disabled
deconstruct_brep = DeconstructBrep(Brep=center_box_20)  # -> Faces, Edges, Vertices; disabled
list_item_52 = ListItem(List=deconstruct_brep.Faces, Index=0, Wrap=True)  # -> Item, Item1, Item2, Item3, Item4, Item5; disabled
panel_195 = Panel(waspsetup)  # disabled
area = Area(Geometry=list_item_52.Item)  # -> Area, Centroid; disabled
area_2 = Area(Geometry=list_item_52.Item1)  # -> Area, Centroid; disabled
area_3 = Area(Geometry=list_item_52.Item5)  # -> Area, Centroid; disabled
deconstruct_brep_2 = DeconstructBrep(Brep=list_item_52.Item)  # -> Faces, Edges, Vertices; disabled
deconstruct_brep_3 = DeconstructBrep(Brep=list_item_52.Item1)  # -> Faces, Edges, Vertices; disabled
deconstruct_brep_4 = DeconstructBrep(Brep=list_item_52.Item5)  # -> Faces, Edges, Vertices; disabled
list_item_53 = ListItem(List=deconstruct_brep_2.Edges, Index=0, Wrap=True)  # disabled
list_item_54 = ListItem(List=deconstruct_brep_3.Edges, Index=0, Wrap=True)  # disabled
list_item_55 = ListItem(List=deconstruct_brep_4.Edges, Index=1, Wrap=True)  # disabled
point_on_curve = PointOnCurve(list_item_53, parameter=0.5)  # disabled
point_on_curve_2 = PointOnCurve(list_item_54, parameter=0.5)  # disabled
point_on_curve_3 = PointOnCurve(list_item_55, parameter=0.5)  # disabled
line = Line(StartPoint=area.Centroid, EndPoint=point_on_curve)  # disabled
line_2 = Line(StartPoint=area_2.Centroid, EndPoint=point_on_curve_2)  # disabled
line_3 = Line(StartPoint=area_3.Centroid, EndPoint=point_on_curve_3)  # disabled
merge_2 = Merge(Data1=area.Centroid, Data2=area_2.Centroid, Data3=area_3.Centroid)  # disabled
merge_3 = Merge(Data1=line, Data2=line_2, Data3=line_3)  # disabled
conndir = Wasp_ConnectionFromDirection(GEO=center_box_20, CEN=merge_2, UP=merge_3)  # -> CONN, PLN_OUT; inputs GEO: Brep, CEN: list of Point3d, UP: list of Curve; disabled; plug-in component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
part_name = Panel("BOX")  # disabled
part = Wasp_BasicPart(NAME=part_name, GEO=center_box_20, CONN=flatten(conndir.CONN))  # -> PART; inputs GEO: Mesh, CONN: list, COLL: Mesh, ATTR: list; disabled; plug-in component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
parts_num = Slider(310, range=0..1000)  # disabled
check_collisions = BooleanToggle(True)  # disabled
reset = Button()  # disabled
colour_swatch_69 = ColourSwatch(SwatchColor=RGB(119, 255, 0))  # disabled

# ---- group: rules
number_slider_273 = Slider(0, range=0..10)  # disabled
number_slider_274 = Slider(2, range=0..10)  # disabled
number_slider_275 = Slider(1, range=0..10)  # disabled
number_slider_276 = Slider(1, range=0..10)  # disabled
number_slider_277 = Slider(1, range=0..10)  # disabled
number_slider_278 = Slider(0, range=0..10)  # disabled
rule = Wasp_Rule(P1=part_name, C1=number_slider_273, P2=part_name, C2=number_slider_275)  # -> R; inputs C1: Int32, C2: Int32; disabled; plug-in component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
rule_2 = Wasp_Rule(P1=part_name, C1=number_slider_274, P2=part_name, C2=number_slider_277)  # -> R; inputs C1: Int32, C2: Int32; disabled; plug-in component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
rule_3 = Wasp_Rule(P1=part_name, C1=number_slider_276, P2=part_name, C2=number_slider_278)  # -> R; inputs C1: Int32, C2: Int32; disabled; plug-in component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
merge_4 = Merge(Data1=rule, Data2=rule_3, Data3=rule_2)  # disabled

# ----
rndaggr = Wasp_StochasticAggregation(PART=flatten(part), N=parts_num, RULES=merge_4, COLL=check_collisions, RESET=reset)  # -> PART_OUT; inputs PART: list, PREV: list, N: Int32, RULES: list, COLL: Boolean, RESET: Boolean; disabled; plug-in component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
depart = Wasp_DeconstructPart(PART=rndaggr)  # -> NAME, GEO, CONN, CONN_PLN, TR, CHILD, ATTR; inputs PART: list; disabled; plug-in component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
custom_preview_101 = CustomPreview(Geometry=depart.GEO, Shader=colour_swatch_69)  # disabled

list_length_70 = ListLength(List=flatten_tree)  # disabled
sort_text = SortText(Keys=flatten_tree, Culture=127)  # -> Keys, Values; disabled
panel_196 = Panel()  # disabled
panel_197 = Panel(sort_text.Keys)  # disabled
colour_swatch_70 = ColourSwatch(SwatchColor=RGB(100, 64, 90))  # disabled
colour_swatch_71 = ColourSwatch(SwatchColor=RGB(226, 48, 76))  # disabled
colour_swatch_72 = ColourSwatch(SwatchColor=RGB(232, 177, 48))  # disabled
panel_198 = Panel()  # disabled
number_slider_279 = Slider(1, range=0..1)  # disabled
number_slider_280 = Slider(1, range=0..1)  # disabled
number_slider_281 = Slider(1, range=0..1)  # disabled
point_5 = Point(<point referenced from the Rhino model>)  # disabled
point_6 = Point(Point(-51.80109557, -31.80562272, 0))  # disabled
point_7 = Point(<point referenced from the Rhino model>)  # disabled

create_set_3 = CreateSet(List=panel_197)  # -> Set, Map; disabled
create_set_4 = CreateSet(List=create_set_3.Map)  # -> Set, Map; disabled
member_index = MemberIndex(Set=create_set_3.Map, Member=create_set_4.Set)  # -> Index, Count; disabled
panel_199 = Panel(member_index.Count)  # disabled

initial_geometry_3 = ClusterInput()  # disabled
number_slider_282 = Slider(2, range=1..5)  # disabled
boolean_toggle_25 = BooleanToggle(True)  # disabled
file_path_18 = FilePath("C:\Users\Albert Burgers\Desktop\Excel FILE.xlsx")  # disabled
standard_height_2 = Slider(3, range=0..10)  # disabled
number_slider_283 = Slider(1, range=0..10)  # disabled
number_slider_284 = Slider(4, range=0..10)  # disabled
list_item_56 = ListItem(Index=number_slider_283, Wrap=True)  # disabled
square_root_3 = SquareRoot(Value=list_item_56)  # disabled
center_box_21 = CenterBox(Base=point_5, X=square_root_3, Y=square_root_3, Z=standard_height_2)  # disabled
panel_200 = Panel(square_root_3)  # disabled

initial_geometry_4 = ClusterInput()  # disabled
number_slider_285 = Slider(2, range=1..5)  # disabled
boolean_toggle_26 = BooleanToggle(True)  # disabled
file_path_19 = FilePath("C:\Users\Albert Burgers\Desktop\Excel FILE.xlsx")  # disabled
standard_height_3 = Slider(3, range=0..10)  # disabled
number_slider_286 = Slider(1, range=0..10)  # disabled
number_slider_287 = Slider(4, range=0..10)  # disabled
list_item_57 = ListItem(Index=number_slider_286, Wrap=True)  # disabled
square_root_4 = SquareRoot(Value=list_item_57)  # disabled
center_box_22 = CenterBox(Base=point_6, X=square_root_4, Y=square_root_4, Z=standard_height_3)  # disabled
panel_201 = Panel(square_root_4)  # disabled

initial_geometry_5 = ClusterInput()  # disabled
number_slider_288 = Slider(2, range=1..5)  # disabled
boolean_toggle_27 = BooleanToggle(True)  # disabled
file_path_20 = FilePath("C:\Users\Albert Burgers\Desktop\Excel FILE.xlsx")  # disabled
standard_height_4 = Slider(3, range=0..10)  # disabled
number_slider_289 = Slider(1, range=0..10)  # disabled
number_slider_290 = Slider(4, range=0..10)  # disabled
list_item_58 = ListItem(Index=number_slider_289, Wrap=True)  # disabled
square_root_5 = SquareRoot(Value=list_item_58)  # disabled
center_box_23 = CenterBox(Base=point_7, X=square_root_5, Y=square_root_5, Z=standard_height_4)  # disabled
panel_202 = Panel(square_root_5)  # disabled

panel_203 = Panel(create_set_3.Map)  # disabled
panel_204 = Panel(create_set_4.Set)  # disabled
partition_list = PartitionList(List=panel_197, Size=panel_199)  # disabled
panel_205 = Panel(partition_list)  # disabled
ghpython_script_5 = GhPythonScript(x=partition_list)  # -> out, flatten(Home), flatten(Leisure), flatten(Work); disabled
# ---------- ghpython_script_5: Python ----------
__author__ = "Tekenplus"
__version__ = "2018.11.20"

import rhinoscriptsyntax as rs
from collections import Counter

List = [x]

Home= List.count("Home")

Leisure= List.count("Leisure")

Work= List.count("Work")
# ---------- end ghpython_script_5 ----------

number_slider_291 = Slider(1, range=0..1)  # disabled
equality = Equality(FirstNumber=ghpython_script_5.Work, SecondNumber=number_slider_291)  # -> Equality, Inequality; disabled
dispatch = Dispatch(List=ghpython_script_5.Work, DispatchPattern=equality.Equality)  # -> ListA, ListB; disabled
list_length_71 = ListLength(List=dispatch.ListA)  # disabled
panel_206 = Panel(list_length_71)  # disabled

number_slider_292 = Slider(1, range=0..1)  # disabled
equality_2 = Equality(FirstNumber=ghpython_script_5.Leisure, SecondNumber=number_slider_292)  # -> Equality, Inequality; disabled
dispatch_2 = Dispatch(List=ghpython_script_5.Leisure, DispatchPattern=equality_2.Equality)  # -> ListA, ListB; disabled
list_length_72 = ListLength(List=dispatch_2.ListA)  # disabled
panel_207 = Panel(list_length_72)  # disabled

number_slider_293 = Slider(1, range=0..1)  # disabled
equality_3 = Equality(FirstNumber=ghpython_script_5.Home, SecondNumber=number_slider_293)  # -> Equality, Inequality; disabled
dispatch_3 = Dispatch(List=ghpython_script_5.Home, DispatchPattern=equality_3.Equality)  # -> ListA, ListB; disabled
list_length_73 = ListLength(List=dispatch_3.ListA)  # disabled
panel_208 = Panel(list_length_73)  # disabled

number_slider_294 = Slider(0, range=0..100)  # disabled

number_slider_295 = Slider(12, range=0..12)  # disabled
number_slider_296 = Slider(10000, range=0..10000)  # disabled
flatten_tree_2 = FlattenTree(Path="{0}")  # disabled

# ---- group: Create User-points
populate_3d_3 = Populate3D(Region=domain_box_2, Count=number_slider_295, Seed=1)  # disabled

# ----
number_slider_297 = Slider(0, range=0..100)  # disabled

subtraction_38 = Subtraction(A=list_length_73, B=number_slider_279)  # disabled
subtraction_39 = Subtraction(A=list_length_72, B=number_slider_280)  # disabled
subtraction_40 = Subtraction(A=list_length_71, B=number_slider_281)  # disabled
panel_209 = Panel(subtraction_38)  # disabled
panel_210 = Panel(subtraction_39)  # disabled
panel_211 = Panel(subtraction_40)  # disabled

panel_212 = Panel(subtraction_38)  # disabled
ghpython_script_6 = GhPythonScript(x=panel_212)  # -> out, a; inputs x: Int32; disabled
# ---------- ghpython_script_6: Python ----------
__author__ = "Tekenplus"
__version__ = "2018.11.21"

import rhinoscriptsyntax as rs

if x == -1:
    
    
    a = "null"
    
else:
    
    a = x
# ---------- end ghpython_script_6 ----------
construct_domain_11 = ConstructDomain(DomainStart=number_slider_294, DomainEnd=ghpython_script_6.a)  # disabled
sub_list_3 = SubList(List=panel_196, Domain=construct_domain_11, Wrap=True)  # -> List, Index; disabled
panel_213 = Panel(construct_domain_11)  # disabled
panel_214 = Panel(sub_list_3.List)  # disabled

panel_215 = Panel(subtraction_39)  # disabled
ghpython_script_7 = GhPythonScript(x=ghpython_script_6.a)  # -> out, a; disabled
# ---------- ghpython_script_7: Python ----------
__author__ = "Tekenplus"
__version__ = "2018.11.21"

import rhinoscriptsyntax as rs

if x == "null":
    
    
    a = 0
    
else:
    
    a = x+1
# ---------- end ghpython_script_7 ----------
ghpython_script_8 = GhPythonScript(x=panel_215, y=ghpython_script_7.a)  # -> out, a; inputs x: Int32; disabled
# ---------- ghpython_script_8: Python ----------
__author__ = "Tekenplus"
__version__ = "2018.11.21"

import rhinoscriptsyntax as rs

if x == -1:
    
    
    a = "null"
    
else:
    
    a = x+y
# ---------- end ghpython_script_8 ----------
construct_domain_12 = ConstructDomain(DomainStart=ghpython_script_7.a, DomainEnd=ghpython_script_8.a)  # disabled
panel_216 = Panel(construct_domain_12)  # disabled
sub_list_4 = SubList(List=panel_196, Domain=construct_domain_12, Wrap=True)  # -> List, Index; disabled
panel_217 = Panel(sub_list_4.List)  # disabled

panel_218 = Panel(subtraction_40)  # disabled
ghpython_script_9 = GhPythonScript(x=ghpython_script_8.a)  # -> out, a; disabled; same code as ghpython_script_7
ghpython_script_10 = GhPythonScript(x=panel_218, y=ghpython_script_9.a)  # -> out, a; inputs x: Int32; disabled; same code as ghpython_script_8
construct_domain_13 = ConstructDomain(DomainStart=ghpython_script_9.a, DomainEnd=ghpython_script_10.a)  # disabled
panel_219 = Panel(construct_domain_13)  # disabled
sub_list_5 = SubList(List=panel_196, Domain=construct_domain_13, Wrap=True)  # -> List, Index; disabled
panel_220 = Panel(sub_list_5.List)  # disabled

custom_preview_102 = CustomPreview(Geometry=panel_214, Material=colour_swatch_70)  # disabled
custom_preview_103 = CustomPreview(Geometry=panel_217, Material=colour_swatch_71)  # disabled
custom_preview_104 = CustomPreview(Geometry=panel_220, Material=colour_swatch_72)  # disabled

panel_221 = Panel(subtraction_38)  # disabled
ghpython_script_11 = GhPythonScript(x=panel_221)  # -> out, a; inputs x: Int32; disabled; same code as ghpython_script_6
construct_domain_14 = ConstructDomain(DomainStart=number_slider_297, DomainEnd=ghpython_script_11.a)  # disabled
sub_list_6 = SubList(List=panel_198, Domain=construct_domain_14, Wrap=True)  # -> List, Index; disabled
panel_222 = Panel(construct_domain_14)  # disabled
panel_223 = Panel(sub_list_6.List)  # disabled

panel_224 = Panel(panel_210)  # disabled
ghpython_script_12 = GhPythonScript(x=ghpython_script_11.a)  # -> out, a; disabled; same code as ghpython_script_7
ghpython_script_13 = GhPythonScript(x=panel_224, y=ghpython_script_12.a)  # -> out, a; inputs x: Int32; disabled; same code as ghpython_script_8
construct_domain_15 = ConstructDomain(DomainStart=ghpython_script_12.a, DomainEnd=ghpython_script_13.a)  # disabled
panel_225 = Panel(construct_domain_15)  # disabled
sub_list_7 = SubList(List=panel_198, Domain=construct_domain_15, Wrap=True)  # -> List, Index; disabled
panel_226 = Panel(sub_list_7.List)  # disabled

panel_227 = Panel(subtraction_40)  # disabled
ghpython_script_14 = GhPythonScript(x=ghpython_script_13.a)  # -> out, a; disabled; same code as ghpython_script_7
ghpython_script_15 = GhPythonScript(x=panel_227, y=ghpython_script_14.a)  # -> out, a; inputs x: Int32; disabled; same code as ghpython_script_8
construct_domain_16 = ConstructDomain(DomainStart=ghpython_script_14.a, DomainEnd=ghpython_script_15.a)  # disabled
panel_228 = Panel(construct_domain_16)  # disabled
sub_list_8 = SubList(List=panel_198, Domain=construct_domain_16, Wrap=True)  # -> List, Index; disabled
panel_229 = Panel(sub_list_8.List)  # disabled

panel_230 = Panel(panel_214)  # disabled
panel_231 = Panel(panel_223)  # disabled
panel_232 = Panel(panel_217)  # disabled
panel_233 = Panel(panel_226)  # disabled
panel_234 = Panel(panel_220)  # disabled
panel_235 = Panel(panel_229)  # disabled
move_111 = Move(Geometry=panel_232, Motion=Vector(0, 0, 10))  # -> Geometry, Transform; disabled
move_112 = Move(Geometry=panel_234, Motion=Vector(0, 0, 10))  # -> Geometry, Transform; disabled
move_113 = Move(Geometry=panel_230, Motion=Vector(0, 0, 10))  # -> Geometry, Transform; disabled
flatten_tree_3 = FlattenTree(Tree=[move_111.Geometry, move_113.Geometry, move_112.Geometry], Path="{0}")  # disabled

number_slider_298 = Slider(0.587, range=0..1)  # disabled
multiplication_22 = Multiplication(A=panel_233, B=number_slider_298)  # disabled
addition_2 = Addition(A=multiplication_22, B=multiplication_11, C=multiplication_14)  # disabled

number_slider_299 = Slider(0.587, range=0..1)  # disabled
multiplication_23 = Multiplication(A=panel_235, B=number_slider_299)  # disabled
addition_3 = Addition(A=multiplication_23, B=multiplication_12, C=multiplication_15)  # disabled

number_slider_300 = Slider(0.582, range=0..1)  # disabled
multiplication_24 = Multiplication(A=panel_231, B=number_slider_300)  # disabled
addition_4 = Addition(A=multiplication_24, B=multiplication_13, C=multiplication_16)  # disabled

rep = ReplaceText(Text=split, Find="SLEEP", Replace="HOUSE ACTIVITY", RecursiveReplace=False)
tree_multiplicator = GhPythonScript(tree=rep, duplicates=Slider(0, range=0..10))  # -> out, tree; inputs tree: tree, duplicates: Int32
# ---------- tree_multiplicator: Python ----------
__author__ = "filip"
__version__ = "2018.12.12"

import rhinoscriptsyntax as rs
import clr
clr.AddReference("Grasshopper")
from Grasshopper.Kernel.Data import GH_Path
from Grasshopper import DataTree

BC=tree.BranchCount
for i in range(duplicates):
    for j in range(BC):
        path = GH_Path(j+BC*(i+1))
        tree.AddRange(tree.Branch(j),path)
# ---------- end tree_multiplicator ----------
cull_i_removes_names_of_users_2 = CullIndex(List=tree_multiplicator.tree, Indices=Slider(0, range=0..100), Wrap=True)
number_slider_301 = Slider(250, range=0..1000)
center_box_24 = CenterBox(Base="0,0,250", X=number_slider_301, Y=number_slider_301, Z=number_slider_301)
panel_236 = Panel(center_box_24)

cset = CreateSet(List=flatten(cull_i_removes_names_of_users_2))  # -> Set, Map
panel_237 = Panel(cset.Set)
bang = ExplodeTree(Data=simplify(graft(panel_237)))  # -> simplify(Branch0), simplify(Branch1), simplify(Branch2), simplify(Branch3), simplify(Branch4), simplify(Branch5), simplify(Branch6), simplify(Branch7), simplify(Branch8)
data_2 = Data(["OTHER", "HOUSE ACTIVITY", "WORK", "CIVIC", "SOCIALIZING", "SHOPPING", "SPORTS", "RELIGION", "EDUCATION"])
panel_238 = Panel(bang.Branch0)
panel_239 = Panel(bang.Branch1)
panel_240 = Panel(bang.Branch2)
panel_241 = Panel(bang.Branch3)
panel_242 = Panel(bang.Branch4)
panel_243 = Panel(bang.Branch5)
panel_244 = Panel(bang.Branch6)
panel_245 = Panel(bang.Branch7)
panel_246 = Panel(data_2)
merge_5 = Merge(Data1=panel_246)  # -> simplify(flatten(Result))
max_occupacy_of_buildings_2 = Merge(
    Data1=Slider(1, range=1..10, expression="x*100"),
    Data2=Slider(5, range=1..10),
    Data3=Slider(8, range=1..10, expression="x*50"),
    Data4=Slider(4, range=1..10, expression="x*50"),
    Data5=Slider(1, range=1..10, expression="x*50"),
    Data6=Slider(2, range=1..10, expression="x*50"),
    Data7=Slider(1, range=1..10, expression="x*50"),
    Data8=Slider(3, range=1..10, expression="x*50"),
    Data9=Slider(4, range=1..10, expression="x*50"))
colors_of_buildings_3 = Merge(
    Data1=ColourSwatch(SwatchColor=RGB(105, 112, 120)),
    Data2=ColourSwatch(SwatchColor=RGB(99, 65, 91)),
    Data3=ColourSwatch(SwatchColor=RGB(232, 176, 44)),
    Data4=ColourSwatch(SwatchColor=RGB(184, 108, 84)),
    Data5=ColourSwatch(SwatchColor=RGB(227, 43, 74)),
    Data6=ColourSwatch(SwatchColor=RGB(62, 162, 163)),
    Data7=ColourSwatch(SwatchColor=RGB(242, 105, 41)),
    Data8=ColourSwatch(SwatchColor=RGB(52, 51, 61)),
    Data9=ColourSwatch(SwatchColor=RGB(191, 196, 153)))
python = GhPythonScript(buildingsTYPESfullNAMES=merge_5)  # -> out, buildingTYPES; inputs buildingsTYPESfullNAMES: list; same code as ghpython_script

# ---- group: LOCATIONS of USERS accorging to SCHEDULE
schedule = GhPythonScript(
    locationsLIST=cull_i_removes_names_of_users_2,
    builidingsNAMES=python.buildingTYPES,
    MAXoccupancy=max_occupacy_of_buildings_2)  # -> out, locationsLIST; inputs locationsLIST: tree, builidingsNAMES: list, MAXoccupancy: list of Int32; same code as ghpython_script_2

# ----
txt = Text(schedule.locationsLIST)

# ---- group: Building list
cset_2 = CreateSet(List=flatten(txt))  # -> Set, Map
panel_247 = Panel(cset_2.Set)

# ---- group: Amount of users from Data sheet
flip = FlipMatrix(Data=simplify(txt))
branch = TreeBranch(Tree=flip, Path=Slider(0, range=0..1), MaintainPaths=True)
lng = ListLength(List=branch)

# ---- group: CUBE to DISPLAY
rectangle = Rectangle(Plane=PlaneXY(0, 0, 0), XSize=Domain(-1, 1), YSize=Domain(-2, 2), Radius=0)  # -> Rectangle, Length
box_8 = DomainBox(Base="-250,-250,400", X="0 to 500", Y="0 to 500", Z="0 to 500")
edges = BrepEdges(Brep=box_8)  # -> Naked, Interior, NonManifold
preview_4 = CustomPreview(Geometry=edges.Interior, Material=ColourSwatch(SwatchColor=RGB(194, 194, 194)))
dedomain = DeconstructDomain(Domain="0 to 500")  # -> Start, End

# ---- group: INITIAL RANDOM POSITIONS
lng_2 = ListLength(List=panel_247)
series_2 = Series(Start=0, Step=1, Count=lng_2)
pop3d = Populate3D(Region=box_8, Count=1, Seed=series_2)

# ----
python_2 = GhPythonScript(
    MAXoccupancy=max_occupacy_of_buildings_2,
    buildngCOLORS=colors_of_buildings_3,
    locationsLIST=panel_247,
    builidingsNAMEStype=python.buildingTYPES,
    activitiesNAMES=merge_5)  # -> out, overallVOLUME, buildingACTIVITY, sizes, colors; inputs MAXoccupancy: list, buildngCOLORS: list of Color, locationsLIST: list, builidingsNAMEStype: list, activitiesNAMES: list
# ---------- python_2: Python ----------
__author__ = "filip"
__version__ = "2018.12.01"

import rhinoscriptsyntax as rs
import math

colors=[]
sizes=[]
overallVOLUME = 0.0
buildingACTIVITY=[]

for i in range(len(locationsLIST)):
    location = locationsLIST[i]
    for n in range(len(builidingsNAMEStype)):
        if location[0:4] == builidingsNAMEStype[n]:
            colors.append(buildngCOLORS[n])
            mo=int(MAXoccupancy[n])
            r=(mo**(1.0/3.0))*3
            sizes.append(r)
            overallVOLUME = overallVOLUME + 36*math.pi*mo
            buildingACTIVITY.append(activitiesNAMES[n])
print(overallVOLUME)
# ---------- end python_2 ----------
material = CreateMaterial(Diffuse=python_2.colors, Specular=RGB(255, 255, 255), Emission=python_2.colors, Transparency=0, Shine=0)  # -> simplify(Material)
cube = Cube(Value=dedomain.End)
division_20 = Division(A=python_2.overallVOLUME, B=cube)
of_cube = Multiplication(A=division_20, B=100)
panel_248 = Panel(of_cube)

of_cube_2 = Multiplication(A=division_20, B=100)
panel_249 = Panel(of_cube_2)
pt = Point(simplify(flatten(pop3d)))

# ---- group: THE CODE
lenght_of_the_final_movement_vector_2 = Slider(5, range=1..10)
number_slider_302 = Slider(15, range=0..50)
number_slider_303 = Slider(2, range=0..93)
retrodicted_steps_2 = Slider(0, range=-3..0)
squeezing_power_2 = Slider(-4, range=-4..-1, expression="-x*2")
predicted_steps_2 = Slider(2, range=0..10)
multiplication_25 = Multiplication(A=number_slider_303, B=number_slider_302)
vector_creator_for_objects_2 = GhPythonScript(
    simulationLENGHT=number_slider_303,
    ITERATIONSperTIMEframe=number_slider_302,
    startingTIMEframeNUMBER=Slider(0, range=0..100),
    SCHEDULES=txt,
    retrodiction=retrodicted_steps_2,
    prediction=predicted_steps_2,
    buildingsLIST=panel_247,
    buildingLOCATIONS=pt,
    haloSIZE=Slider(25, range=5..100),
    squeezingPOWER=squeezing_power_2,
    movementSPEED=lenght_of_the_final_movement_vector_2,
    boxSIZE=dedomain.End)  # -> out, BUILDINGS_LOCATIONS_fromPYTHON, buildingOCCUPANCY, buildingLOCATIONS; inputs simulationLENGHT: Int32, ITERATIONSperTIMEframe: Int32, startingTIMEframeNUMBER: Int32, SCHEDULES: tree, retrodiction: Int32, prediction: Int32, buildingsLIST: list, buildingLOCATIONS: list of Point3d, squeezingPOWER: Int32
# ---------- vector_creator_for_objects_2: Python ----------
__author__ = "filip"
__version__ = "2018.11.30"

import rhinoscriptsyntax as rs
import ghpythonlib as gpl


bL = buildingsLIST

MAXhaloSIZE = haloSIZE
bC = len(bL)
bC2 = bC**2
Vzero = rs.CreateVector(0,0,0)

hbS = boxSIZE/2 # half of box size

BUILDINGS_LOCATIONS_fromPYTHON=[]

buildingOCCUPANCY=[]

def Squeezer(coordinate):
    if coordinate < 2*MAXhaloSIZE:
        d = coordinate
        squeezerVECTORcoordinate = MAXhaloSIZE**2/d**2
    elif coordinate > boxSIZE-2*MAXhaloSIZE:
        d = boxSIZE - coordinate
        squeezerVECTORcoordinate = -(MAXhaloSIZE**2/d**2)
    else:
        squeezerVECTORcoordinate = 0
    return squeezerVECTORcoordinate

steps = abs(retrodiction) + 1 + prediction
frameRANGE = []
for schedualFRAME in range(simulationLENGHT):
    t = startingTIMEframeNUMBER + schedualFRAME
    uS = []
    for user in range(SCHEDULES.BranchCount):
        uS.append([])
        for frameSTEP in range(steps):
            time = max(retrodiction+frameSTEP+t,0)
            uS[user].append(SCHEDULES.Branch(user)[time])

    ######################## FLOWS between all OBJECTS ########################
    
    objectsFLOWS=[]
    
    for i in range(bC2):
        objectsFLOWS.append(0)
    
    buildingOCCUPANCY.append([])

    for b in range(bC):
        buildingOCCUPANCY[schedualFRAME].append(0)
        for u in range(len(uS)):
            if bL[b] == uS[u][0]:
                buildingOCCUPANCY[schedualFRAME][b]+= 1
    print(buildingOCCUPANCY)
    
    for u in range(len(uS)):
        for locatin in range(len(uS[u])-1):
            if uS[u][locatin] != uS[u][locatin+1]:
                for B1 in range(bC):
                    for B2 in range(bC):
                        if uS[u][locatin] == bL[B1] and  uS[u][locatin+1] == bL[B2]:
                            objectsFLOWS[B1*bC+B2]=objectsFLOWS[B1*bC+B2]+1
                            objectsFLOWS[B2*bC+B1]=objectsFLOWS[B2*bC+B1]+1
    
    maxflow=max(objectsFLOWS)
    
    ######################## OCCUPANCY of EACH BUILDING ########################
    
    
    
    
    #####################################################################
    ############################ ITERATIONS #############################
    #####################################################################

    for iteration in range(ITERATIONSperTIMEframe):
        
        print("time frame: "+str(t)+"    |    iteration: "+str(iteration))
        
        BUILDINGS_LOCATIONS_fromPYTHON.append([])
        
        objectsVECTORS=[]
        objectsDISTANCES=[]
        objectsUNITS=[]
        antyproxmityVECTORS=[]
        squeezingVECTORS = []
        objectMOVEMNT=[]

        ######################## VECTORS and DISTANCES between all OBJECTS ########################
        
        for i in range(bC):
            B1 = buildingLOCATIONS[i]
            for j in range(bC):
                v = rs.VectorCreate(buildingLOCATIONS[j],B1)
                if v == Vzero:
                    d = 0
                    uv = Vzero
                    sp = Vzero
                else:
                    d = rs.VectorLength(v)
                    uv = v/d
                    sp = -uv*haloSIZE**2/d**2
        
                objectsUNITS.append(uv)
                antyproxmityVECTORS.append(sp)
            squeezingVECTORS.append(rs.CreateVector(Squeezer(B1[0]),Squeezer(B1[1]),Squeezer(B1[2])))
        
        
        ######################## MOVEMNET of OBJECTS according to FLOWS ########################
        
        flowVECTORS=[]
        if maxflow == 0:
            for i in range(bC2):
                flowVECTORS.append(Vzero)
        else:
            for i in range(bC2):
                flowVECTORS.append(objectsUNITS[i]*objectsFLOWS[i]/maxflow)
        
        
        ######################## MOVEMNET of OBJECTS according to DISTANCES ########################
        for i in range(bC):
            objectMOVEMNT.append(Vzero)
            objectMOVEMNT[i]=rs.VectorAdd(objectMOVEMNT[i],squeezingVECTORS[i])
            for j in range(bC):
                objectMOVEMNT[i]=rs.VectorAdd(objectMOVEMNT[i],flowVECTORS[i*bC+j])
                objectMOVEMNT[i]=rs.VectorAdd(objectMOVEMNT[i],antyproxmityVECTORS[i*bC+j])
            buildingLOCATIONS[i] = rs.VectorAdd(buildingLOCATIONS[i],objectMOVEMNT[i]*movementSPEED)
            BUILDINGS_LOCATIONS_fromPYTHON[schedualFRAME*ITERATIONSperTIMEframe+iteration].append(buildingLOCATIONS[i])
# ---------- end vector_creator_for_objects_2 ----------
number_of_iterartions_2 = Panel(multiplication_25)

# ---- group: CUBE to DISPLAY (continued)
pop2d = Populate2D(Region=center_box_24, Count=1, Seed=series_2)

# ---- group: Amount of users from Data sheet (continued)
pop3d_2 = Populate3D(Region=box_8, Count=lng, Seed=1)  # -> flatten(Population)

# ----
toggle = BooleanToggle(False)
timer_12 = Timer(TimerInterval=30)
lng_3 = ListLength(List=vector_creator_for_objects_2.BUILDINGS_LOCATIONS_fromPYTHON)
mod = Modulus(B=lng_3)
panel_250 = Panel(mod)
python_3 = GhPythonScript(
    t=mod,
    ITERATIONSperFRAME=number_slider_302,
    x=vector_creator_for_objects_2.BUILDINGS_LOCATIONS_fromPYTHON,
    y=vector_creator_for_objects_2.buildingOCCUPANCY)  # -> out, simplify(flatten(postions)), simplify(flatten(occupancy)); inputs t: Int32, x: list, y: list
# ---------- python_3: Python ----------
__author__ = "filip"
__version__ = "2018.12.07"

import rhinoscriptsyntax as rs

xint=x[t]
yint=y[int(t/ITERATIONSperFRAME)]
postions = xint
occupancy = yint
# ---------- end python_3 ----------

buildings = Panel(panel_247)
cbrt = CubeRoot(Value=python_3.occupancy)
activity = Panel(python_2.buildingACTIVITY)
addition_5 = Addition(A=cbrt, B=1)
multiplication_26 = Multiplication(A=addition_5, B=Slider(2, range=0..10))
location_of_building = Panel(python_3.postions)
sph_2 = Sphere(Base=simplify(python_3.postions), Radius=simplify(multiplication_26))
box_9 = CenterBox(Base=python_3.postions, X=multiplication_26, Y=multiplication_26, Z=multiplication_26)
preview_5 = CustomPreview(Geometry=simplify(graft(box_9)), Material=simplify(graft(material)))
occupancy_of_a_building = Panel(python_3.occupancy)

boolean_toggle_28 = BooleanToggle(True)  # disabled
deconstruct_brep_5 = DeconstructBrep(Brep=center_box_22)  # -> Faces, Edges, Vertices; disabled
waspsetup_2 = Wasp_Setup(RUN=boolean_toggle_28)  # -> log; inputs RUN: Boolean; disabled; plug-in component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
list_item_59 = ListItem(List=deconstruct_brep_5.Faces, Index=0, Wrap=True)  # -> Item, Item1, Item2, Item3, Item4, Item5; disabled
panel_251 = Panel(waspsetup_2)  # disabled
area_4 = Area(Geometry=list_item_59.Item)  # -> Area, Centroid; disabled
area_5 = Area(Geometry=list_item_59.Item1)  # -> Area, Centroid; disabled
area_6 = Area(Geometry=list_item_59.Item5)  # -> Area, Centroid; disabled
deconstruct_brep_6 = DeconstructBrep(Brep=list_item_59.Item)  # -> Faces, Edges, Vertices; disabled
deconstruct_brep_7 = DeconstructBrep(Brep=list_item_59.Item1)  # -> Faces, Edges, Vertices; disabled
deconstruct_brep_8 = DeconstructBrep(Brep=list_item_59.Item5)  # -> Faces, Edges, Vertices; disabled
list_item_60 = ListItem(List=deconstruct_brep_6.Edges, Index=0, Wrap=True)  # disabled
list_item_61 = ListItem(List=deconstruct_brep_7.Edges, Index=0, Wrap=True)  # disabled
list_item_62 = ListItem(List=deconstruct_brep_8.Edges, Index=1, Wrap=True)  # disabled
point_on_curve_4 = PointOnCurve(list_item_60, parameter=0.5)  # disabled
point_on_curve_5 = PointOnCurve(list_item_61, parameter=0.5)  # disabled
point_on_curve_6 = PointOnCurve(list_item_62, parameter=0.5)  # disabled
line_4 = Line(StartPoint=area_4.Centroid, EndPoint=point_on_curve_4)  # disabled
line_5 = Line(StartPoint=area_5.Centroid, EndPoint=point_on_curve_5)  # disabled
line_6 = Line(StartPoint=area_6.Centroid, EndPoint=point_on_curve_6)  # disabled
merge_6 = Merge(Data1=area_4.Centroid, Data2=area_5.Centroid, Data3=area_6.Centroid)  # disabled
merge_7 = Merge(Data1=line_4, Data2=line_5, Data3=line_6)  # disabled
conndir_2 = Wasp_ConnectionFromDirection(GEO=center_box_22, CEN=merge_6, UP=merge_7)  # -> CONN, PLN_OUT; inputs GEO: Brep, CEN: list of Point3d, UP: list of Curve; disabled; plug-in component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
part_name_2 = Panel("BOX")  # disabled
part_2 = Wasp_BasicPart(NAME=part_name_2, GEO=center_box_22, CONN=flatten(conndir_2.CONN))  # -> PART; inputs GEO: Mesh, CONN: list, COLL: Mesh, ATTR: list; disabled; plug-in component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
check_collisions_2 = BooleanToggle(True)  # disabled
reset_2 = Button()  # disabled
colour_swatch_73 = ColourSwatch(SwatchColor=RGB(226, 48, 76))  # disabled

# ---- group: rules
number_slider_304 = Slider(0, range=0..10)  # disabled
number_slider_305 = Slider(2, range=0..10)  # disabled
number_slider_306 = Slider(1, range=0..10)  # disabled
number_slider_307 = Slider(1, range=0..10)  # disabled
number_slider_308 = Slider(1, range=0..10)  # disabled
number_slider_309 = Slider(0, range=0..10)  # disabled
rule_4 = Wasp_Rule(P1=part_name_2, C1=number_slider_304, P2=part_name_2, C2=number_slider_306)  # -> R; inputs C1: Int32, C2: Int32; disabled; plug-in component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
rule_5 = Wasp_Rule(P1=part_name_2, C1=number_slider_305, P2=part_name_2, C2=number_slider_308)  # -> R; inputs C1: Int32, C2: Int32; disabled; plug-in component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
rule_6 = Wasp_Rule(P1=part_name_2, C1=number_slider_307, P2=part_name_2, C2=number_slider_309)  # -> R; inputs C1: Int32, C2: Int32; disabled; plug-in component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
merge_8 = Merge(Data1=rule_4, Data2=rule_6, Data3=rule_5)  # disabled

# ----
rndaggr_2 = Wasp_StochasticAggregation(PART=flatten(part_2), N=panel_210, RULES=merge_8, COLL=check_collisions_2, RESET=reset_2)  # -> PART_OUT; inputs PART: list, PREV: list, N: Int32, RULES: list, COLL: Boolean, RESET: Boolean; disabled; plug-in component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
depart_2 = Wasp_DeconstructPart(PART=rndaggr_2)  # -> NAME, GEO, CONN, CONN_PLN, TR, CHILD, ATTR; inputs PART: list; disabled; plug-in component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
custom_preview_105 = CustomPreview(Geometry=depart_2.GEO, Shader=colour_swatch_73)  # disabled

boolean_toggle_29 = BooleanToggle(True)  # disabled
deconstruct_brep_9 = DeconstructBrep(Brep=center_box_21)  # -> Faces, Edges, Vertices; disabled
waspsetup_3 = Wasp_Setup(RUN=boolean_toggle_29)  # -> log; inputs RUN: Boolean; disabled; plug-in component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
list_item_63 = ListItem(List=deconstruct_brep_9.Faces, Index=0, Wrap=True)  # -> Item, Item1, Item2, Item3, Item4, Item5; disabled
panel_252 = Panel(waspsetup_3)  # disabled
area_7 = Area(Geometry=list_item_63.Item)  # -> Area, Centroid; disabled
area_8 = Area(Geometry=list_item_63.Item1)  # -> Area, Centroid; disabled
area_9 = Area(Geometry=list_item_63.Item5)  # -> Area, Centroid; disabled
deconstruct_brep_10 = DeconstructBrep(Brep=list_item_63.Item)  # -> Faces, Edges, Vertices; disabled
deconstruct_brep_11 = DeconstructBrep(Brep=list_item_63.Item1)  # -> Faces, Edges, Vertices; disabled
deconstruct_brep_12 = DeconstructBrep(Brep=list_item_63.Item5)  # -> Faces, Edges, Vertices; disabled
list_item_64 = ListItem(List=deconstruct_brep_10.Edges, Index=0, Wrap=True)  # disabled
list_item_65 = ListItem(List=deconstruct_brep_11.Edges, Index=0, Wrap=True)  # disabled
list_item_66 = ListItem(List=deconstruct_brep_12.Edges, Index=1, Wrap=True)  # disabled
point_on_curve_7 = PointOnCurve(list_item_64, parameter=0.5)  # disabled
point_on_curve_8 = PointOnCurve(list_item_65, parameter=0.5)  # disabled
point_on_curve_9 = PointOnCurve(list_item_66, parameter=0.5)  # disabled
line_7 = Line(StartPoint=area_7.Centroid, EndPoint=point_on_curve_7)  # disabled
line_8 = Line(StartPoint=area_8.Centroid, EndPoint=point_on_curve_8)  # disabled
line_9 = Line(StartPoint=area_9.Centroid, EndPoint=point_on_curve_9)  # disabled
merge_9 = Merge(Data1=area_7.Centroid, Data2=area_8.Centroid, Data3=area_9.Centroid)  # disabled
merge_10 = Merge(Data1=line_7, Data2=line_8, Data3=line_9)  # disabled
conndir_3 = Wasp_ConnectionFromDirection(GEO=center_box_21, CEN=merge_9, UP=merge_10)  # -> CONN, PLN_OUT; inputs GEO: Brep, CEN: list of Point3d, UP: list of Curve; disabled; plug-in component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
part_name_3 = Panel("BOX")  # disabled
part_3 = Wasp_BasicPart(NAME=part_name_3, GEO=center_box_21, CONN=flatten(conndir_3.CONN))  # -> PART; inputs GEO: Mesh, CONN: list, COLL: Mesh, ATTR: list; disabled; plug-in component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
parts_num_2 = Slider(310, range=0..1000)  # disabled
check_collisions_3 = BooleanToggle(True)  # disabled
reset_3 = Button()  # disabled
colour_swatch_74 = ColourSwatch(SwatchColor=RGB(100, 64, 90))  # disabled

# ---- group: rules
number_slider_310 = Slider(0, range=0..10)  # disabled
number_slider_311 = Slider(2, range=0..10)  # disabled
number_slider_312 = Slider(1, range=0..10)  # disabled
number_slider_313 = Slider(1, range=0..10)  # disabled
number_slider_314 = Slider(1, range=0..10)  # disabled
number_slider_315 = Slider(0, range=0..10)  # disabled
rule_7 = Wasp_Rule(P1=part_name_3, C1=number_slider_310, P2=part_name_3, C2=number_slider_312)  # -> R; inputs C1: Int32, C2: Int32; disabled; plug-in component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
rule_8 = Wasp_Rule(P1=part_name_3, C1=number_slider_311, P2=part_name_3, C2=number_slider_314)  # -> R; inputs C1: Int32, C2: Int32; disabled; plug-in component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
rule_9 = Wasp_Rule(P1=part_name_3, C1=number_slider_313, P2=part_name_3, C2=number_slider_315)  # -> R; inputs C1: Int32, C2: Int32; disabled; plug-in component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
merge_11 = Merge(Data1=rule_7, Data2=rule_9, Data3=rule_8)  # disabled

# ----
rndaggr_3 = Wasp_StochasticAggregation(PART=flatten(part_3), N=panel_209, RULES=merge_11, COLL=check_collisions_3, RESET=reset_3)  # -> PART_OUT; inputs PART: list, PREV: list, N: Int32, RULES: list, COLL: Boolean, RESET: Boolean; disabled; plug-in component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
depart_3 = Wasp_DeconstructPart(PART=rndaggr_3)  # -> NAME, GEO, CONN, CONN_PLN, TR, CHILD, ATTR; inputs PART: list; disabled; plug-in component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
custom_preview_106 = CustomPreview(Geometry=depart_3.GEO, Shader=colour_swatch_74)  # disabled

boolean_toggle_30 = BooleanToggle(True)  # disabled
deconstruct_brep_13 = DeconstructBrep(Brep=center_box_23)  # -> Faces, Edges, Vertices; disabled
waspsetup_4 = Wasp_Setup(RUN=boolean_toggle_30)  # -> log; inputs RUN: Boolean; disabled; plug-in component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
list_item_67 = ListItem(List=deconstruct_brep_13.Faces, Index=0, Wrap=True)  # -> Item, Item1, Item2, Item3, Item4, Item5; disabled
panel_253 = Panel(waspsetup_4)  # disabled
area_10 = Area(Geometry=list_item_67.Item)  # -> Area, Centroid; disabled
area_11 = Area(Geometry=list_item_67.Item1)  # -> Area, Centroid; disabled
area_12 = Area(Geometry=list_item_67.Item5)  # -> Area, Centroid; disabled
deconstruct_brep_14 = DeconstructBrep(Brep=list_item_67.Item)  # -> Faces, Edges, Vertices; disabled
deconstruct_brep_15 = DeconstructBrep(Brep=list_item_67.Item1)  # -> Faces, Edges, Vertices; disabled
deconstruct_brep_16 = DeconstructBrep(Brep=list_item_67.Item5)  # -> Faces, Edges, Vertices; disabled
list_item_68 = ListItem(List=deconstruct_brep_14.Edges, Index=0, Wrap=True)  # disabled
list_item_69 = ListItem(List=deconstruct_brep_15.Edges, Index=0, Wrap=True)  # disabled
list_item_70 = ListItem(List=deconstruct_brep_16.Edges, Index=1, Wrap=True)  # disabled
point_on_curve_10 = PointOnCurve(list_item_68, parameter=0.5)  # disabled
point_on_curve_11 = PointOnCurve(list_item_69, parameter=0.5)  # disabled
point_on_curve_12 = PointOnCurve(list_item_70, parameter=0.5)  # disabled
line_10 = Line(StartPoint=area_10.Centroid, EndPoint=point_on_curve_10)  # disabled
line_11 = Line(StartPoint=area_11.Centroid, EndPoint=point_on_curve_11)  # disabled
line_12 = Line(StartPoint=area_12.Centroid, EndPoint=point_on_curve_12)  # disabled
merge_12 = Merge(Data1=area_10.Centroid, Data2=area_11.Centroid, Data3=area_12.Centroid)  # disabled
merge_13 = Merge(Data1=line_10, Data2=line_11, Data3=line_12)  # disabled
conndir_4 = Wasp_ConnectionFromDirection(GEO=center_box_23, CEN=merge_12, UP=merge_13)  # -> CONN, PLN_OUT; inputs GEO: Brep, CEN: list of Point3d, UP: list of Curve; disabled; plug-in component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
part_name_4 = Panel("BOX")  # disabled
part_4 = Wasp_BasicPart(NAME=part_name_4, GEO=center_box_23, CONN=flatten(conndir_4.CONN))  # -> PART; inputs GEO: Mesh, CONN: list, COLL: Mesh, ATTR: list; disabled; plug-in component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
check_collisions_4 = BooleanToggle(True)  # disabled
reset_4 = Button()  # disabled
colour_swatch_75 = ColourSwatch(SwatchColor=RGB(232, 177, 48))  # disabled

# ---- group: rules
number_slider_316 = Slider(0, range=0..10)  # disabled
number_slider_317 = Slider(2, range=0..10)  # disabled
number_slider_318 = Slider(1, range=0..10)  # disabled
number_slider_319 = Slider(1, range=0..10)  # disabled
number_slider_320 = Slider(1, range=0..10)  # disabled
number_slider_321 = Slider(0, range=0..10)  # disabled
rule_10 = Wasp_Rule(P1=part_name_4, C1=number_slider_316, P2=part_name_4, C2=number_slider_318)  # -> R; inputs C1: Int32, C2: Int32; disabled; plug-in component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
rule_11 = Wasp_Rule(P1=part_name_4, C1=number_slider_317, P2=part_name_4, C2=number_slider_320)  # -> R; inputs C1: Int32, C2: Int32; disabled; plug-in component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
rule_12 = Wasp_Rule(P1=part_name_4, C1=number_slider_319, P2=part_name_4, C2=number_slider_321)  # -> R; inputs C1: Int32, C2: Int32; disabled; plug-in component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
merge_14 = Merge(Data1=rule_10, Data2=rule_12, Data3=rule_11)  # disabled

# ----
rndaggr_4 = Wasp_StochasticAggregation(PART=flatten(part_4), N=panel_211, RULES=merge_14, COLL=check_collisions_4, RESET=reset_4)  # -> PART_OUT; inputs PART: list, PREV: list, N: Int32, RULES: list, COLL: Boolean, RESET: Boolean; disabled; plug-in component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
depart_4 = Wasp_DeconstructPart(PART=rndaggr_4)  # -> NAME, GEO, CONN, CONN_PLN, TR, CHILD, ATTR; inputs PART: list; disabled; plug-in component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
custom_preview_107 = CustomPreview(Geometry=depart_4.GEO, Shader=colour_swatch_75)  # disabled

# ==== cluster ComparePointLists: Conpares two lists of points.
point_list_1 = ClusterInput()
point_list_2 = ClusterInput()
cset = CreateSet(List=point_list_1)  # -> Set, Map
cset_2 = CreateSet(List=point_list_2)  # -> Set, Map
intersection = SetIntersection(SetA=cset.Set, SetB=cset_2.Set)
exdiff = SetDifferenceS(SetA=cset.Set, SetB=cset_2.Set)
points_in_common = ClusterOutput(intersection)
points_not_in_commom = ClusterOutput(exdiff)

# ==== cluster Cluster
path = ClusterInput()
path_2 = FilePath(path)
file = ReadFile(File=path_2, PerLineParse=True)
split = TextSplit(Text=file, Separators=";")  # -> simplify(flatten(Result))
R = ClusterOutput(split)
