# Grasshopper definition AggregationTest_1401.gh (Grasshopper 1.0.7)

# ----
# Setup
toggle = BooleanToggle(True)
waspsetup = Wasp_Setup(RUN=toggle)  # -> log; inputs RUN: Boolean; plug-in component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
panel = Panel(waspsetup)

# ----
# 22. Greenary Pod a
connections_x_axis = Curve([<curve referenced from the Rhino model> x6])
connections_centers = Point([<point referenced from the Rhino model> x6])
part_geometry = Brep(<brep referenced from the Rhino model>)
conndir = Wasp_ConnectionFromDirection(GEO=part_geometry, CEN=connections_centers, UP=connections_x_axis)  # -> CONN, PLN_OUT; inputs GEO: Brep, CEN: list of Point3d, UP: list of Curve, T: list; plug-in component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
points = PointList(Points=connections_centers, Size=Slider(0.5, range=0..1))
part_name = Panel("A")
part = Wasp_BasicPart(NAME=part_name, GEO=part_geometry, CONN=flatten(conndir.CONN))  # -> PART; inputs GEO: Mesh, CONN: list, COLL: Mesh, ATTR: list; plug-in component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

# ----
# 22. Greenary Pod b
part_geometry_2 = Brep(<brep referenced from the Rhino model>)
connections_centers_2 = Point([<point referenced from the Rhino model> x6])
connections_x_axis_2 = Curve([<curve referenced from the Rhino model> x6])
conndir_2 = Wasp_ConnectionFromDirection(GEO=part_geometry_2, CEN=connections_centers_2, UP=connections_x_axis_2)  # -> CONN, PLN_OUT; inputs GEO: Brep, CEN: list of Point3d, UP: list of Curve, T: list; plug-in component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
points_2 = PointList(Points=connections_centers_2, Size=Slider(0.5, range=0..1))
part_name_2 = Panel("D")
part_2 = Wasp_BasicPart(NAME=part_name_2, GEO=part_geometry_2, CONN=flatten(conndir_2.CONN))  # -> PART; inputs GEO: Mesh, CONN: list, COLL: Mesh, ATTR: list; plug-in component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

# ----
# 10. Presentation Pod
part_geometry_3 = Brep(<brep referenced from the Rhino model>)
connections_centers_3 = Point([<point referenced from the Rhino model> x28])
connections_x_axis_3 = Curve([<curve referenced from the Rhino model> x28])
conndir_3 = Wasp_ConnectionFromDirection(GEO=part_geometry_3, CEN=connections_centers_3, UP=connections_x_axis_3)  # -> CONN, PLN_OUT; inputs GEO: Brep, CEN: list of Point3d, UP: list of Curve, T: list; plug-in component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
points_3 = PointList(Points=connections_centers_3, Size=Slider(0.5, range=0..1))
part_name_3 = Panel("N")
part_3 = Wasp_BasicPart(NAME=part_name_3, GEO=part_geometry_3, CONN=flatten(conndir_3.CONN))  # -> PART; inputs GEO: Mesh, CONN: list, COLL: Mesh, ATTR: list; plug-in component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

# ----
# pods in Office
connections_centers_4 = Point([<point referenced from the Rhino model> x25])
connections_x_axis_4 = Curve([<curve referenced from the Rhino model> x25])

# ----
# 20. Walking Pod a
connections_centers_5 = Point([<point referenced from the Rhino model> x2])
part_geometry_4 = Brep(<brep referenced from the Rhino model>)
connections_x_axis_5 = Curve([<curve referenced from the Rhino model> x2])
conndir_4 = Wasp_ConnectionFromDirection(GEO=part_geometry_4, CEN=connections_centers_5, UP=connections_x_axis_5)  # -> CONN, PLN_OUT; inputs GEO: Brep, CEN: list of Point3d, UP: list of Curve, T: list; plug-in component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
points_4 = PointList(Points=connections_centers_5, Size=Slider(0.5, range=0..1))
part_name_4 = Panel("E")
part_4 = Wasp_BasicPart(NAME=part_name_4, GEO=part_geometry_4, CONN=flatten(conndir_4.CONN))  # -> PART; inputs GEO: Mesh, CONN: list, COLL: Mesh, ATTR: list; plug-in component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

# ----
# 23. Kiosk Pod
part_geometry_5 = Brep(<brep referenced from the Rhino model>)
connections_centers_6 = Point([<point referenced from the Rhino model> x2])
connections_x_axis_6 = Curve([<curve referenced from the Rhino model> x2])
conndir_5 = Wasp_ConnectionFromDirection(GEO=part_geometry_5, CEN=connections_centers_6, UP=connections_x_axis_6)  # -> CONN, PLN_OUT; inputs GEO: Brep, CEN: list of Point3d, UP: list of Curve, T: list; plug-in component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
points_5 = PointList(Points=connections_centers_6, Size=Slider(0.5, range=0..1))
part_name_5 = Panel("F")
part_5 = Wasp_BasicPart(NAME=part_name_5, GEO=part_geometry_5, CONN=flatten(conndir_5.CONN))  # -> PART; inputs GEO: Mesh, CONN: list, COLL: Mesh, ATTR: list; plug-in component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

# ----
# 8. Workshop Pod
part_geometry_6 = Brep(<brep referenced from the Rhino model>)
conndir_6 = Wasp_ConnectionFromDirection(GEO=part_geometry_6, CEN=connections_centers_4, UP=connections_x_axis_4)  # -> CONN, PLN_OUT; inputs GEO: Brep, CEN: list of Point3d, UP: list of Curve, T: list; plug-in component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
points_6 = PointList(Points=connections_centers_4, Size=Slider(0.5, range=0..1))
part_name_6 = Panel("M")
part_6 = Wasp_BasicPart(NAME=part_name_6, GEO=part_geometry_6, CONN=flatten(conndir_6.CONN))  # -> PART; inputs GEO: Mesh, CONN: list, COLL: Mesh, ATTR: list; plug-in component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

# ----
# 1. Living Pod
part_geometry_7 = Brep(<brep referenced from the Rhino model>)
connections_x_axis_7 = Curve([<curve referenced from the Rhino model> x18])
connections_centers_7 = Point([<point referenced from the Rhino model> x18])
conndir_7 = Wasp_ConnectionFromDirection(GEO=part_geometry_7, CEN=connections_centers_7, UP=connections_x_axis_7)  # -> CONN, PLN_OUT; inputs GEO: Brep, CEN: list of Point3d, UP: list of Curve, T: list; plug-in component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
points_7 = PointList(Points=connections_centers_7, Size=Slider(0.5, range=0..1))
part_name_7 = Panel("Z")
part_7 = Wasp_BasicPart(NAME=part_name_7, GEO=part_geometry_7, CONN=flatten(conndir_7.CONN))  # -> PART; inputs GEO: Mesh, CONN: list, COLL: Mesh, ATTR: list; plug-in component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

# ----
# 5. Eating Pod
part_geometry_8 = Brep(<brep referenced from the Rhino model>)
connections_centers_8 = Point([<point referenced from the Rhino model> x6])
connections_x_axis_8 = Curve([<curve referenced from the Rhino model> x6])
conndir_8 = Wasp_ConnectionFromDirection(GEO=part_geometry_8, CEN=connections_centers_8, UP=connections_x_axis_8)  # -> CONN, PLN_OUT; inputs GEO: Brep, CEN: list of Point3d, UP: list of Curve, T: list; plug-in component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
points_8 = PointList(Points=connections_centers_8, Size=Slider(0.5, range=0..1))
part_name_8 = Panel("Y")
part_8 = Wasp_BasicPart(NAME=part_name_8, GEO=part_geometry_8, CONN=flatten(conndir_8.CONN))  # -> PART; inputs GEO: Mesh, CONN: list, COLL: Mesh, ATTR: list; plug-in component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

# ----
# 2. Kichen Pod
part_geometry_9 = Brep(<brep referenced from the Rhino model>)
connections_x_axis_9 = Curve([<curve referenced from the Rhino model> x5])
connections_centers_9 = Point([<point referenced from the Rhino model> x5])
conndir_9 = Wasp_ConnectionFromDirection(GEO=part_geometry_9, CEN=connections_centers_9, UP=connections_x_axis_9)  # -> CONN, PLN_OUT; inputs GEO: Brep, CEN: list of Point3d, UP: list of Curve, T: list; plug-in component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
points_9 = PointList(Points=connections_centers_9, Size=Slider(0.5, range=0..1))
part_name_9 = Panel("V")
part_9 = Wasp_BasicPart(NAME=part_name_9, GEO=part_geometry_9, CONN=flatten(conndir_9.CONN))  # -> PART; inputs GEO: Mesh, CONN: list, COLL: Mesh, ATTR: list; plug-in component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

# ----
# 12. Conversation Pod
part_geometry_10 = Brep(<brep referenced from the Rhino model>)
connections_centers_10 = Point([<point referenced from the Rhino model> x30])
connections_x_axis_10 = Curve([<curve referenced from the Rhino model> x30])
conndir_10 = Wasp_ConnectionFromDirection(GEO=part_geometry_10, CEN=connections_centers_10, UP=connections_x_axis_10)  # -> CONN, PLN_OUT; inputs GEO: Brep, CEN: list of Point3d, UP: list of Curve, T: list; plug-in component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
points_10 = PointList(Points=connections_centers_10, Size=Slider(0.5, range=0..1))
part_name_10 = Panel("O")
part_10 = Wasp_BasicPart(NAME=part_name_10, GEO=part_geometry_10, CONN=flatten(conndir_10.CONN))  # -> PART; inputs GEO: Mesh, CONN: list, COLL: Mesh, ATTR: list; plug-in component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

# ----
# 7. Sleep Pod
connections_x_axis_11 = Curve([<curve referenced from the Rhino model> x5])
part_geometry_11 = Brep(<brep referenced from the Rhino model>)
connections_centers_11 = Point([<point referenced from the Rhino model> x5])
conndir_11 = Wasp_ConnectionFromDirection(GEO=part_geometry_11, CEN=connections_centers_11, UP=connections_x_axis_11)  # -> CONN, PLN_OUT; inputs GEO: Brep, CEN: list of Point3d, UP: list of Curve, T: list; plug-in component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
points_11 = PointList(Points=connections_centers_11, Size=Slider(0.5, range=0..1))
part_name_11 = Panel("X")
part_11 = Wasp_BasicPart(NAME=part_name_11, GEO=part_geometry_11, CONN=flatten(conndir_11.CONN))  # -> PART; inputs GEO: Mesh, CONN: list, COLL: Mesh, ATTR: list; plug-in component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

# ----
# 26. Workstation Pod
part_geometry_12 = Brep(<brep referenced from the Rhino model>)
connections_x_axis_12 = Curve([<curve referenced from the Rhino model> x4])
connections_centers_12 = Point([<point referenced from the Rhino model> x4])
conndir_12 = Wasp_ConnectionFromDirection(GEO=part_geometry_12, CEN=connections_centers_12, UP=connections_x_axis_12)  # -> CONN, PLN_OUT; inputs GEO: Brep, CEN: list of Point3d, UP: list of Curve, T: list; plug-in component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
points_12 = PointList(Points=connections_centers_12, Size=Slider(0.5, range=0..1))
part_name_12 = Panel("Q")
part_12 = Wasp_BasicPart(NAME=part_name_12, GEO=part_geometry_12, CONN=flatten(conndir_12.CONN))  # -> PART; inputs GEO: Mesh, CONN: list, COLL: Mesh, ATTR: list; plug-in component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

# ----
# 26. Workstation Pod
part_geometry_13 = Brep(<brep referenced from the Rhino model>)
connections_x_axis_13 = Curve([<curve referenced from the Rhino model> x53])
connections_centers_13 = Point([<point referenced from the Rhino model> x53])
conndir_13 = Wasp_ConnectionFromDirection(GEO=part_geometry_13, CEN=connections_centers_13, UP=connections_x_axis_13)  # -> CONN, PLN_OUT; inputs GEO: Brep, CEN: list of Point3d, UP: list of Curve, T: list; plug-in component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
points_13 = PointList(Points=connections_centers_13, Size=Slider(0.5, range=0..1))
part_name_13 = Panel("P")
part_13 = Wasp_BasicPart(NAME=part_name_13, GEO=part_geometry_13, CONN=flatten(conndir_13.CONN))  # -> PART; inputs GEO: Mesh, CONN: list, COLL: Mesh, ATTR: list; plug-in component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

# ----
# pods in Park
number_slider = Slider(0.5, range=0..1)

# ----
# 20. Walking Pod b
part_geometry_14 = Brep(<brep referenced from the Rhino model>)
connections_centers_14 = Point([<point referenced from the Rhino model> x2])
connections_x_axis_14 = Curve([<curve referenced from the Rhino model> x2])
conndir_14 = Wasp_ConnectionFromDirection(GEO=part_geometry_14, CEN=connections_centers_14, UP=connections_x_axis_14)  # -> CONN, PLN_OUT; inputs GEO: Brep, CEN: list of Point3d, UP: list of Curve, T: list; plug-in component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
points_14 = PointList(Points=connections_centers_14, Size=number_slider)
part_name_14 = Panel("B")
part_14 = Wasp_BasicPart(NAME=part_name_14, GEO=part_geometry_14, CONN=flatten(conndir_14.CONN))  # -> PART; inputs GEO: Mesh, CONN: list, COLL: Mesh, ATTR: list; plug-in component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

# ----
# 20. Walking Pod c
part_geometry_15 = Brep(<brep referenced from the Rhino model>)
connections_centers_15 = Point([<point referenced from the Rhino model> x2])
connections_x_axis_15 = Curve([<curve referenced from the Rhino model> x2])
conndir_15 = Wasp_ConnectionFromDirection(GEO=part_geometry_15, CEN=connections_centers_15, UP=connections_x_axis_15)  # -> CONN, PLN_OUT; inputs GEO: Brep, CEN: list of Point3d, UP: list of Curve, T: list; plug-in component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
points_15 = PointList(Points=connections_centers_15, Size=Slider(0.5, range=0..1))
part_name_15 = Panel("C")
part_15 = Wasp_BasicPart(NAME=part_name_15, GEO=part_geometry_15, CONN=flatten(conndir_15.CONN))  # -> PART; inputs GEO: Mesh, CONN: list, COLL: Mesh, ATTR: list; plug-in component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

# ----
# rules in Park
panel_2 = Panel("""A|0
A|1
A|2
A|3
D|1
D|2
D|3
D|4
B|0
B|1
C|0
C|1""")
panel_3 = Panel("""D|1
D|2
D|3
D|4""")
panel_4 = Panel("""A|0
A|1
A|2
A|3
B|0
B|1
C|0
C|1
D|1
D|2
D|3
D|4
E|0
E|1""")
panel_5 = Panel("""A|0
A|1
A|2
A|3""")
panel_6 = Panel("""E|0
E|1""")
panel_7 = Panel("""B|0
B|1""")
panel_8 = Panel("""B|0
B|1
C|0
C|1
A|0
A|1
A|2
A|3
D|1
D|2
D|3
D|4
E|0
E|1""")
panel_9 = Panel("""A|0
A|1
A|2
A|3""")
panel_10 = Panel("""C|0
C|1
B|0
B|1
A|0
A|1
A|2
A|3
D|1
D|2
D|3
D|4
E|0
E|1""")
panel_11 = Panel("""C|0
C|1""")
crossref = CrossReference(ListA=panel_5, ListB=panel_6, CrossMode=1)  # -> ListA, ListB
crossref_2 = CrossReference(ListA=panel_8, ListB=panel_7, CrossMode=1)  # -> ListA, ListB
crossref_3 = CrossReference(ListA=panel_10, ListB=panel_11, CrossMode=1)  # -> ListA, ListB
crossref_4 = CrossReference(ListA=panel_2, ListB=panel_3, CrossMode=1)  # -> ListA, ListB
crossref_5 = CrossReference(ListA=panel_4, ListB=panel_9, CrossMode=1)  # -> ListA, ListB
concat = Concatenate(FragmentA=crossref.ListB, FragmentB="_", FragmentC=crossref.ListA)
concat_2 = Concatenate(FragmentA=crossref_2.ListB, FragmentB="_", FragmentC=crossref_2.ListA)
concat_3 = Concatenate(FragmentA=crossref_3.ListB, FragmentB="_", FragmentC=crossref_3.ListA)
concat_4 = Concatenate(FragmentA=crossref_4.ListB, FragmentB="_", FragmentC=crossref_4.ListA)
concat_5 = Concatenate(FragmentA=crossref_5.ListB, FragmentB="_", FragmentC=crossref_5.ListA)
E = Panel(concat)
A = Panel(concat_5)
B = Panel(concat_2)
C = Panel(concat_3)
D = Panel(concat_4)
f_ad = Panel("""F|0_A|4
F|1_A|5
F|1_D|0
F|0_D|5""")
ruletxt = Wasp_RuleFromText(TXT=A)  # -> R; plug-in component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
ruletxt_2 = Wasp_RuleFromText(TXT=E)  # -> R; plug-in component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
ruletxt_3 = Wasp_RuleFromText(TXT=D)  # -> R; plug-in component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
ruletxt_4 = Wasp_RuleFromText(TXT=B)  # -> R; plug-in component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
ruletxt_5 = Wasp_RuleFromText(TXT=C)  # -> R; plug-in component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
ruletxt_6 = Wasp_RuleFromText(TXT=f_ad)  # -> R; plug-in component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
a_f = Panel("""A|4_F|0
A|5_F|1""")
d_f = Panel("""D|0_F|1
D|5_F|0""")
ruletxt_7 = Wasp_RuleFromText(TXT=a_f)  # -> R; plug-in component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
ruletxt_8 = Wasp_RuleFromText(TXT=d_f)  # -> R; plug-in component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
merge = Merge(
    Data1=ruletxt,
    Data2=ruletxt_7,
    Data3=ruletxt_4,
    Data4=ruletxt_5,
    Data5=ruletxt_2,
    Data6=ruletxt_3,
    Data7=ruletxt_8,
    Data9=ruletxt_6)

# ----
# rules in Office <---> Park
panel_12 = Panel("""O|0
O|1
O|28
O|29
O|26
O|27
P|0
P|1
P|2
P|3
P|4
P|5
P|6
P|7
P|24
P|25
P|26
P|27""")
panel_13 = Panel("""A|0
A|1
A|2
A|3
D|1
D|2
D|3
D|4""")
panel_14 = Panel("""A|0
A|1
A|2
A|3
D|1
D|2
D|3
D|4""")
panel_15 = Panel("""O|0
O|1
O|28
O|29
O|26
O|27
P|0
P|1
P|2
P|3
P|4
P|5
P|6
P|7
P|24
P|25
P|26
P|27""")
crossref_6 = CrossReference(ListA=panel_13, ListB=panel_12, CrossMode=1)  # -> ListA, ListB
crossref_7 = CrossReference(ListA=panel_15, ListB=panel_14, CrossMode=1)  # -> ListA, ListB
concat_6 = Concatenate(FragmentA=crossref_6.ListB, FragmentB="_", FragmentC=crossref_6.ListA)
concat_7 = Concatenate(FragmentA=crossref_7.ListB, FragmentB="_", FragmentC=crossref_7.ListA)
C_2 = Panel(concat_6)
B_2 = Panel(concat_7)
ruletxt_9 = Wasp_RuleFromText(TXT=C_2)  # -> R; plug-in component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
ruletxt_10 = Wasp_RuleFromText(TXT=B_2)  # -> R; plug-in component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
merge_2 = Merge(Data1=ruletxt_10, Data3=ruletxt_9)

merge_3 = Merge(Data1=part_6, Data2=part_3, Data3=part_10, Data4=part_13, Data5=part_12)
merge_4 = Merge(Data1=part, Data2=part_14, Data3=part_15, Data4=part_2, Data5=part_4, Data6=part_5)

# ----
# rules in Apartment <---> Park
panel_16 = Panel("""A|0
A|1
A|2
A|3
D|1
D|2
D|3
D|4""")
panel_17 = Panel("""Z|3
Z|5
Z|6
Z|7""")
panel_18 = Panel("""A|0
A|1
A|2
A|3
D|1
D|2
D|3
D|4""")
panel_19 = Panel("""Z|0
Z|1
Z|2
Z|3
Z|4
Z|5
Z|6
Z|7
X|1
X|2
Y|1
Y|3""")
crossref_8 = CrossReference(ListA=panel_16, ListB=panel_19, CrossMode=1)  # -> ListA, ListB
crossref_9 = CrossReference(ListA=panel_17, ListB=panel_18, CrossMode=1)  # -> ListA, ListB
concat_8 = Concatenate(FragmentA=crossref_8.ListB, FragmentB="_", FragmentC=crossref_8.ListA)
concat_9 = Concatenate(FragmentA=crossref_9.ListB, FragmentB="_", FragmentC=crossref_9.ListA)
B_3 = Panel(concat_9)
C_3 = Panel(concat_8)
ruletxt_11 = Wasp_RuleFromText(TXT=C_3)  # -> R; plug-in component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
ruletxt_12 = Wasp_RuleFromText(TXT=B_3)  # -> R; plug-in component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
merge_5 = Merge(Data1=ruletxt_12, Data3=ruletxt_11)

# ----
# rules in Park
panel_20 = Panel("""Z|3
Z|6
Z|5
Z|7
Z|1
Z|2""")
panel_21 = Panel("""Z|3
Z|6
Z|5
Z|7
Z|1
Z|2
V|3
W|2
Y|1
Y|3
X|1
X|2""")
panel_22 = Panel("""Z|0
Z|4
Y|1
Y|3""")
panel_23 = Panel("""Z|0
Z|4""")
panel_24 = Panel("""X|1
X|2""")
panel_25 = Panel("""Z|0
Z|4
V|3
W|2""")
panel_26 = Panel("""Y|1
Y|3""")
panel_27 = Panel("""Z|0
Z|4
W|2""")
crossref_10 = CrossReference(ListA=panel_21, ListB=panel_20, CrossMode=1)  # -> ListA, ListB
crossref_11 = CrossReference(ListA=panel_23, ListB="W|2", CrossMode=1)  # -> ListA, ListB
crossref_12 = CrossReference(ListA=panel_25, ListB=panel_26, CrossMode=1)  # -> ListA, ListB
crossref_13 = CrossReference(ListA=panel_27, ListB=panel_24, CrossMode=1)  # -> ListA, ListB
crossref_14 = CrossReference(ListA=panel_22, ListB="V|3", CrossMode=1)  # -> ListA, ListB
concat_10 = Concatenate(FragmentA=crossref_10.ListB, FragmentB="_", FragmentC=crossref_10.ListA)
concat_11 = Concatenate(FragmentA=crossref_11.ListB, FragmentB="_", FragmentC=crossref_11.ListA)
concat_12 = Concatenate(FragmentA=crossref_12.ListB, FragmentB="_", FragmentC=crossref_12.ListA)
concat_13 = Concatenate(FragmentA=crossref_13.ListB, FragmentB="_", FragmentC=crossref_13.ListA)
concat_14 = Concatenate(FragmentA=crossref_14.ListB, FragmentB="_", FragmentC=crossref_14.ListA)
Z = Panel(concat_10)
panel_28 = Panel(concat_13)
panel_29 = Panel(concat_12)
panel_30 = Panel(concat_11)
V = Panel(concat_14)
ruletxt_13 = Wasp_RuleFromText(TXT=Z)  # -> R; plug-in component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
ruletxt_14 = Wasp_RuleFromText(TXT=panel_30)  # -> R; plug-in component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
ruletxt_15 = Wasp_RuleFromText(TXT=panel_29)  # -> R; plug-in component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
ruletxt_16 = Wasp_RuleFromText(TXT=panel_28)  # -> R; plug-in component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
ruletxt_17 = Wasp_RuleFromText(TXT=V)  # -> R; plug-in component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
panel_31 = Panel("""Z|13
Z|14
Z|15
Z|16
Z|17
X|3""")
panel_32 = Panel("""Z|13
Z|14
Z|15
Z|16
Z|17""")
crossref_15 = CrossReference(ListA=panel_31, ListB=panel_32, CrossMode=1)  # -> ListA, ListB
panel_33 = Panel("""Z|16_Z|12
Z|16_Z|9
Z|13_Z|12
Z|13_Z|9
Z|12_Z|16
Z|9_Z|16
Z|12_Z|13
Z|9_Z|13""")
concat_15 = Concatenate(FragmentA=crossref_15.ListB, FragmentB="_", FragmentC=crossref_15.ListA)
panel_34 = Panel("""Z|16_Z|9
Z|13_Z|12
Z|12_Z|13
Z|9_Z|16""")
Y = Panel(concat_15)
ruletxt_18 = Wasp_RuleFromText(TXT=panel_34)  # -> R; plug-in component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
ruletxt_19 = Wasp_RuleFromText(TXT=Y)  # -> R; plug-in component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

# ----
# rules in Office
panel_35 = Panel("""N|2
N|3
O|0
O|1
P|0
P|1
P|2
P|3""")
panel_36 = Panel("""M|0
O|0
O|1
P|0
P|1
P|2
P|3""")
panel_37 = Panel("""M|0
N|2
N|3
O|0
O|1
P|0
P|1
P|2
P|3""")
panel_38 = Panel("""N|2
N|3""")
panel_39 = Panel("""M|0
N|2
N|3
O|0
O|1
P|0
P|1
P|2
P|3""")
panel_40 = Panel("""P|0
P|1
P|2
P|3""")
panel_41 = Panel("""O|0
O|1""")
crossref_16 = CrossReference(ListA=panel_35, ListB="M|0", CrossMode=1)  # -> ListA, ListB
crossref_17 = CrossReference(ListA=panel_36, ListB=panel_38, CrossMode=1)  # -> ListA, ListB
crossref_18 = CrossReference(ListA=panel_37, ListB=panel_40, CrossMode=1)  # -> ListA, ListB
crossref_19 = CrossReference(ListA=panel_39, ListB=panel_41, CrossMode=1)  # -> ListA, ListB
concat_16 = Concatenate(FragmentA=crossref_16.ListB, FragmentB="_", FragmentC=crossref_16.ListA)
concat_17 = Concatenate(FragmentA=crossref_17.ListB, FragmentB="_", FragmentC=crossref_17.ListA)
concat_18 = Concatenate(FragmentA=crossref_18.ListB, FragmentB="_", FragmentC=crossref_18.ListA)
concat_19 = Concatenate(FragmentA=crossref_19.ListB, FragmentB="_", FragmentC=crossref_19.ListA)
M = Panel(concat_16)
N = Panel(concat_17)
P = Panel(concat_18)
O = Panel(concat_19)
ruletxt_20 = Wasp_RuleFromText(TXT=M)  # -> R; plug-in component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
ruletxt_21 = Wasp_RuleFromText(TXT=N)  # -> R; plug-in component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
ruletxt_22 = Wasp_RuleFromText(TXT=P)  # -> R; plug-in component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
ruletxt_23 = Wasp_RuleFromText(TXT=O)  # -> R; plug-in component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
panel_42 = Panel("""P|13_Q|3
P|38_Q|2
Q|3_P|13
Q|2_P|38""")
p_q = Panel("""Q|2_Q|1
Q|3_Q|0
Q|1_Q|2
Q|0_Q|3
P|13_Q|3
P|38_Q|2
Q|3_P|13
Q|2_P|38""")
ruletxt_24 = Wasp_RuleFromText(TXT=p_q)  # -> R; plug-in component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
panel_43 = Panel("""P|8
P|9
P|10
P|11
P|12
P|13
P|14
P|15
P|16
P|17
P|18
P|19
P|20
P|21
P|22
P|23""")
panel_44 = Panel("""O|12
O|13
O|14
O|15
O|16
O|17
O|18
O|19
O|20
O|21
O|22
O|23
O|24
O|25""")
panel_45 = Panel("""O|12
O|13
O|14
O|15
O|16
O|17
O|18
O|19
O|20
O|21
O|22
O|23
O|24
O|25""")
panel_46 = Panel("""P|8
P|9
P|10
P|11
P|12
P|13
P|14
P|15
P|16
P|17
P|18
P|19
P|20
P|21
P|22
P|23""")
crossref_20 = CrossReference(ListA=panel_43, ListB=panel_44, CrossMode=1)  # -> ListA, ListB
crossref_21 = CrossReference(ListA=panel_45, ListB=panel_46, CrossMode=1)  # -> ListA, ListB
concat_20 = Concatenate(FragmentA=crossref_20.ListB, FragmentB="_", FragmentC=crossref_20.ListA)
concat_21 = Concatenate(FragmentA=crossref_21.ListB, FragmentB="_", FragmentC=crossref_21.ListA)
M_2 = Panel(concat_20)
M_3 = Panel(concat_21)
ruletxt_25 = Wasp_RuleFromText(TXT=M_2)  # -> R; plug-in component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
ruletxt_26 = Wasp_RuleFromText(TXT=M_3)  # -> R; plug-in component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
panel_47 = Panel("""O|2
O|3
O|4
O|5
O|6
O|7
O|8
O|9
O|10
O|11""")
panel_48 = Panel("""P|28
P|29
P|30
P|31
P|32
P|33
P|34
P|35
P|36
P|37
P|38
P|39
P|40
P|41
P|42
P|43
P|44
P|45
P|46
P|47
P|48
P|49
P|50
P|51
P|52""")
panel_49 = Panel("""O|2
O|3
O|4
O|5
O|6
O|7
O|8
O|9
O|10
O|11""")
panel_50 = Panel("""P|28
P|29
P|30
P|31
P|32
P|33
P|34
P|35
P|36
P|37
P|38
P|39
P|40
P|41
P|42
P|43
P|44
P|45
P|46
P|47
P|48
P|49
P|50
P|51
P|52""")
crossref_22 = CrossReference(ListA=panel_48, ListB=panel_47, CrossMode=1)  # -> ListA, ListB
crossref_23 = CrossReference(ListA=panel_49, ListB=panel_50, CrossMode=1)  # -> ListA, ListB
concat_22 = Concatenate(FragmentA=crossref_22.ListB, FragmentB="_", FragmentC=crossref_22.ListA)
concat_23 = Concatenate(FragmentA=crossref_23.ListB, FragmentB="_", FragmentC=crossref_23.ListA)
M_4 = Panel(concat_22)
M_5 = Panel(concat_23)
ruletxt_27 = Wasp_RuleFromText(TXT=M_4)  # -> R; plug-in component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
ruletxt_28 = Wasp_RuleFromText(TXT=M_5)  # -> R; plug-in component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
merge_6 = Merge(
    Data1=ruletxt_20,
    Data2=ruletxt_21,
    Data3=ruletxt_23,
    Data4=ruletxt_22,
    Data5=ruletxt_26,
    Data6=ruletxt_28,
    Data7=ruletxt_24,
    Data8=ruletxt_25,
    Data9=ruletxt_27)

# ----
# rules in Apartment <---> Office
panel_51 = Panel("""Z|0
Z|1
Z|2
Z|3
Z|4
Z|5
Z|6
Z|7""")
panel_52 = Panel("""P|0
P|1
P|2
P|3""")
panel_53 = Panel("""P|0
P|1
P|2
P|3""")
panel_54 = Panel("""Z|0
Z|1
Z|2
Z|3
Z|4
Z|5
Z|6
Z|7""")
crossref_24 = CrossReference(ListA=panel_52, ListB=panel_51, CrossMode=1)  # -> ListA, ListB
crossref_25 = CrossReference(ListA=panel_54, ListB=panel_53, CrossMode=1)  # -> ListA, ListB
concat_24 = Concatenate(FragmentA=crossref_24.ListB, FragmentB="_", FragmentC=crossref_24.ListA)
concat_25 = Concatenate(FragmentA=crossref_25.ListB, FragmentB="_", FragmentC=crossref_25.ListA)
B_4 = Panel(concat_24)
C_4 = Panel(concat_25)
ruletxt_29 = Wasp_RuleFromText(TXT=B_4)  # -> R; plug-in component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
ruletxt_30 = Wasp_RuleFromText(TXT=C_4)  # -> R; plug-in component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

merge_7 = Merge(Data1=ruletxt_13, Data2=ruletxt_17, Data3=ruletxt_14, Data4=ruletxt_15, Data5=ruletxt_16, Data6=ruletxt_18)
merge_8 = Merge(Data1=ruletxt_29, Data3=ruletxt_30)

# ----
# Input_rules
merge_9 = Merge(Data2=merge, Data3=merge_5, Data4=merge_7, Data5=merge_8, Data6=merge_2, Data7=merge_6)

panel_55 = Panel("""N|8
N|9
N|10
N|11
N|12
N|13
N|14
N|15
N|16
N|17
N|18
N|19
N|20
N|21""")
panel_56 = Panel("""O|2
O|3
O|4
O|5
O|6
O|7
O|8
O|9
O|10
O|11""")
panel_57 = Panel("""P|8
P|9
P|10
P|11
P|12
P|13
P|14
P|15
P|16
P|17
P|18
P|19
P|20
P|21
P|22
P|23""")
panel_58 = Panel("""M|1
M|2
M|3
M|4
M|5
M|6""")
crossref_26 = CrossReference(ListB=panel_55, CrossMode=1)  # -> ListA, ListB
crossref_27 = CrossReference(ListB=panel_56, CrossMode=1)  # -> ListA, ListB
crossref_28 = CrossReference(ListB=panel_57, CrossMode=1)  # -> ListA, ListB
crossref_29 = CrossReference(ListB=panel_58, CrossMode=1)  # -> ListA, ListB
concat_26 = Concatenate(FragmentA=crossref_26.ListB, FragmentB="_", FragmentC=crossref_26.ListA)
concat_27 = Concatenate(FragmentA=crossref_27.ListB, FragmentB="_", FragmentC=crossref_27.ListA)
concat_28 = Concatenate(FragmentA=crossref_28.ListB, FragmentB="_", FragmentC=crossref_28.ListA)
concat_29 = Concatenate(FragmentA=crossref_29.ListB, FragmentB="_", FragmentC=crossref_29.ListA)
M_6 = Panel(concat_26)
M_7 = Panel(concat_27)
M_8 = Panel(concat_28)
M_9 = Panel(concat_29)
ruletxt_31 = Wasp_RuleFromText(TXT=M_6)  # -> R; plug-in component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
ruletxt_32 = Wasp_RuleFromText(TXT=M_7)  # -> R; plug-in component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
ruletxt_33 = Wasp_RuleFromText(TXT=M_8)  # -> R; plug-in component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
ruletxt_34 = Wasp_RuleFromText(TXT=M_9)  # -> R; plug-in component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
merge_10 = Merge(Data1=ruletxt_34, Data2=ruletxt_31, Data3=ruletxt_32, Data4=ruletxt_33)
panel_59 = Panel("""N|22
N|23
N|24
N|25
N|26
N|27""")
panel_60 = Panel("""O|12
O|13
O|14
O|15
O|16
O|17
O|18
O|19
O|20
O|21
O|22
O|23
O|24
O|25""")
panel_61 = Panel("""P|28
P|29
P|30
P|31
P|32
P|33
P|34
P|35
P|36
P|37
P|38
P|39
P|40
P|41
P|42
P|43
P|44
P|45
P|46
P|47
P|48
P|49
P|50
P|51
P|52""")
panel_62 = Panel("""M|15
M|16
M|17
M|18
M|19
M|20
M|21
M|22
M|23
M|24""")
crossref_30 = CrossReference(ListB=panel_59, CrossMode=1)  # -> ListA, ListB
crossref_31 = CrossReference(ListB=panel_60, CrossMode=1)  # -> ListA, ListB
crossref_32 = CrossReference(ListB=panel_61, CrossMode=1)  # -> ListA, ListB
crossref_33 = CrossReference(ListB=panel_62, CrossMode=1)  # -> ListA, ListB
concat_30 = Concatenate(FragmentA=crossref_30.ListB, FragmentB="_", FragmentC=crossref_30.ListA)
concat_31 = Concatenate(FragmentA=crossref_31.ListB, FragmentB="_", FragmentC=crossref_31.ListA)
concat_32 = Concatenate(FragmentA=crossref_32.ListB, FragmentB="_", FragmentC=crossref_32.ListA)
concat_33 = Concatenate(FragmentA=crossref_33.ListB, FragmentB="_", FragmentC=crossref_33.ListA)
M_10 = Panel(concat_30)
M_11 = Panel(concat_31)
M_12 = Panel(concat_32)
M_13 = Panel(concat_33)
ruletxt_35 = Wasp_RuleFromText(TXT=M_10)  # -> R; plug-in component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
ruletxt_36 = Wasp_RuleFromText(TXT=M_11)  # -> R; plug-in component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
ruletxt_37 = Wasp_RuleFromText(TXT=M_12)  # -> R; plug-in component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
ruletxt_38 = Wasp_RuleFromText(TXT=M_13)  # -> R; plug-in component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
merge_11 = Merge(Data1=ruletxt_38, Data2=ruletxt_35, Data3=ruletxt_36, Data4=ruletxt_37)

# ----
# 4. Bathroom Pod
part_geometry_16 = Brep(<brep referenced from the Rhino model>)
connections_centers_16 = Point([<point referenced from the Rhino model> x3])
connections_x_axis_16 = Curve([<curve referenced from the Rhino model> x3])
points_16 = PointList(Points=connections_centers_16, Size=Slider(0.5, range=0..1))
part_name_16 = Panel("W")

# ----
# pods in Apartment
conndir_16 = Wasp_ConnectionFromDirection(GEO=part_geometry_16, CEN=connections_centers_16, UP=connections_x_axis_16)  # -> CONN, PLN_OUT; inputs GEO: Brep, CEN: list of Point3d, UP: list of Curve, T: list; plug-in component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

part_16 = Wasp_BasicPart(NAME=part_name_16, GEO=part_geometry_16, CONN=flatten(conndir_16.CONN))  # -> PART; inputs GEO: Mesh, CONN: list, COLL: Mesh, ATTR: list; plug-in component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

merge_12 = Merge(Data1=part_7, Data2=part_9, Data3=part_16, Data4=part_8, Data5=part_11)

# ----
# Input_pods
merge_13 = Merge(Data1=merge_4, Data2=merge_12, Data3=merge_3)

# ----
# field
number_slider_2 = Slider(10, range=0..100)
brep = Brep([<brep referenced from the Rhino model> x3])
wires = BrepWireframe(Brep=brep, Density=-1)
fieldpts = Wasp_FieldPoints(BOU=brep, RES=number_slider_2)  # -> PTS, COUNT; inputs BOU: list of GeometryBase; plug-in component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
preview = CustomPreview(Geometry=wires, Shader=ColourSwatch(SwatchColor=RGB(0, 0, 0)))
bbox = BoundingBox(Content=fieldpts.PTS, Plane=PlaneXY(0, 0, 0), UnionBox=True)  # -> Box, Box_2
pop3d = Populate3D(Region=bbox.Box, Count=Slider(5, range=0..10), Seed=Slider(22, range=0..100))
pull = PullPoint(Point=fieldpts.PTS, Geometry=pop3d, ClosestOnly=True)  # -> ClosestPoint, Distance
bnd = Bounds(Numbers=pull.Distance)
remap = RemapNumbers(Value=pull.Distance, Source=bnd, Target=Domain(0, 1))  # -> Mapped, Clipped

graph = GraphMapper(
    remap.Mapped,
    x0=0,
    x1=1,
    y0=0,
    y1=1,
    container_name="Gaussian",
    factor=0.2936870456,
    mean=0.427175343,
    sdev=0.1366479993)

field = Wasp_Field(BOU=brep, PTS=fieldpts.PTS, COUNT=fieldpts.COUNT, RES=number_slider_2, VAL=graph)  # -> FIELD; inputs BOU: list of GeometryBase, PTS: list of Point3d, COUNT: Vector3d, VAL: list; plug-in component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

# ----
# Visualize Field Isolines
number_slider_3 = Slider(0.226, range=0..1)
plane = ValueList({"XY": 0, "YZ": 1, "XZ": 2}, selected="YZ")
fieldiso = Wasp_FieldIsolines(FIELD=field, PLN=plane, t=graft(number_slider_3), ISO=Slider(0.758, range=0..1))  # -> CRV; plug-in component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
preview_2 = CustomPreview(Geometry=fieldiso, Shader=ColourSwatch(SwatchColor=RGB(255, 0, 0)))

# ----
# Visualize Field
gradient = Gradient(LowerLimit=0, UpperLimit=1, Parameter=graph, stops=[0: RGB(0, 128, 0), 0.5: RGB(255, 255, 0), 1: RGB(255, 0, 0)])
preview_3 = CustomPreview(Geometry=fieldpts.PTS, Shader=gradient)

# ----
# Aggregation
parts_num = Slider(50, range=0..200)
check_collisions = BooleanToggle(True)
reset = Button()
fieldaggregation = Wasp_FieldDrivenAggregation(
    PART=flatten(merge_13),
    N=parts_num,
    RULES=merge_9,
    FIELD=field,
    THRES=Slider(0.95, range=0..1),
    COLL=check_collisions,
    RESET=reset)  # -> PART_OUT; inputs PART: list, PREV: list, N: Int32, RULES: list, COLL: Boolean, MODE: Int32, RESET: Boolean; plug-in component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

depart = Wasp_DeconstructPart(PART=fieldaggregation)  # -> NAME, GEO, CONN, CONN_PLN, TR, CHILD, ATTR; inputs PART: list; plug-in component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

# ----
# output_Park
panel_63 = Panel("C")
tmatch = MatchText(Text=depart.NAME, Pattern=panel_63, Case=True)
tmatch_2 = MatchText(Text=depart.NAME, Pattern="D", Case=True)
tmatch_3 = MatchText(Text=depart.NAME, Pattern="B", Case=True)
tmatch_4 = MatchText(Text=depart.NAME, Pattern="E", Case=True)
tmatch_5 = MatchText(Text=depart.NAME, Pattern="F", Case=True)
tmatch_6 = MatchText(Text=depart.NAME, Pattern="A", Case=True)
cull = CullPattern(List=depart.GEO, CullPattern=tmatch_6)
cull_2 = CullPattern(List=depart.GEO, CullPattern=tmatch)
cull_3 = CullPattern(List=depart.GEO, CullPattern=tmatch_2)
cull_4 = CullPattern(List=depart.GEO, CullPattern=tmatch_4)
cull_5 = CullPattern(List=depart.GEO, CullPattern=tmatch_5)
cull_6 = CullPattern(List=depart.GEO, CullPattern=tmatch_3)
preview_4 = CustomPreview(Geometry=cull, Shader=ColourSwatch(SwatchColor=RGB(111, 218, 0)))  # disabled
preview_5 = CustomPreview(Geometry=cull_6, Shader=ColourSwatch(SwatchColor=RGB(117, 220, 75)))
preview_6 = CustomPreview(Geometry=cull_2, Shader=ColourSwatch(SwatchColor=RGB(59, 200, 126)))
preview_7 = CustomPreview(Geometry=cull_3, Shader=ColourSwatch(SwatchColor=RGB(167, 226, 60)))  # disabled
preview_8 = CustomPreview(Geometry=cull_4, Shader=ColourSwatch(SwatchColor=RGB(109, 200, 116)))
preview_9 = CustomPreview(Geometry=cull_5, Shader=ColourSwatch(SwatchColor=RGB(255, 236, 0)))  # disabled

# ----
# replace
part_a_detailed = Brep(<brep referenced from the Rhino model>)
part_b_detailed = Brep(<brep referenced from the Rhino model>)
part_b_detailed_2 = Brep(<brep referenced from the Rhino model>)
cull_7 = CullPattern(List=depart.TR, CullPattern=tmatch_2)
cull_8 = CullPattern(List=depart.TR, CullPattern=tmatch_6)
cull_9 = CullPattern(List=depart.TR, CullPattern=tmatch_5)
transform = Transform(Geometry=part_a_detailed, Transform=cull_7)
transform_2 = Transform(Geometry=part_b_detailed, Transform=cull_8)
transform_3 = Transform(Geometry=part_b_detailed_2, Transform=cull_9)
preview_10 = CustomPreview(Geometry=transform, Shader=ColourSwatch(SwatchColor=RGB(140, 220, 60)))
preview_11 = CustomPreview(Geometry=transform_2, Shader=ColourSwatch(SwatchColor=RGB(93, 162, 158)))
preview_12 = CustomPreview(Geometry=transform_3, Shader=ColourSwatch(SwatchColor=RGB(214, 255, 0)))

# ----
# output_Office
panel_64 = Panel("N")
tmatch_7 = MatchText(Text=depart.NAME, Pattern="M", Case=True)
tmatch_8 = MatchText(Text=depart.NAME, Pattern=panel_64, Case=True)
tmatch_9 = MatchText(Text=depart.NAME, Pattern="Q", Case=True)
tmatch_10 = MatchText(Text=depart.NAME, Pattern="O", Case=True)
tmatch_11 = MatchText(Text=depart.NAME, Pattern="P", Case=True)
cull_10 = CullPattern(List=depart.GEO, CullPattern=tmatch_7)
cull_11 = CullPattern(List=depart.GEO, CullPattern=tmatch_8)
cull_12 = CullPattern(List=depart.GEO, CullPattern=tmatch_9)
cull_13 = CullPattern(List=depart.GEO, CullPattern=tmatch_10)
cull_14 = CullPattern(List=depart.GEO, CullPattern=tmatch_11)
preview_13 = CustomPreview(Geometry=cull_10, Shader=ColourSwatch(SwatchColor=RGB(255, 0, 0)))  # disabled
preview_14 = CustomPreview(Geometry=cull_11, Shader=ColourSwatch(SwatchColor=RGB(236, 97, 129)))  # disabled
preview_15 = CustomPreview(Geometry=cull_13, Shader=ColourSwatch(SwatchColor=RGB(255, 225, 0)))  # disabled
preview_16 = CustomPreview(Geometry=cull_14, Shader=ColourSwatch(SwatchColor=RGB(255, 225, 0)))  # disabled
preview_17 = CustomPreview(Geometry=cull_12, Shader=ColourSwatch(SwatchColor=RGB(255, 187, 83)))  # disabled

# ----
# replace
part_a_detailed_2 = Brep(<brep referenced from the Rhino model>)
part_b_detailed_3 = Brep(<brep referenced from the Rhino model>)
part_b_detailed_4 = Brep(<brep referenced from the Rhino model>)
part_b_detailed_5 = Brep(<brep referenced from the Rhino model>)
part_b_detailed_6 = Brep(<brep referenced from the Rhino model>)
cull_15 = CullPattern(List=depart.TR, CullPattern=tmatch_7)
cull_16 = CullPattern(List=depart.TR, CullPattern=tmatch_8)
cull_17 = CullPattern(List=depart.TR, CullPattern=tmatch_10)
cull_18 = CullPattern(List=depart.TR, CullPattern=tmatch_11)
cull_19 = CullPattern(List=depart.TR, CullPattern=tmatch_9)
transform_4 = Transform(Geometry=part_a_detailed_2, Transform=cull_15)
transform_5 = Transform(Geometry=part_b_detailed_3, Transform=cull_16)
transform_6 = Transform(Geometry=part_b_detailed_4, Transform=cull_17)
transform_7 = Transform(Geometry=part_b_detailed_5, Transform=cull_18)
transform_8 = Transform(Geometry=part_b_detailed_6, Transform=cull_19)
preview_18 = CustomPreview(Geometry=transform_5, Shader=ColourSwatch(SwatchColor=RGB(255, 144, 77)))
preview_19 = CustomPreview(Geometry=transform_6, Shader=ColourSwatch(SwatchColor=RGB(255, 193, 83)))
preview_20 = CustomPreview(Geometry=transform_7, Shader=ColourSwatch(SwatchColor=RGB(248, 171, 85)))
preview_21 = CustomPreview(Geometry=transform_8, Shader=ColourSwatch(SwatchColor=RGB(255, 187, 83)))
preview_22 = CustomPreview(Geometry=transform_4, Shader=ColourSwatch(SwatchColor=RGB(255, 125, 78)))

# ----
# output_Park
panel_65 = Panel("Z")
tmatch_12 = MatchText(Text=depart.NAME, Pattern="Y", Case=True)
tmatch_13 = MatchText(Text=depart.NAME, Pattern="X", Case=True)
tmatch_14 = MatchText(Text=depart.NAME, Pattern=panel_65, Case=True)
tmatch_15 = MatchText(Text=depart.NAME, Pattern="W", Case=True)
tmatch_16 = MatchText(Text=depart.NAME, Pattern="V", Case=True)
cull_20 = CullPattern(List=depart.GEO, CullPattern=tmatch_14)
cull_21 = CullPattern(List=depart.GEO, CullPattern=tmatch_12)
cull_22 = CullPattern(List=depart.GEO, CullPattern=tmatch_15)
cull_23 = CullPattern(List=depart.GEO, CullPattern=tmatch_16)
cull_24 = CullPattern(List=depart.GEO, CullPattern=tmatch_13)
preview_23 = CustomPreview(Geometry=cull_20, Shader=ColourSwatch(SwatchColor=RGB(255, 0, 0)))  # disabled
preview_24 = CustomPreview(Geometry=cull_23, Shader=ColourSwatch(SwatchColor=RGB(236, 97, 129)))  # disabled
preview_25 = CustomPreview(Geometry=cull_24, Shader=ColourSwatch(SwatchColor=RGB(255, 225, 0)))  # disabled
preview_26 = CustomPreview(Geometry=cull_21, Shader=ColourSwatch(SwatchColor=RGB(236, 97, 129)))  # disabled
preview_27 = CustomPreview(Geometry=cull_22, Shader=ColourSwatch(SwatchColor=RGB(216, 107, 187)))

# ----
# replace
part_b_detailed_7 = Brep(<brep referenced from the Rhino model>)
part_b_detailed_8 = Brep(<brep referenced from the Rhino model>)
part_b_detailed_9 = Brep(<brep referenced from the Rhino model>)
part_a_detailed_3 = Brep(<brep referenced from the Rhino model>)
cull_25 = CullPattern(List=depart.TR, CullPattern=tmatch_12)
cull_26 = CullPattern(List=depart.TR, CullPattern=tmatch_13)
cull_27 = CullPattern(List=depart.TR, CullPattern=tmatch_14)
cull_28 = CullPattern(List=depart.TR, CullPattern=tmatch_16)
transform_9 = Transform(Geometry=part_a_detailed_3, Transform=cull_27)
transform_10 = Transform(Geometry=part_b_detailed_7, Transform=cull_25)
transform_11 = Transform(Geometry=part_b_detailed_8, Transform=cull_26)
transform_12 = Transform(Geometry=part_b_detailed_9, Transform=cull_28)
preview_28 = CustomPreview(Geometry=transform_10, Shader=ColourSwatch(SwatchColor=RGB(150, 113, 197)))
preview_29 = CustomPreview(Geometry=transform_11, Shader=ColourSwatch(SwatchColor=RGB(111, 165, 197)))
preview_30 = CustomPreview(Geometry=transform_9, Shader=ColourSwatch(SwatchColor=RGB(182, 111, 195)))
preview_31 = CustomPreview(Geometry=transform_12, Shader=ColourSwatch(SwatchColor=RGB(121, 117, 197)))
