# Grasshopper definition Arda_aggregation2.gh (Grasshopper 0.9.76)
# plug-ins: Python Interpreter

initial_geometry = ClusterInput()
waspsetup = Wasp_Setup(RUN=Toggle(True))  # -> log; inputs RUN: Boolean; plug-in component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
box = CenterBox(Base=PlaneXY(0, 0, 0), X=Slider(10, range=0..10), Y=Slider(5, range=0..10), Z=Slider(7, range=0..10))
debrep = DeconstructBrep(Brep=box)  # -> Faces, Edges, Vertices
item = ListItem(List=debrep.Faces, Index=0, Wrap=True)  # -> Item, Item1, Item2, Item3, Item4, Item5
panel = Panel(waspsetup)
area = Area(Geometry=item.Item)  # -> Area, Centroid
area_2 = Area(Geometry=item.Item1)  # -> Area, Centroid
area_3 = Area(Geometry=item.Item5)  # -> Area, Centroid
debrep_2 = DeconstructBrep(Brep=item.Item)  # -> Faces, Edges, Vertices
debrep_3 = DeconstructBrep(Brep=item.Item1)  # -> Faces, Edges, Vertices
debrep_4 = DeconstructBrep(Brep=item.Item5)  # -> Faces, Edges, Vertices
item_2 = ListItem(List=debrep_2.Edges, Index=0, Wrap=True)
item_3 = ListItem(List=debrep_3.Edges, Index=0, Wrap=True)
item_4 = ListItem(List=debrep_4.Edges, Index=1, Wrap=True)
curvepoint = PointOnCurve(item_2, parameter=0.5)
curvepoint_2 = PointOnCurve(item_3, parameter=0.5)
curvepoint_3 = PointOnCurve(item_4, parameter=0.5)
ln = Line(StartPoint=area.Centroid, EndPoint=curvepoint)
ln_2 = Line(StartPoint=area_2.Centroid, EndPoint=curvepoint_2)
ln_3 = Line(StartPoint=area_3.Centroid, EndPoint=curvepoint_3)
merge = Merge(Data1=area.Centroid, Data2=area_2.Centroid, Data3=area_3.Centroid)
merge_2 = Merge(Data1=ln, Data2=ln_2, Data3=ln_3)
conndir = Wasp_ConnectionFromDirection(GEO=box, CEN=merge, UP=merge_2)  # -> CONN, PLN_OUT; inputs GEO: Brep, CEN: list of Point3d, UP: list of Curve; plug-in component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
part_name = Panel("BOX")
part = Wasp_BasicPart(NAME=part_name, GEO=box, CONN=flatten(conndir.CONN))  # -> PART; inputs GEO: Mesh, CONN: list, COLL: Mesh, ATTR: list; plug-in component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
parts_num = Slider(310, range=0..1000)

# ---- group: rules
rule = Wasp_Rule(P1=part_name, C1=Slider(0, range=0..10), P2=part_name, C2=Slider(1, range=0..10))  # -> R; inputs C1: Int32, C2: Int32; plug-in component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
rule_2 = Wasp_Rule(P1=part_name, C1=Slider(2, range=0..10), P2=part_name, C2=Slider(1, range=0..10))  # -> R; inputs C1: Int32, C2: Int32; plug-in component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
rule_3 = Wasp_Rule(P1=part_name, C1=Slider(1, range=0..10), P2=part_name, C2=Slider(0, range=0..10))  # -> R; inputs C1: Int32, C2: Int32; plug-in component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
merge_3 = Merge(Data1=rule, Data2=rule_3, Data3=rule_2)

# ----
check_collisions = BooleanToggle(True)
reset = Button()
rndaggr = Wasp_StochasticAggregation(PART=flatten(part), N=parts_num, RULES=merge_3, COLL=check_collisions, RESET=reset)  # -> PART_OUT; inputs PART: list, PREV: list, N: Int32, RULES: list, COLL: Boolean, RESET: Boolean; plug-in component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
depart = Wasp_DeconstructPart(PART=rndaggr)  # -> NAME, GEO, CONN, CONN_PLN, TR, CHILD, ATTR; inputs PART: list; plug-in component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
preview = CustomPreview(Geometry=depart.GEO, Shader=ColourSwatch(SwatchColor=RGB(119, 255, 0)))
