# Grasshopper definition DWELLING SPACE STANDARD.gh (Grasshopper 1.0.7)

panel = Panel("BATH")

# ---- group: programme dimensions
program_dim_1 = Slider(1.5, range=0..20)
program_dim_2 = Slider(0.75, range=0..20)
voxel_size = Slider(0.15, range=0..2)
program_ht = Slider(0.6, range=0..10)

# ---- group: cube count
division = Division(A=program_dim_1, B=voxel_size)
division_2 = Division(A=program_dim_2, B=voxel_size)
division_3 = Division(A=program_ht, B=voxel_size)
panel_2 = Panel(division)
panel_3 = Panel(division_2)
panel_4 = Panel(division_3)
round = Round(Number=panel_2)  # -> Nearest, Floor, Ceiling
round_2 = Round(Number=panel_3)  # -> Nearest, Floor, Ceiling
round_3 = Round(Number=panel_4)  # -> Nearest, Floor, Ceiling
panel_5 = Panel(round.Nearest)
panel_6 = Panel(round_2.Nearest)
panel_7 = Panel(round_3.Nearest)

# ----
construct_point = ConstructPoint(XCoordinate=Slider(29, range=0..50), YCoordinate=Slider(0, range=0..50), ZCoordinate=0)
yz_plane = YZPlane(Origin=construct_point)
xz_plane = XZPlane(Origin=construct_point)
square = Square(Plane=xz_plane, Size=voxel_size, ExtentX=panel_5, ExtentY=panel_7)  # -> Cells, Points
square_2 = Square(Plane=construct_point, Size=voxel_size, ExtentX=panel_5, ExtentY=panel_6)  # -> Cells, Points
square_3 = Square(Plane=yz_plane, Size=voxel_size, ExtentX=panel_6, ExtentY=panel_7)  # -> Cells, Points

surface = Surface(square_3.Cells)
surface_2 = Surface(square.Cells)
surface_3 = Surface(square_2.Cells)
