# Grasshopper definition GH Density.gh (Grasshopper 1.0.7)
# plug-ins: ExcelReadWrite

file_path = FilePath("/Users/albertburgersII/Desktop/GH WORKBOOK.xlsx")
exceldynamicread = ExcelDynamicRead(ExcelFile=file_path, Connect=Toggle(True), SheetNum=Slider(1, range=0..10), DataRange="all")  # -> DataOutput, Message
panel = Panel(exceldynamicread.DataOutput)
