# Grasshopper definition GH.gh (Grasshopper 0.9.80)

# ---- group: Surface Input and Max Floor Height
surface = Slider(9, range=0..100)
number_slider = Slider(3, range=0..100)
sqrt = SquareRoot(Value=surface)

# ----
number_slider_2 = Slider(500, range=0..1000)

pt = Point(<point referenced from the Rhino model>)
vec = VectorXYZ(XComponent=sqrt, YComponent=0, ZComponent=0)  # -> Vector, Length
vec_2 = VectorXYZ(XComponent=0, YComponent=sqrt, ZComponent=0)  # -> Vector, Length
vec_3 = VectorXYZ(XComponent=0, YComponent=sqrt, ZComponent=0)  # -> Vector, Length
move = Move(Geometry=pt, Motion=vec_2.Vector)  # -> Geometry, Transform
vec_4 = VectorXYZ(XComponent=0, YComponent=0, ZComponent=number_slider)  # -> Vector, Length
vec_5 = VectorXYZ(XComponent=sqrt, YComponent=0, ZComponent=0)  # -> Vector, Length
move_2 = Move(Geometry=pt, Motion=vec.Vector)  # -> Geometry, Transform
move_3 = Move(Geometry=move_2.Geometry, Motion=vec_3.Vector)  # -> Geometry, Transform
move_4 = Move(Geometry=move.Geometry, Motion=vec_5.Vector)  # -> Geometry, Transform
ln = Line(StartPoint=pt, EndPoint=move.Geometry)
ln_2 = Line(StartPoint=pt, EndPoint=move_2.Geometry)
ln_3 = Line(StartPoint=move_2.Geometry, EndPoint=move_3.Geometry)
ln_4 = Line(StartPoint=move.Geometry, EndPoint=move_4.Geometry)
loft = Loft(Curves=[ln_4, ln_2], Options={Adjust=False, Closed=False, LoftEnds=0, LoftSimp=0, LoftType=0, Rebuild=10, Refit=0.01})

pt_2 = Point(<point referenced from the Rhino model>)
vec_6 = VectorXYZ(XComponent=number_slider_2, YComponent=0, ZComponent=0)  # -> Vector, Length
vec_7 = VectorXYZ(XComponent=0, YComponent=number_slider_2, ZComponent=0)  # -> Vector, Length
vec_8 = VectorXYZ(XComponent=0, YComponent=number_slider_2, ZComponent=0)  # -> Vector, Length
move_5 = Move(Geometry=pt_2, Motion=vec_7.Vector)  # -> Geometry, Transform
vec_9 = VectorXYZ(XComponent=0, YComponent=0, ZComponent=number_slider_2)  # -> Vector, Length
vec_10 = VectorXYZ(XComponent=number_slider_2, YComponent=0, ZComponent=0)  # -> Vector, Length
move_6 = Move(Geometry=pt_2, Motion=vec_6.Vector)  # -> Geometry, Transform
move_7 = Move(Geometry=move_6.Geometry, Motion=vec_8.Vector)  # -> Geometry, Transform
move_8 = Move(Geometry=move_5.Geometry, Motion=vec_10.Vector)  # -> Geometry, Transform
ln_5 = Line(StartPoint=pt_2, EndPoint=move_5.Geometry)
ln_6 = Line(StartPoint=pt_2, EndPoint=move_6.Geometry)
ln_7 = Line(StartPoint=move_6.Geometry, EndPoint=move_7.Geometry)
ln_8 = Line(StartPoint=move_5.Geometry, EndPoint=move_8.Geometry)
loft_2 = Loft(Curves=[ln_8, ln_6], Options={Adjust=False, Closed=False, LoftEnds=0, LoftSimp=0, LoftType=0, Rebuild=10, Refit=0.01})

extr = Extrude(Base=loft, Direction=vec_4.Vector)

series = Series(Start=0, Step=Slider(6, range=0..100), Count=Slider(59, range=0..100))
Z = UnitZ(Factor=series)
X = UnitX(Factor=series)
Y = UnitY(Factor=series)
move_9 = Move(Geometry=extr, Motion=X)  # -> Geometry, Transform
crossref = CrossReference(ListA=move_9.Geometry, ListB=Y, CrossMode=1)  # -> ListA, ListB
move_10 = Move(Geometry=crossref.ListA, Motion=crossref.ListB)  # -> Geometry, Transform
crossref_2 = CrossReference(ListA=move_10.Geometry, ListB=Z, CrossMode=1)  # -> ListA, ListB

extr_2 = Extrude(Base=loft_2, Direction=vec_9.Vector)
move_11 = Move(Geometry=crossref_2.ListA, Motion=crossref_2.ListB)  # -> Geometry, Transform
reduce = RandomReduce(List=move_11.Geometry, Reduction=Slider(267, range=0..1000), Seed=1)
