# Grasshopper definition GradientBake.gh (Grasshopper 0.9.76)

number_slider = Slider(20, range=0..100)
number_of_lines_ish = Slider(372, range=0..1000)
series = Series(Start=0, Step=1, Count=number_slider)
dom = ConstructDomain(DomainStart=0, DomainEnd=number_slider)
remap = RemapNumbers(Value=series, Source=dom, Target=Domain(0, 1))  # -> Mapped, Clipped
graph = GraphMapper(
    remap.Mapped,
    x0=0,
    x1=1,
    y0=0,
    y1=1,
    container_name="Bezier",
    cpx=[0, 0.3984851241, 0.5924243331, 1],
    cpy=[0, 0.4014490247, 0.5985505581, 1])
remap_2 = RemapNumbers(Value=graph, Source=Domain(0, 1), Target=dom)  # -> Mapped, Clipped
division = Division(A=number_of_lines_ish, B=2)
ma = MassAddition(Input=remap_2.Mapped)  # -> Result, PartialResults
division_2 = Division(A=ma.Result, B=division)
division_3 = Division(A=remap_2.Mapped, B=division_2)
rev = ReverseList(List=division_3)
repeat = RepeatData(Data="Black", Length=rev)
repeat_2 = RepeatData(Data="White", Length=division_3)
merge = Merge(Data1=repeat, Data2=repeat_2)  # -> flatten(Result)
lng = ListLength(List=merge)
series_2 = Series(Start=0, Step=1, Count=lng)
ln = Line(StartPoint=Point(0, 0, 0), EndPoint=Point(100, 0, 0))

# ---- group: Spacing between lines = 1. Add Expression to input to change
Y = UnitY(Factor=expr("x/4", series_2))

# ---- group: Put your own lines in here if you already have...
line = Line(ln)

# ----
move = Move(Geometry=line, Motion=Y)  # -> Geometry, Transform
preview = CustomPreview(Geometry=move.Geometry, Shader=merge)

# ---- group: Press this button to bake
c_script = CSharpScript(bake=Button(), curves=move.Geometry, color=merge)  # -> out; inputs bake: Boolean, curves: Curve, color: Color
# ---------- c_script: C# ----------
    if(bake){
      Rhino.DocObjects.ObjectAttributes att = new Rhino.DocObjects.ObjectAttributes();
      att.ColorSource = Rhino.DocObjects.ObjectColorSource.ColorFromObject;
      att.ObjectColor = color;

      doc.Objects.AddCurve(curves, att);
    }
# ---------- end c_script ----------
