# Grasshopper definition Morphocode-Rabbit-CA2d-Life-Conway-with-Memory.gh (Grasshopper 0.9.66)
# plug-ins: Rabbit

# ---- group: LEARN MORE AT HTTP://MORPHOCODE.COM
# Information
# MORPHOCODE.COM: In this case a 3D Structure is created using the memory of a 2D cellular automata.
# 
# CONWAY'S Game of life Rules:
# "This is the most famous cellular automata ever invented. People have been discovering patterns for this rule since around 1970. Large collections are available on the Internet.
# The rule definition is very simple: a living cell remains alive only when surrounded by 2 or 3 living neighbors,  otherwise it dies of loneliness or overcrowding. A dead cell comes to life when it has exactly 3 living neighbors.
# A rule by John Conway."
# http://psoup.math.wisc.edu/mcell/rullex_life.html
legend = Legend(Colour=[RGB(144, 238, 144), RGB(30, 144, 255)], Tags=["Click it.", "Play with it."], LegendType=1)

# ---- group: 2D Cellular Space
y_dimension = Slider(43, range=1..50)
x_dimension = Slider(50, range=1..51)
spacing = Slider(9, range=0..10)
sqgrid = Square(Plane=PlaneXY(0, 0, 0), Size=spacing, ExtentX=x_dimension, ExtentY=y_dimension)  # -> Cells, Points
pcen = PolygonCenter(Polyline=sqgrid.Cells)  # -> CenterV, CenterE

# ---- group: Initial Configuration / Popular Configurations
the_queen_bee_shuttle = Point([Point(211, 212, 0), Point(220, 212, 0), Point(231, 203, 0), Point(238, 195, 0), Point(237, 184, 0), Point(239, 174, 0), Point(229, 167, 0), Point(220, 159, 0), Point(209, 159, 0)])
r_pentonimo = Point([Point(221, 178, 0), Point(229, 175, 0), Point(230, 185, 0), Point(237, 185, 0), Point(228, 167, 0)])
die_hard = Point([Point(94, 149, 0), Point(103, 149, 0), Point(104, 140, 0), Point(140, 140, 0), Point(148, 140, 0), Point(158, 138, 0), Point(148, 158, 0)])
gliders = Point([Point(95, 274, 0), Point(103, 266, 0), Point(113, 266, 0), Point(105, 255, 0), Point(95, 257, 0), Point(337, 194, 0), Point(328, 183, 0), Point(317, 184, 0), Point(328, 176, 0), Point(336, 175, 0)])

# ---- group: Initial Configuration
custom = Point([Point(465.9230752, 240.8456072, 0), Point(467.8298635, 253.7693904, 0), Point(467.9398066, 260.3354176, 0), Point(469.6993842, 270.1290839, 0), Point(476.2306708, 269.8657665, 0)])
alive = Boolean(True)
c_state = CustomStateConfiguration(Points=die_hard, CustomInitialState=alive)

# ---- group: Evolution Rules
survive = Slider(2, range=0..10)
born = Slider(3, range=0..10)
survive_2 = Slider(3, range=0..10)
life_cell = LifeLikeCell(BornRulesNumberOfNeigbors=born, SurviveRulesNumberOfNeighbors=[survive, survive_2])

# ---- group: TIME CONTROLLER
timer = Timer(TimerInterval=500, Target=time)  # disabled
reset = BooleanToggle(False)
manual_time_control = Slider(26, range=0..200)
time = DiscreteTime(Reset=reset)
panel = Panel(time)

# ----
# Conway's Game Of Life with Memory
# MORPHOCODE.COM: START HERE: Run the timer to start the evolution!
# 
# During the evolution, some of the alive cells can die, while new cells can be born on the empty slots.
# MORPHOCODE.COM: Defining the cellular automaton: cell prototype, grid dimensions and initial configuration of the cell states.
# 
# Use the CONFIGURATION bellow to specify which cells are in 'alive' state.
# MORPHOCODE.COM: The 'Cell Components' component lists the corresponding point, cell state and moment of time for each cell.
# A filter is applied so that only Alive cells are listed.
# A box is created for each alive cell and is moved up depending on the time moment associated with the cell.
panel_2 = Panel(life_cell)
c_grid = CellularGrid(CellPrototype=life_cell, GridOfPoints=pcen.CenterV, StateConfiguration=c_state)
# TUTORIAL: CELLULAR AUTOMATA WITH RABBIT
# 
# MORE ABOUT CELLULAR AUTOMATA:
# http://morphocode.com/course/getting-started-rabbit/
# 
# VISIT US FOR MORE:
# http://morphocode.com
# 
# LICENSE:
# http://creativecommons.org/licenses/by-nc-sa/3.0/us/
ca_evolver = CAEvolver(DiscreteTime=manual_time_control, CellularAutomata=c_grid)  # -> CAConfiguration, Memory

# ---- group: Create Box For Each Alive Cell
list = ValueList({"Dead": false, "Alive": true}, selected="Alive")
cells = ListCells(CellularAutomatonConfiguration=ca_evolver.Memory, FilterState=list)  # -> PointCellS, CellState, Time
box_height = Slider(4, range=0..10)
multiplication = Multiplication(A=cells.Time, B=box_height)
Z = UnitZ(Factor=multiplication)
move = Move(Geometry=cells.PointCellS, Motion=Z)  # -> Geometry, Transform
box_height_2 = Slider(2, range=0..10)
box_depth = Slider(4.5, range=0..10)
box_width = Slider(4.5, range=0..10)
box = CenterBox(Base=move.Geometry, X=box_width, Y=box_depth, Z=box_height_2)
