# Grasshopper definition Morphocode-Rabbit-CA2d-Life-Conway-with-Memory_autosave_autosave2.gh (Grasshopper 1.0.7)
# plug-ins: Kangaroo Components, Firefly_X, VoxelTools, Rabbit

# ---- group: LEARN MORE AT HTTP://MORPHOCODE.COM
# Information
# MORPHOCODE.COM: Defining the cellular automaton: cell prototype, grid dimensions and initial configuration of the cell states.
# 
# Use the CONFIGURATION bellow to specify which cells are in 'alive' state.
# MORPHOCODE.COM: In this case a 3D Structure is created using the memory of a 2D cellular automata.
# 
# CONWAY'S Game of life Rules:
# "This is the most famous cellular automata ever invented. People have been discovering patterns for this rule since around 1970. Large collections are available on the Internet.
# The rule definition is very simple: a living cell remains alive only when surrounded by 2 or 3 living neighbors,  otherwise it dies of loneliness or overcrowding. A dead cell comes to life when it has exactly 3 living neighbors.
# A rule by John Conway."
# http://psoup.math.wisc.edu/mcell/rullex_life.html
legend = Legend(Colour=[RGB(144, 238, 144), RGB(30, 144, 255)], Tags=["Click it.", "Play with it."], LegendType=1)

# ---- group: 2D Cellular Space
y_dimension = Slider(10, range=1..50)
x_dimension = Slider(10, range=1..51)
spacing = Slider(1.2, range=0..10)
sqgrid = Square(Plane=PlaneXY(0, 0, 0), Size=spacing, ExtentX=x_dimension, ExtentY=y_dimension)  # -> Cells, Points
pcen = PolygonCenter(Polyline=sqgrid.Cells)  # -> CenterV, CenterE

# ---- group: Initial Configuration / Popular Configurations
the_queen_bee_shuttle = Point([Point(36.33837962, 22.74956859, 0), Point(38.4103104, 20.89576259, 0), Point(35.19787442, 21.28175702, 0), Point(37.18728912, 20.11844564, 0), Point(33.48008224, 23.02557471, 0), Point(38.80673952, 19.70889213, 0)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])
r_pentonimo = Point([Point(221, 178, 0), Point(229, 175, 0), Point(230, 185, 0), Point(237, 185, 0), Point(228, 167, 0)])
die_hard = Point([Point(94, 149, 0), Point(103, 149, 0), Point(104, 140, 0), Point(140, 140, 0), Point(148, 140, 0), Point(158, 138, 0), Point(148, 158, 0)])
gliders = Point([Point(95, 274, 0), Point(103, 266, 0), Point(113, 266, 0), Point(105, 255, 0), Point(95, 257, 0), Point(337, 194, 0), Point(328, 183, 0), Point(317, 184, 0), Point(328, 176, 0), Point(336, 175, 0)])

# ---- group: Evolution Rules
survive = Slider(2, range=0..10)
born = Slider(1, range=0..10)
survive_2 = Slider(3, range=0..10)
life_cell = LifeLikeCell(BornRulesNumberOfNeigbors=born, SurviveRulesNumberOfNeighbors=[survive, survive_2])

# ----
pt = Point(Point(5.405602421, 5.505327714, 0))

# ---- group: Initial Configuration
custom = Point()
alive = Boolean(True)
c_state = CustomStateConfiguration(Points=pt, CustomInitialState=alive)

# ----
Z = UnitZ(Factor=Slider(1.2, range=0..10))
move = Move(Geometry=sqgrid.Cells, Motion=Z)  # -> Geometry, Transform
# Conway's Game Of Life with Memory
panel = Panel(life_cell)
c_grid = CellularGrid(CellPrototype=life_cell, GridOfPoints=pcen.CenterV, StateConfiguration=c_state)
xy_plane = XYPlane(Origin=Point(0, 0, 0))

# ---- group: TIME CONTROLLER
# MORPHOCODE.COM: START HERE: Run the timer to start the evolution!
# 
# During the evolution, some of the alive cells can die, while new cells can be born on the empty slots.
timer = Timer(TimerInterval=500, Target=time)  # disabled
manual_time_control = Slider(10, range=0..200)
time = DiscreteTime(Reset=Toggle(True))
panel_2 = Panel(time)

# ---- group: Retail
brep = Brep(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)  # disabled

brep_2 = Brep(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)  # disabled

brep_3 = Brep(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)  # disabled

brep_4 = Brep(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)  # disabled

brep_5 = Brep(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)  # disabled

brep_6 = Brep(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)  # disabled

brep_7 = Brep(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)  # disabled

# ----
solid_union = SolidUnion(Breps=[brep_5, brep, brep_3, brep_7, brep_4, brep_2, brep_6])  # disabled

# ----
# TUTORIAL: CELLULAR AUTOMATA WITH RABBIT
# 
# MORE ABOUT CELLULAR AUTOMATA:
# http://morphocode.com/course/getting-started-rabbit/
# 
# VISIT US FOR MORE:
# http://morphocode.com
# 
# LICENSE:
# http://creativecommons.org/licenses/by-nc-sa/3.0/us/
ca_evolver = CAEvolver(DiscreteTime=manual_time_control, CellularAutomata=c_grid)  # -> CAConfiguration, Memory

xy_plane_2 = XYPlane(Origin=Point(0, 0, 0))  # disabled
box = Box({Plane=PlaneXY(-38.02261219, -21.63326362, 0), X=Domain(0, 49.51774281), Y=Domain(0, 58.10195767), Z=Domain(0, 33.72050103)})  # disabled
bounding_box = BoundingBox(Content=solid_union, Plane=xy_plane_2)  # -> Box, Box_2; disabled

# ---- group: Create Box For Each Alive Cell
list = ValueList({"Dead": false, "Alive": true}, selected="Dead")
# MORPHOCODE.COM: The 'Cell Components' component lists the corresponding point, cell state and moment of time for each cell.
# A filter is applied so that only Alive cells are listed.
# A box is created for each alive cell and is moved up depending on the time moment associated with the cell.
cells = ListCells(CellularAutomatonConfiguration=ca_evolver.Memory, FilterState=list)  # -> PointCellS, CellState, Time
box_height = Slider(1.2, range=0..10)
multiplication = Multiplication(A=cells.Time, B=box_height)
Z_2 = UnitZ(Factor=multiplication)
move_2 = Move(Geometry=cells.PointCellS, Motion=Z_2)  # -> Geometry, Transform
box_height_2 = Slider(0.6, range=0..10)
box_depth = Slider(0.6, range=0..10)
box_width = Slider(0.6, range=0..10)
box_2 = CenterBox(Base=move_2.Geometry, X=box_width, Y=box_depth, Z=box_height_2)

# ----
number_slider = Slider(8, range=0..30)  # disabled
number_slider_2 = Slider(3, range=0..30)  # disabled
number_slider_3 = Slider(6, range=0..30)  # disabled

brep_8 = Brep(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)  # disabled
number_slider_4 = Slider(2, range=0..10)  # disabled
division = Division(A=number_slider_3, B=number_slider_4)  # disabled
division_2 = Division(A=number_slider_2, B=number_slider_4)  # disabled
division_3 = Division(A=number_slider, B=number_slider_4)  # disabled
number_slider_5 = Slider(0, range=0..100)  # disabled
list_item = ListItem(Index=number_slider_5, Wrap=True)  # disabled
center_box = CenterBox(Base=list_item, X=division, Y=division_3, Z=division_2)  # disabled
center_box_2 = CenterBox(Base=PlaneXY(0, 0, 0), X=division, Y=division_3, Z=division_2)  # disabled
box_rectangle = BoxRectangle(Height=Domain(0, 10))  # disabled

number_slider_6 = Slider(500, range=0..1000)

# ---- group: Count time steps
# MAKE INDIVIDUAL SCRIPTS
# 
# Amount of time steps cant be limited to the amount of users. Now all the amount of pods is limited to a ‘random’ 240
boolean_toggle = BooleanToggle(True)
timer_2 = Timer(TimerInterval=100, Target=counter)
amount_of_time_steps = Panel("240")
counter = Counter(Reset=boolean_toggle)
modulus = Modulus(A=counter, B=amount_of_time_steps)
panel_3 = Panel(modulus)

# ----
pt_2 = Point(Point(0, 0, 0))
box_3 = CenterBox(Base=pt_2, X=number_slider_6, Y=number_slider_6, Z=number_slider_6)
xy_plane_3 = XYPlane(Origin=Point(0, 0, 0))
number_slider_7 = Slider(120, range=0..120)
bounding_box_2 = BoundingBox(Content=box_3, Plane=xy_plane_3)  # -> Box, Box_2
pt_3 = Point(Point(0, 0, 0))
brep_9 = Brep(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)
brep_10 = Brep(brep_9)
bounding_box_3 = BoundingBox(Content=brep_10, Plane=xy_plane)  # -> Box, Box_2
custom_preview = CustomPreview(Geometry=brep_10, Shader=ColourSwatch(SwatchColor=RGBA(191, 196, 153, 50)))  # disabled
createcrid = CreateCrid(
    BoundingBox=bounding_box_3.Box,
    SizeX=Slider(1.2, range=0..30),
    SizeY=Slider(1.2, range=0..30),
    SizeZ=Slider(1.2, range=0..30))
voxelategeometry = VoxelateGeometry(Geometry=brep_10, VoxelGrid=createcrid, Distance=0)
voxelgridboxes = VoxelGridBoxes(VoxelGrid=voxelategeometry)  # -> Boxes, Points

amount_of_users = Slider(200, range=0..10000)  # disabled
list_length = ListLength(List=voxelgridboxes.Boxes)  # disabled
subtraction = Subtraction(A=list_length, B=panel_3)  # disabled
panel_4 = Panel(list_length)  # disabled
panel_5 = Panel(subtraction)  # disabled
random_reduce = RandomReduce(List=voxelgridboxes.Boxes, Reduction=subtraction, Seed=1)  # disabled

scavoxcreate = CreateScalarGrid(BoundingBox=brep_9, SizeX=pt_3, SizeY=pt_3, SizeZ=pt_3)
collision_one_many = CollisionOneMany(Collider=center_box_2, Obstacles=solid_union)  # -> Collision, Index; disabled
box_4 = CenterBox(Base=pt_2, X=number_slider_7, Y=number_slider_7, Z=number_slider_7)
createcrid_2 = CreateCrid(BoundingBox=bounding_box_2.Box, SizeX=number_slider_7, SizeY=number_slider_7, SizeZ=number_slider_7)
vg = VoxelGrid()
cull_pattern = CullPattern(List=center_box_2, CullPattern=collision_one_many.Collision)  # disabled
vg_2 = VoxelGrid()
xy_plane_4 = XYPlane(Origin=Point(0, 0, 0))
voxgeo = VoxelateGeometry(Geometry=brep_9, VoxelGrid=scavoxcreate, Distance=0)
brep_11 = Brep(brep_9)
brep_12 = Brep(box_2)
debox = DeconstructBox(Box=box_2)  # -> Plane, X, Y, Z
voxelategeometry_2 = VoxelateGeometry(Geometry=box_4, VoxelGrid=createcrid_2, Distance=0)
debox_2 = DeconstructBox(Box=brep_9)  # -> Plane, X, Y, Z

# ---- group: EDUCATION
colour_swatch = ColourSwatch(SwatchColor=RGB(191, 196, 40))  # disabled

# ----
voxelgridboxes_2 = VoxelGridBoxes(VoxelGrid=voxelategeometry_2)  # -> Boxes, Points
custom_preview_2 = CustomPreview(Geometry=brep_11, Shader=ColourSwatch(SwatchColor=RGBA(191, 196, 153, 50)))  # disabled
bounding_box_4 = BoundingBox(Content=brep_11, Plane=xy_plane_4)  # -> Box, Box_2
panel_6 = Panel(debox_2.Plane)
panel_7 = Panel(debox.Plane)
custom_preview_3 = CustomPreview(Geometry=random_reduce, Shader=colour_swatch)  # disabled

createcrid_3 = CreateCrid(
    BoundingBox=bounding_box_4.Box,
    SizeX=Slider(1.2, range=0..30),
    SizeY=Slider(1.2, range=0..30),
    SizeZ=Slider(1.2, range=0..30))
voxelategeometry_3 = VoxelateGeometry(Geometry=brep_11, VoxelGrid=createcrid_3, Distance=0)
voxelgridboxes_3 = VoxelGridBoxes(VoxelGrid=voxelategeometry_3)  # -> Boxes, Points

brep_13 = Brep(debox.X)
box_5 = CenterBox(Base=voxelgridboxes_2.Points, X=number_slider_7, Y=number_slider_7, Z=number_slider_7)
brep_14 = Brep(voxelgridboxes_2.Boxes)

# ---- group: EDUCATION
colour_swatch_2 = ColourSwatch(SwatchColor=RGB(191, 196, 40))

# ----
panel_8 = Panel(voxelgridboxes_3.Points)
custom_preview_4 = CustomPreview(Geometry=debox.Plane, Shader=colour_swatch_2)  # disabled
number_slider_8 = Slider(-250, range=-500..500)  # disabled
number_slider_9 = Slider(-250, range=-500..500)  # disabled

# ---- group: EDUCATION
colour_swatch_3 = ColourSwatch(SwatchColor=RGB(191, 196, 40))  # disabled

# ----
vec = VectorXYZ(XComponent=number_slider_8, YComponent=number_slider_9, ZComponent=0)  # -> Vector, Length; disabled
cluster = Cluster(path="\\Mac\Home\Downloads\3Dmove 19-01-10 objects coordinates.csv")  # disabled
cluster_2 = Cluster(path="\\Mac\Home\Downloads\3Dmove 19-01-10 objects coordinates.csv")  # disabled
collision_one_many_2 = CollisionOneMany(Collider=box_2, Obstacles=voxelgridboxes_3.Boxes)  # -> Collision, Index
custom_preview_5 = CustomPreview(Geometry=voxelgridboxes_3.Boxes, Shader=colour_swatch_3)  # disabled
number_slider_10 = Slider(4, range=0.1..10)  # disabled
number_slider_11 = Slider(4, range=0.1..10)  # disabled
number_slider_12 = Slider(4, range=0.1..10)  # disabled
division_4 = Division(A=4, B=2)  # disabled
box_6 = CenterBox(Base=cluster_2, X=division_4, Y=division_4, Z=division_4)  # disabled
item = ListItem(List=collision_one_many_2.Collision, Index=0, Wrap=True)
panel_9 = Panel(item)
brep_15 = Brep(collision_one_many_2.Collision)
cull_pattern_2 = CullPattern(List=box_2, CullPattern=collision_one_many_2.Collision)
box_7 = CenterBox(Base=cluster, X=number_slider_10, Y=number_slider_12, Z=number_slider_11)  # disabled
invert = Invert(BitmapToModify=Toggle(False))
panel_10 = Panel(invert)
number_slider_13 = Slider(3, range=0..10)  # disabled
move_3 = Move(Geometry=cluster, Motion=vec.Vector)  # -> Geometry, Transform; disabled
move_4 = Move(Geometry=box_7, Motion=vec.Vector)  # -> Geometry, Transform; disabled
move_5 = Move(Geometry=vec.Vector, Motion=box_6)  # -> Geometry, Transform; disabled
scale = Scale(Geometry=move_4.Geometry, Center=move_3.Geometry, Factor=number_slider_13)  # -> Geometry, Transform; disabled
preview = CustomPreview(
    Geometry=simplify(graft(move_5.Geometry)),
    Material=simplify(graft(Tree({0}: [{diffuse=RGB(176, 48, 71), emission=RGB(176, 48, 71), shine=0, specular=RGB(176, 48, 71), transparency=0}], {1}: [{diffuse=RGB(82, 42, 66), emission=RGB(82, 42, 66), shine=0, specular=RGB(82, 42, 66), transparency=0}], {2}: [{diffuse=RGB(52, 51, 61), emission=RGB(52, 51, 61), shine=0, specular=RGB(52, 51, 61), transparency=0}], {3}: [{diffuse=RGB(166, 124, 0), emission=RGB(166, 124, 0), shine=0, specular=RGB(166, 124, 0), transparency=0}], {4}: [{diffuse=RGB(82, 42, 66), emission=RGB(82, 42, 66), shine=0, specular=RGB(82, 42, 66), transparency=0}], {5}: [{diffuse=RGB(166, 124, 0), emission=RGB(166, 124, 0), shine=0, specular=RGB(166, 124, 0), transparency=0}]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))))  # disabled
preview_2 = CustomPreview(
    Geometry=simplify(graft(move_4.Geometry)),
    Material=simplify(graft(Tree({0}: [{diffuse=RGB(82, 42, 66), emission=RGB(82, 42, 66), shine=0, specular=RGB(82, 42, 66), transparency=0}], {1}: [{diffuse=RGB(166, 124, 0), emission=RGB(166, 124, 0), shine=0, specular=RGB(166, 124, 0), transparency=0}], {2}: [{diffuse=RGB(145, 65, 38), emission=RGB(145, 65, 38), shine=0, specular=RGB(145, 65, 38), transparency=0}], {3}: [{diffuse=RGB(176, 48, 71), emission=RGB(176, 48, 71), shine=0, specular=RGB(176, 48, 71), transparency=0}], {4}: [{diffuse=RGB(13, 122, 128), emission=RGB(13, 122, 128), shine=0, specular=RGB(13, 122, 128), transparency=0}], {5}: [{diffuse=RGB(189, 77, 17), emission=RGB(189, 77, 17), shine=0, specular=RGB(189, 77, 17), transparency=0}]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))))  # disabled
bbox = BoundingBox(Content=scale.Geometry, Plane=PlaneXY(0, 0, 0))  # -> Box, Box_2; disabled
education = ColourSwatch(SwatchColor=RGBA(191, 196, 153, 8))  # disabled
box_8 = EvaluateBox(Box=bbox.Box, UParameter=0.5, VParameter=0.5, WParameter=0.5)  # -> Plane, Point, Include; disabled
number_slider_14 = Slider(10, range=0..10)  # disabled
sph = Sphere(Base=box_8.Point, Radius=number_slider_14)  # disabled
preview_3 = CustomPreview(Geometry=sph, Material=education)  # disabled

# ==== cluster Cluster
path = ClusterInput()
path_2 = FilePath(path)
file = ReadFile(File=path_2, PerLineParse=True)
split = TextSplit(Text=file, Separators=";")  # -> simplify(flatten(Result))
R = ClusterOutput(split)
