# Grasshopper definition Testing shit.gh (Grasshopper 1.0.7)

rndm_values = GhPythonScript()  # -> a; inputs x: list of Point3d; disabled
# ---------- rndm_values: Python ----------
__author__ = "thomm"
__version__ = "2018.12.03"

import rhinoscriptsyntax as rs
from random import randint 

#for point in range(len(x)):
a = [randint(0,5000) for point in range(len(x))]


#x = [randint(0, 9) for p in range(0, 10)]
# ---------- end rndm_values ----------
box = Box({Plane=PlaneXY(0, 0, 0), X=Domain(0, 50), Y=Domain(0, 50), Z=Domain(0, 50)})
box_2 = GhPythonScript()  # -> a; disabled
# ---------- box_2: Python ----------
__author__ = "thomm"
__version__ = "2018.12.03"

import rhinoscriptsyntax as rs
import Grasshopper as gh

# Make a 3D box

O = 0
x = 50
y = 50
z = 50

corners = []

OriginPt = (O,0,0)      # Pt0
corners.append(OriginPt)
Pt1 = (x,0,0)           #Pt1 (+x,0,0)
corners.append(Pt1)
BasePt = (x,y,0)       #Pt2 (+x,+y,0)
corners.append(BasePt)
Pt3 = (0,y,0)           #Pt3 (0,+y,0)
corners.append(Pt3)
Pt7 = (0,0,z)
corners.append(Pt7)
Pt5 = (x,0,z)          #Pt5 (+x,0,+z)
corners.append(Pt5)
HeightPt = (x,y,z)     #Pt4 (+x,+y,+z)
corners.append(HeightPt)
Pt6 = (0,y,z)          #Pt6 (0,+y,+z)
corners.append(Pt6)

Box = rs.AddBox(corners)

a = Box
# ---------- end box_2 ----------
pop3d = Populate3D(Region=box_2, Count=Slider(10, range=0..10), Seed=Slider(4, range=0..10))  # disabled
pop3d_2 = Populate3D(Region=box, Count=Slider(10, range=0..10), Seed=Slider(4, range=0..10))  # disabled
python = PythonScript()  # -> uniquePts, duplPts, duplPtsIndexes; inputs pts: list of Point3d; disabled
# ---------- python: Python ----------
import Rhino

def CullDuplPts(pts,t):

    duplPtsIndexes = []
    for i in range(len(pts)):
        for k in range(len(pts)):
            if (i != k) and (i not in duplPtsIndexes) and (k not in duplPtsIndexes) and \
            (pts[i].EpsilonEquals(pts[k], t)):
                duplPtsIndexes.append(i)
    
    uniquePtsIndexes = range(len(pts))
    duplPts = []
    uniquePts = []
    for index1 in duplPtsIndexes:
        duplPts.append(pts[index1])
    for index2 in uniquePtsIndexes:
        if index2 not in duplPtsIndexes:
            uniquePts.append(pts[index2])
    
    return duplPtsIndexes, duplPts, uniquePts

if not t:
    t = Rhino.RhinoDoc.ActiveDoc.ModelAbsoluteTolerance

duplPtsIndexes, duplPts, uniquePts = CullDuplPts(pts,t)
# ---------- end python ----------
clst_pts = GhPythonScript()  # -> out, a; inputs x: list of Point3d, y: list of Point3d; disabled
# ---------- clst_pts: Python ----------
__author__ = "thomm"
__version__ = "2018.12.03"

import rhinoscriptsyntax as rs

temp = []


for item in range(len(x)):
    tol = 15
    for j in range(len(y)):
        if abs((y[j][0])-(x[item][0]))< tol and abs((y[j][1])-(x[item][1]))< tol and abs((y[j][2])-(x[item][2])) < tol:
            temp.append(x[item])

a = temp
# ---------- end clst_pts ----------
panel = Panel(clst_pts.a)

# ---- group: Finding location in the city which meets the Intensity desire per object
_10_random_points = Data([Point(40.79722634, 49.5499915, 28.19873257), Point(4.441313657, 1.970598359, 46.81578274), Point(31.73384032, 5.382998709, 7.564641376), Point(1.914955607, 39.27543824, 42.39608699), Point(48.51214776, 10.78586833, 40.77693515), Point(2.044474148, 21.84181638, 6.443520406), Point(20.10134532, 45.44494524, 3.638843006), Point(41.49857713, 32.04825906, 9.283106173), Point(45.46523506, 36.63520107, 48.69043443), Point(25.50355332, 24.72184858, 29.11545498)])
sph = Sphere(Base=_10_random_points, Radius=Slider(1, range=0..10))
preview = CustomPreview(Geometry=sph, Material=ColourSwatch(SwatchColor=RGB(255, 255, 255)))
pt_grid = GhPythonScript(size=Slider(50, range=0..1000), points=Slider(10, range=0..100))  # -> out, a; inputs size: Int32, points: Int32
# ---------- pt_grid: Python ----------
__author__ = "thomm"
__version__ = "2018.12.03"

import rhinoscriptsyntax as rs
import Grasshopper as gh
from Rhino import Geometry as rg


# Make a 3D box

O = 0
Pts = O + (points + 1)
n = size/points

GridPt = []


for i in range(O, Pts):
    for j in range(O, Pts):
        for k in range(O, Pts):
            Pts1 = rs.AddPoint((n*i,n*j,n*k))
            GridPt.append(Pts1)


a = GridPt
# ---------- end pt_grid ----------
location_coords_per_object = Panel(_10_random_points)
all_grid_points = Panel(pt_grid.a)
random_intensity_gradient = Data([4518, 1839, 4349, 1605, 940, 1210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])
intensity_per_grid_point = Panel(random_intensity_gradient)
intensity_desire_per_object = Panel("""1074
1083
400
330
4521
532
1492
3591
2963
10""")
pre_selection = GhPythonScript(x=simplify(intensity_per_grid_point), y=simplify(graft(intensity_desire_per_object)), z=all_grid_points)  # -> out, simplify(a); inputs x: list of Int32, y: list of Int32, z: list of Point3d
# ---------- pre_selection: Python ----------
__author__ = "thomm"
__version__ = "2018.12.03"

import rhinoscriptsyntax as rs
import math 

CoordPt = []
Coords = []
CoordZ = []


for value in range(len(y)):
    for index in range(len(x)):
        tol = 10
        if abs(y[value] - x[index]) < tol:
            CoordPt.append(index)

for Pt in range(len(CoordPt)):
    for item in range(len(z)):
        if item == CoordPt[Pt]:
            CoordZ.append(z[item])

a = CoordZ
# ---------- end pre_selection ----------
giving_coords = GhPythonScript(CoordZ=pre_selection.a, u=graft(location_coords_per_object))  # -> out, simplify(a); inputs CoordZ: list of Point3d, u: list of Point3d
# ---------- giving_coords: Python ----------
__author__ = "thomm"
__version__ = "2018.12.03"

import rhinoscriptsyntax as rs
import math 


Dist = [] 
DestPt = []


for item in range(len(u)):
    for point in range(len(CoordZ)):
        distance = math.sqrt((u[item][0] - CoordZ[point][0])**2 + (u[item][1] - CoordZ[point][1])**2 + (u[item][2] - CoordZ[point][2])**2)
        Dist.append(distance)
    for element in range(len(Dist)):
        smallest = sorted(Dist, key=float) 
        if smallest[0] == Dist[element]:
            DestPt.append(CoordZ[element])

a = DestPt
# ---------- end giving_coords ----------
coords_for_intensity_desire = Panel(giving_coords.a)
