# Grasshopper definition bakecolor.ghx (Grasshopper 0.8.1)

gradient = Gradient(LowerLimit=0, UpperLimit=1, stops=[0: None, 0: None])
geo = Geometry()
bake = BooleanToggle(False)
simplebake = CSharpScript(obj=geo, name="Name_object", layer="LayerName", color=gradient, activate=bake)  # -> out; inputs obj: GeometryBase, name: String, layer: String, color: Color, activate: Boolean
# ---------- simplebake: C# ----------
    //Inserts geometry into the Rhino document, with custom attributes
    //Written by Giulio Piacentino - rewritten by [uto] for GH 07
    //Version written 2010 09 27 - for Grasshopper 0.7.0055

    if(obj == null) return;
    if(activate){
      
      //Make new attribute
      Rhino.DocObjects.ObjectAttributes att = new Rhino.DocObjects.ObjectAttributes();
      Guid o_id = default(Guid);

      //Set object name
      if(name != null && Rhino.DocObjects.LayerInfo.IsValidName(name) == true)
      {
        att.Name = name;
      }

      //Set layer
      if(layer != null && Rhino.DocObjects.LayerInfo.IsValidName(layer) == true){
        //Get the current layer index

        Rhino.DocObjects.Tables.LayerTable layerTable = doc.Layers;
        int layerIndex = layerTable.Find(layer, true);
        if(layerIndex == -1){ //This layer does not exist, we add it
          //make new layer
          Rhino.DocObjects.LayerInfo myLayer = new Rhino.DocObjects.LayerInfo();
          myLayer.Name = layer;
          //Add the layer to the layer table
          layerIndex = layerTable.Add(myLayer);

          if( layerIndex > -1 ){ //We manged to add layer!
            att.LayerIndex = layerIndex;
            __out.Add("Added new layer to the document at position " + layerIndex + " named " + layer + ". ");
          }else{
            __out.Add("Layer did not add. Try cleaning up your layers."); //This never happened to me.
          }
        }else{
          att.LayerIndex = layerIndex;
          __out.Add("Added to existing layer " + layerIndex + " named " + layer + ". ");
        }
      }

      //Set color
      if(color != null)
      {
        att.ColorSource = Rhino.DocObjects.ObjectColorSource.ColorFromObject;
        att.ObjectColor = color;
        att.PlotColorSource = Rhino.DocObjects.ObjectPlotColorSource.PlotColorFromObject;
        att.PlotColor = color;
      }

      //Bake to the right type of object
      switch (obj.ObjectType)
      {
        case Rhino.DocObjects.ObjectType.Brep:
          o_id = doc.Objects.AddBrep((Brep) obj, att);
          break;
        case Rhino.DocObjects.ObjectType.Mesh:
          o_id = doc.Objects.AddMesh((Mesh) obj, att);
          break;

        case Rhino.DocObjects.ObjectType.Point:
          o_id = doc.Objects.AddPoint(((Rhino.Geometry.Point) obj).Location, att);
          break;

        case Rhino.DocObjects.ObjectType.Curve:
          o_id = doc.Objects.AddCurve((Curve) obj, att);
          break;

        default:
          Print("I'm not sure what kind of geometry is coming in the input. Try turning it into a Point, Curve, Mesh, or Brep before the input.");
          return;
      }
      __out.Add("Added " + obj.GetType().Name);

    } else {

      Print("Inactive");
    }
# ---------- end simplebake ----------
